# Grasshopper definition read_xyz_irrad.gh (Grasshopper 1.0.7)

path = FilePath("/Users/jmccarty/Data/221205_ipv_workbench/sketches/steps/sample_irrad_data/sample_xyz_irrad.csv")
file = ReadFile(File=path, PerLineParse=True)
split = TextSplit(Text=file, Separators=",")
tstat = TreeStatistics(Tree=split)  # -> Paths, Length, Count
item = ListItem(List=tstat.Paths, Index=0, Wrap=True)
branch = TreeBranch(Tree=split, Path=item, MaintainPaths=True)
panel = Panel("""X
Y
Z
X_v
Y_v
Z_v
irrad_kWh""")
mindex = MemberIndex(Set=branch, Member=panel)  # -> simplify(Index), Count
bang = ExplodeTree(Data=mindex.Index)  # -> Branch0, Branch1, Branch2, Branch3, Branch4, Branch5, Branch6
item_2 = ListItem(List=split, Index=bang.Branch1, Wrap=True)
item_3 = ListItem(List=split, Index=bang.Branch2, Wrap=True)
item_4 = ListItem(List=split, Index=bang.Branch3, Wrap=True)
item_5 = ListItem(List=split, Index=bang.Branch4, Wrap=True)
item_6 = ListItem(List=split, Index=bang.Branch5, Wrap=True)
item_7 = ListItem(List=split, Index=bang.Branch0, Wrap=True)
flatten = FlattenTree(Tree=item_7, Path="{0}")
flatten_2 = FlattenTree(Tree=item_2, Path="{0}")
flatten_3 = FlattenTree(Tree=item_4, Path="{0}")
flatten_4 = FlattenTree(Tree=item_5, Path="{0}")
flatten_5 = FlattenTree(Tree=item_6, Path="{0}")
flatten_6 = FlattenTree(Tree=item_3, Path="{0}")
sort = SortList(Keys=bang.Branch6)  # -> reverse(Keys), ValuesA
split_2 = SplitList(List=flatten, Index="1")  # -> ListA, ListB
split_3 = SplitList(List=flatten_3, Index="1")  # -> ListA, ListB
split_4 = SplitList(List=flatten_4, Index="1")  # -> ListA, ListB
split_5 = SplitList(List=flatten_5, Index="1")  # -> ListA, ListB
split_6 = SplitList(List=flatten_2, Index="1")  # -> ListA, ListB
split_7 = SplitList(List=flatten_6, Index="1")  # -> ListA, ListB
item_8 = ListItem(List=sort.Keys, Index=0, Wrap=True)
gradient = Gradient(
    LowerLimit=Slider(0, range=0..100),
    UpperLimit=item_8,
    Parameter=bang.Branch6,
    stops=[0: RGB(0, 0, 3), 0.0312: RGB(3, 2, 18), 0.0625: RGB(10, 7, 35), 0.0938: RGB(20, 11, 54), 0.125: RGB(32, 12, 74), 0.156: RGB(46, 10, 90)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])
pt = ConstructPoint(XCoordinate=split_2.ListB, YCoordinate=split_6.ListB, ZCoordinate=split_7.ListB)
vec = VectorXYZ(XComponent=split_3.ListB, YComponent=split_4.ListB, ZComponent=split_5.ListB)  # -> Vector, Length
number_slider = Slider(0.02, range=0..0.1)
amp = Amplitude(Vector=vec.Vector, Amplitude=number_slider)
circle = CircleCNR(Center=pt, Normal=vec.Vector, Radius=number_slider)
move = Move(Geometry=circle, Motion=amp)  # -> Geometry, Transform
srf = Surface(move.Geometry)
preview = CustomPreview(Geometry=srf, Material=gradient)
