# Grasshopper definition 1_cactus_panelizer_template.gh (Grasshopper 1.0.7)
# plug-ins: Pufferfish, HDTTreeUtils, EleFront

# ----
# Panelizer: Connect the project config file to the one that was created for your project.
project_config_file = FilePath()
list = ValueList({"management", "irradiance"}, selected="irradiance")
list_2 = ValueList({"management", "irradiance"}, selected="management")
read_workbench_config = GhPythonScript(config_file=project_config_file, section=list)  # -> out, keys, values
# ---------- read_workbench_config: Python ----------
"""Read the config file for a workbench project."""

__author__ = "jmccarty"



with open(config_file) as fp:
    config = fp.readlines()
    
config = [c.replace("\n","").replace(r"[","").replace(r"]","") for c in config]

if section == 'management':
    management = {}

    for c in config:
        if c == 'management':
            pass
        elif c == 'analysis':
            break
        elif c == 'irradiance':
            break
        elif c == "":
            pass
        else:
            #print(c)
            key = c.split(" = ")[0]
            #print(key)
            value = c.split(" = ")[1]
            #print(value)
            management[key] = value

    keys = list(management.keys())
    values = list(management.values())

elif section == 'analysis':
    out_dict = {}
    line_start = 0
    for n, c in enumerate(config):
        print(c)
        if c == 'analysis':
            line_start = n
            break
        else:
            pass
    for c in config[line_start+1:]:
        if c == "":
            pass
        elif c=='irradiance':
            break
        else:
            #print(c)
            key = c.split(" = ")[0]
            #print(key)
            value = c.split(" = ")[1]
            #print(value)
            out_dict[key] = value
    
    keys = list(out_dict.keys())
    values = list(out_dict.values())

elif section == 'irradiance':
    out_dict = {}
    line_start = 0
    for n, c in enumerate(config):
        if c == 'irradiance':
            line_start = n
            break
        else:
            pass
    for c in config[line_start+1:]:
        if c == "":
            pass
        else:
            #print(c)
            key = c.split(" = ")[0]
            #print(key)
            value = c.split(" = ")[1]
            #print(value)
            out_dict[key] = value

    keys = list(out_dict.keys())
    values = list(out_dict.values())

else:
    out = "section must be either 'management', 'analysis', or 'irradiance'."
# ---------- end read_workbench_config ----------
read_workbench_config_2 = GhPythonScript(config_file=project_config_file, section=list_2)  # -> out, keys, values; same code as read_workbench_config
panel = Panel("""parent_dir
project_name
host_name
scenario_name""")
list_3 = ValueList({"project_data", "raw_host_file", "latitude", "host_name", "exclude_surfaces", "base_epw", "longitude", "timezone", "elevation", "parent_dir", "project_name", "utc", "scenario_name", "tmy_name", "grid_x_mm", "grid_y_mm", "radiance_parameters"}, selected="grid_x_mm")
get_config_value = GhPythonScript(keys=read_workbench_config.keys, values=read_workbench_config.values, search_key=list_3)  # -> out, out_value; inputs keys: list, values: list
# ---------- get_config_value: Python ----------
__author__ = "jmccarty"

import rhinoscriptsyntax as rs

config = dict(zip(keys,values))

out_value = config[search_key]
# ---------- end get_config_value ----------
list_4 = ValueList({"project_data", "raw_host_file", "latitude", "host_name", "exclude_surfaces", "base_epw", "longitude", "timezone", "elevation", "parent_dir", "project_name", "utc", "scenario_name", "tmy_name", "grid_x_mm", "grid_y_mm", "radiance_parameters"}, selected="grid_y_mm")
get_config_value_2 = GhPythonScript(keys=read_workbench_config.keys, values=read_workbench_config.values, search_key=list_4)  # -> out, out_value; inputs keys: list, values: list; same code as get_config_value
panel_2 = Panel("""parent_dir
project_name
host_name
scenario_name""")
get_config_value_3 = GhPythonScript(keys=read_workbench_config_2.keys, values=read_workbench_config_2.values, search_key=panel_2)  # -> out, out_value; inputs keys: list, values: list; same code as get_config_value
list_5 = ValueList({"project_data", "raw_host_file", "latitude", "host_name", "exclude_surfaces", "base_epw", "longitude", "timezone", "elevation", "parent_dir", "project_name", "utc", "scenario_name", "tmy_name", "grid_x_mm", "grid_y_mm", "radiance_parameters"}, selected="parent_dir")
list_6 = ValueList({"project_data", "raw_host_file", "latitude", "host_name", "exclude_surfaces", "base_epw", "longitude", "timezone", "elevation", "parent_dir", "project_name", "utc", "scenario_name", "tmy_name", "grid_x_mm", "grid_y_mm", "radiance_parameters"}, selected="host_name")
get_config_value_4 = GhPythonScript(keys=read_workbench_config_2.keys, values=read_workbench_config_2.values, search_key=list_6)  # -> out, out_value; inputs keys: list, values: list; same code as get_config_value
get_config_value_5 = GhPythonScript(keys=read_workbench_config_2.keys, values=read_workbench_config_2.values, search_key=panel)  # -> out, out_value; inputs keys: list, values: list; same code as get_config_value
locate_device_data = GhPythonScript(config_keys=panel_2, config_values=get_config_value_3.out_value)  # -> out, out_dir, out_name, out_file; inputs config_keys: list, config_values: list
# ---------- locate_device_data: Python ----------
"""Creates the file path to save the 
    geometry file out of the template"""

__author__ = "jmccarty"

import os 
 

config_inputs = dict(zip(config_keys,config_values))

parent_dir = config_inputs['parent_dir']
project_name = config_inputs['project_name']
host_name = config_inputs['host_name']
scenario_name = config_inputs['scenario_name']

out_dir = os.path.join(parent_dir, project_name, "inputs", "shared", "cell_module_data")
out_name = "cactus_devices.csv"

out_file = os.path.join(out_dir,out_name)
# ---------- end locate_device_data ----------
locate_geometry_file = GhPythonScript(config_keys=panel_2, config_values=get_config_value_3.out_value)  # -> out, out_dir, out_name, out_file; inputs config_keys: list, config_values: list
# ---------- locate_geometry_file: Python ----------
"""Creates the file path to save the 
    geometry file out of the template"""

__author__ = "jmccarty"

import os 
 

config_inputs = dict(zip(config_keys,config_values))

parent_dir = config_inputs['parent_dir']
project_name = config_inputs['project_name']
host_name = config_inputs['host_name']
scenario_name = config_inputs['scenario_name']

out_dir = os.path.join(parent_dir, project_name, "inputs", "hosts", host_name, scenario_name, "geometry")
out_name = "1_geometry.3dm"

out_file = os.path.join(out_dir,out_name)
# ---------- end locate_geometry_file ----------
locate_panelizer_dir = GhPythonScript(config_keys=panel, config_values=get_config_value_5.out_value)  # -> out, out_dir; inputs config_keys: list, config_values: list
# ---------- locate_panelizer_dir: Python ----------
"""Creates the file path to save the 
    geometry file out of the template"""

__author__ = "jmccarty"

import os 
 

config_inputs = dict(zip(config_keys,config_values))

parent_dir = config_inputs['parent_dir']
project_name = config_inputs['project_name']
host_name = config_inputs['host_name']
scenario_name = config_inputs['scenario_name']

out_dir = os.path.join(parent_dir, project_name, "inputs", "hosts", host_name, scenario_name, "panelizer")
# ---------- end locate_panelizer_dir ----------

list_7 = ValueList({"management", "analysis", "irradiance"}, selected="analysis")
read_workbench_config_3 = GhPythonScript(config_file=project_config_file, section=list_7)  # -> out, keys, values; same code as read_workbench_config
list_8 = ValueList({"project_data", "raw_host_file", "latitude", "host_name", "exclude_surfaces", "base_epw", "longitude", "timezone", "elevation", "parent_dir", "project_name", "utc", "scenario_name", "tmy_name", "device_id", "module_orientation", "grid_x_mm", "grid_y_mm", "radiance_parameters"}, selected="device_id")
get_config_value_6 = GhPythonScript(keys=read_workbench_config_3.keys, values=read_workbench_config_3.values, search_key=list_8)  # -> out, out_value; inputs keys: list, values: list; same code as get_config_value
cell_info_table = FilePath(locate_device_data.out_file)

# ---- group: Control Panel
enable_panelizer = BooleanToggle(False)
write_panelizer = BooleanToggle(False)
enable_cell_creation = BooleanToggle(False)
enable_radiance_writer = BooleanToggle(False)

# ----
write_radiance = BooleanToggle(False)
path = FilePath("/Users/jmccarty/Data/230110_cisbat_carbon/02_model/panelizer_models/")
host_name_to_path = GhPythonScript(host_name=get_config_value_4.out_value)  # -> out, root
# ---------- host_name_to_path: Python ----------
__author__ = "jmccarty"

import re
root = re.sub("[^0-9]", "", host_name)
# ---------- end host_name_to_path ----------

# ---- group: Deconstruct Template Model
panel_3 = Panel("""output_host
output_host_obstructions
output_terrain
output_host_windows
output_vegetation_seasonal
output_vegetation_constant
output_opaque_context
output_raised_surfaces
output_integrated_surfaces""")
_3dm = Import3DM(File=locate_geometry_file.out_file, Layer=graft(panel_3), Name="*")  # -> simplify(Geometry)
mindex = MemberIndex(Set=panel_3, Member="output_raised_surfaces")  # -> Index, Count
mindex_2 = MemberIndex(Set=panel_3, Member="output_integrated_surfaces")  # -> Index, Count
mindex_3 = MemberIndex(Set=panel_3, Member="output_vegetation_constant")  # -> Index, Count
mindex_4 = MemberIndex(Set=panel_3, Member="output_opaque_context")  # -> Index, Count
mindex_5 = MemberIndex(Set=panel_3, Member="output_host")  # -> Index, Count
mindex_6 = MemberIndex(Set=panel_3, Member="output_host_obstructions")  # -> Index, Count
mindex_7 = MemberIndex(Set=panel_3, Member="output_terrain")  # -> Index, Count
mindex_8 = MemberIndex(Set=panel_3, Member="output_host_windows")  # -> Index, Count
mindex_9 = MemberIndex(Set=panel_3, Member="output_vegetation_seasonal")  # -> Index, Count
branch = TreeBranch(Tree=_3dm, Path=mindex.Index, MaintainPaths=True)
branch_2 = TreeBranch(Tree=_3dm, Path=mindex_2.Index, MaintainPaths=True)
branch_3 = TreeBranch(Tree=_3dm, Path=mindex_3.Index, MaintainPaths=True)
branch_4 = TreeBranch(Tree=_3dm, Path=mindex_4.Index, MaintainPaths=True)
branch_5 = TreeBranch(Tree=_3dm, Path=mindex_5.Index, MaintainPaths=True)
branch_6 = TreeBranch(Tree=_3dm, Path=mindex_6.Index, MaintainPaths=True)
branch_7 = TreeBranch(Tree=_3dm, Path=mindex_7.Index, MaintainPaths=True)
branch_8 = TreeBranch(Tree=_3dm, Path=mindex_8.Index, MaintainPaths=True)
branch_9 = TreeBranch(Tree=_3dm, Path=mindex_9.Index, MaintainPaths=True)
flatten = FlattenTree(Tree=branch_5, Path=host_name_to_path.root)
terrain = Brep(branch_7)
flatten_2 = FlattenTree(Tree=branch_6, Path=host_name_to_path.root)
merge = Merge(Data1=branch, Data2=branch_2)
flatten_3 = FlattenTree(Tree=merge, Path=host_name_to_path.root)
area = Area(Geometry=flatten_3)  # -> Area, Centroid
sort_pt = SortPoints(Points=area.Centroid)  # -> Points, Indices
item = ListItem(List=flatten_3, Index=sort_pt.Indices, Wrap=True)  # -> graft(Item)

# ---- group: Remove down facing surfaces
brep = Brep(item)
area_2 = Area(Geometry=brep)  # -> Area, Centroid
evalsrf = EvaluateSurface(Surface=brep, Point=area_2.Centroid)  # -> Point, Normal, UDirection, VDirection, Frame
devec = DeconstructVector(Vector=evalsrf.Normal)  # -> XComponent, YComponent, ZComponent
smaller = SmallerThan(FirstNumber=devec.ZComponent, SecondNumber=0)  # -> SmallerThan, OrEqualTo
dispatch = Dispatch(List=brep, DispatchPattern=smaller.SmallerThan)  # -> ListA, ListB
brep_2 = Brep(dispatch.ListB)

# ---- group: Get Lower Left
flatten_4 = FlattenTree(Tree=brep_2, Path=host_name_to_path.root)  # -> graft(Tree)
area_3 = Area(Geometry=flatten_4)  # -> Area, Centroid
vec = VectorXYZ(XComponent=Slider(0, range=0..100), YComponent=Slider(1, range=0..1), ZComponent=Slider(0, range=0..100))  # -> Vector, Length
evalsrf_2 = EvaluateSurface(Surface=flatten_4, Point=area_3.Centroid)  # -> Point, Normal, UDirection, VDirection, Frame
debrep = DeconstructBrep(Brep=flatten_4)  # -> Faces, Edges, Vertices
trim = TrimTree(Tree=debrep.Vertices, Depth=1)
pdecon = Deconstruct(Point=trim)  # -> XComponent, YComponent, ZComponent
sort = SortList(Keys=pdecon.ZComponent)  # -> Keys, ValuesA
cset = CreateSet(List=sort.Keys)  # -> Set, Map
item_2 = ListItem(List=cset.Set, Index=0, Wrap=True)
mindex_10 = MemberIndex(Set=pdecon.ZComponent, Member=item_2)  # -> Index, Count
trim_2 = TrimTree(Tree=mindex_10.Index, Depth=1)
item_3 = ListItem(List=trim, Index=trim_2, Wrap=True)
calc_angle_from_north = GhPythonScript(north_vector=vec.Vector, vector_b=evalsrf_2.Normal)  # -> out, angle; inputs north_vector: Vector3d, vector_b: Vector3d
# ---------- calc_angle_from_north: Python ----------
__author__ = "jmccarty_teach"

import rhinoscriptsyntax as rs
import math


x1 = north_vector.X
x2 = vector_b.X
y1 = north_vector.Y
y2 = vector_b.Y

a = (x1,y1)
b = (x2,y2)

ang1 = math.atan2(*a[::-1])
ang2 = math.atan2(*b[::-1])

angle = math.degrees((ang1 - ang2) % (2 * math.pi))
# ---------- end calc_angle_from_north ----------
pdecon_2 = Deconstruct(Point=item_3)  # -> XComponent, YComponent, ZComponent
angle_sorter = GhPythonScript(angle=calc_angle_from_north.angle, X=pdecon_2.XComponent, Y=pdecon_2.YComponent)  # -> out, dir, key; inputs X: list, Y: list
# ---------- angle_sorter: Python ----------
__author__ = "jmccarty_teach"

import rhinoscriptsyntax as rs
if angle < 90:
    print("North, largest X")
    dir = "X"
    key = max(X)
elif 90 <= angle < 180:
    print("East, lowest Y")
    dir = "Y"
    key = min(Y)
elif 180 <= angle < 270:
    print("South, lowest X")
    dir = "X"
    key = min(X)
elif angle >= 270:
    print("West, largest Y")
    dir = "Y"
    key = max(Y)
# ---------- end angle_sorter ----------
python = GhPythonScript(dir=angle_sorter.dir, key=angle_sorter.key, x_list=pdecon_2.XComponent, y_list=pdecon_2.YComponent)  # -> out, out_dir, index; inputs x_list: list, y_list: list
# ---------- python: Python ----------
__author__ = "jmccarty_teach"

import rhinoscriptsyntax as rs

if dir=="X":
    out_dir = "X"
    index = x_list.index(key)
else:
    out_dir = "Y"
    index = y_list.index(key)
# ---------- end python ----------
item_4 = ListItem(List=item_3, Index=python.index, Wrap=True)

# ---- group: Dispatch Flat Roof
evalsrf_3 = EvaluateSurface(Surface=flatten_4, Point=item_4)  # -> Point, Normal, UDirection, VDirection, Frame
devec_2 = DeconstructVector(Vector=evalsrf_3.Normal)  # -> XComponent, YComponent, ZComponent
equalst = EqualityWithinTolerance(FirstNumber=devec_2.ZComponent, SecondNumber=Slider(1, range=-1..1), Tolerance=Slider(1e-05, range=0..1e-05))  # -> Equality, Inequality
dispatch_2 = Dispatch(List=flatten_4, DispatchPattern=equalst.Equality)  # -> ListA, ListB
dispatch_3 = Dispatch(List=evalsrf_3.Normal, DispatchPattern=equalst.Equality)  # -> ListA, ListB
dispatch_4 = Dispatch(List=item_4, DispatchPattern=equalst.Equality)  # -> ListA, ListB
clean = CleanTree(RemoveNulls=True, RemoveInvalid=True, RemoveEmpty=True, Tree=dispatch_2.ListB)
clean_2 = CleanTree(RemoveNulls=True, RemoveInvalid=True, RemoveEmpty=True, Tree=dispatch_4.ListB)
clean_3 = CleanTree(RemoveNulls=True, RemoveInvalid=True, RemoveEmpty=True, Tree=dispatch_3.ListB)

# ---- group: Tilted Surfaces
wires = BrepWireframe(Brep=clean, Density=-1)
trim_helper = TrimHelper(output_paths=wires, input_paths=clean_2)
crv_cp = CurveClosestPoint(Point=clean_2, Curve=trim_helper)  # -> Point, Parameter, Distance
smaller_2 = SmallerThan(FirstNumber=crv_cp.Distance, SecondNumber=Slider(0.002, range=0..0.01))  # -> SmallerThan, OrEqualTo
dispatch_5 = Dispatch(List=trim_helper, DispatchPattern=smaller_2.SmallerThan)  # -> ListA, ListB
midpt = CurveMiddle(Curve=dispatch_5.ListA)
pdecon_3 = Deconstruct(Point=midpt)  # -> XComponent, YComponent, ZComponent
pdecon_4 = Deconstruct(Point=clean_2)  # -> XComponent, YComponent, ZComponent
subtraction = Subtraction(A=pdecon_4.ZComponent, B=pdecon_3.ZComponent)
abs = Absolute(Value=subtraction)
sort_2 = SortList(Keys=abs, ValuesA=midpt)  # -> Keys, ValuesA
pl = PlaneNormal(Origin=clean_2, ZAxis=clean_3)
item_5 = ListItem(List=sort_2.ValuesA, Index=-1, Wrap=True)
item_6 = ListItem(List=sort_2.ValuesA, Index=0, Wrap=True)
toggle = BooleanToggle(True)
vec2pt = Vector2Pt(PointA=clean_2, PointB=item_6, Unitize=toggle)  # -> Vector, Length
vec2pt_2 = Vector2Pt(PointA=clean_2, PointB=item_5, Unitize=toggle)  # -> Vector, Length
align = AlignPlane(Plane=pl, Direction=vec2pt_2.Vector)  # -> Plane, Angle
align_2 = AlignPlane(Plane=pl, Direction=vec2pt.Vector)  # -> Plane, Angle

# ----
deplane = DeconstructPlane(Plane=align_2.Plane)  # -> Origin, XAxis, YAxis, ZAxis
deplane_2 = DeconstructPlane(Plane=align.Plane)  # -> Origin, XAxis, YAxis, ZAxis
angle = Angle(VectorA=vec2pt_2.Vector, VectorB=deplane.YAxis)  # -> Angle, Reflex
angle_2 = Angle(VectorA=vec2pt.Vector, VectorB=deplane_2.YAxis)  # -> Angle, Reflex
merge_2 = Merge(Data1=angle.Angle, Data2=angle_2.Angle)
merge_3 = Merge(Data1=align_2.Plane, Data2=align.Plane)
sort_3 = SortList(Keys=merge_2, ValuesA=merge_3)  # -> Keys, ValuesA
item_7 = ListItem(List=sort_3.ValuesA, Index=0, Wrap=True)

# ---- group: Panelizer Distribution / Surface Origins
pt = Point(item_4)

# ---- group: Panelizer Distribution / Original Surfaces
srf = Surface(flatten_4)

# ---- group: Panelizer Distribution / Building
building_number = Number(host_name_to_path.root)

# ---- group: Enable Radiance Model Builder
python_gate = GhPythonScript(object_to_pass=srf, pass_object=enable_radiance_writer)  # -> out, out_object
# ---------- python_gate: Python ----------
__author__ = "jmccarty"

import rhinoscriptsyntax as rs

if pass_object:
    out_object=object_to_pass
else:
    out_object=None
# ---------- end python_gate ----------

# ---- group: Enable Panelizer
python_gate_2 = GhPythonScript(object_to_pass=srf, pass_object=enable_panelizer)  # -> out, out_object; same code as python_gate
python_gate_3 = GhPythonScript(object_to_pass=pt, pass_object=enable_panelizer)  # -> out, out_object; same code as python_gate

# ---- group: Surface Setup / Base Surface
srf_2 = Surface(python_gate_2.out_object)

# ---- group: Radiance Writer
brep_3 = Brep(terrain)
area_4 = Area(Geometry=brep_3)  # -> Area, Centroid
evalsrf_4 = EvaluateSurface(Surface=brep_3, Point=area_4.Centroid)  # -> Point, Normal, UDirection, VDirection, Frame
number_slider = Slider(0.5, range=0..1)
number_slider_2 = Slider(0.5, range=0..1)
devec_3 = DeconstructVector(Vector=evalsrf_4.Normal)  # -> XComponent, YComponent, ZComponent
searchmods = HBSearchMofidiers(keywords="context")  # -> modifiers; plug-in component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
smaller_3 = SmallerThan(FirstNumber=devec_3.ZComponent, SecondNumber=0)  # -> SmallerThan, OrEqualTo
glassmod3 = HBGlassModifier3(
    name="seasonal_hull",
    r_trans=number_slider,
    g_trans=number_slider,
    b_trans=number_slider,
    refract=Slider(1.2, range=0..10))  # -> modifier; plug-in component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
glassmod3_2 = HBGlassModifier3(
    name="constant_hull",
    r_trans=number_slider_2,
    g_trans=number_slider_2,
    b_trans=number_slider_2,
    refract=Slider(1.2, range=0..10))  # -> modifier; plug-in component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
panel_4 = Panel("seasonal_vegetation")
panel_5 = Panel("constant_vegetation")
python_2 = GhPythonScript(down=smaller_3.SmallerThan, normal=brep_3)  # -> out, a; inputs down: Boolean, normal: Surface
# ---------- python_2: Python ----------
__author__ = "jmccarty"

import rhinoscriptsyntax as rs
import Rhino
import ghpythonlib.components as ghc

srf =Rhino.Geometry.Brep.CreateFromSurface(normal)
if down==True:
    flippedSrf, success = ghc.Flip(normal)
    a = flippedSrf
else:
    print("Up")
    a = normal
# ---------- end python_2 ----------
face = HBFace(geo=flatten, name="host", rad_mod=searchmods)  # -> report, faces; plug-in component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
face_2 = HBFace(geo=flatten([flatten_2, branch_4]), name="context", rad_mod=searchmods)  # -> report, faces; plug-in component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
face_3 = HBFace(geo=python_2.a, name="terrain", rad_mod=searchmods)  # -> report, faces; plug-in component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

# ----
number_slider_3 = Slider(0.25, range=0..1)
number_slider_4 = Slider(37, range=0..60)
number_slider_5 = Slider(40, range=0..40)
aperture = HBAperture(geo=branch_3, name=panel_5, rad_mod=glassmod3_2)  # -> report, apertures; plug-in component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
aperture_2 = HBAperture(geo=branch_9, name=panel_4, rad_mod=glassmod3)  # -> report, apertures; plug-in component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
number_slider_6 = Slider(0.25, range=0..1)
number_slider_7 = Slider(11, range=0..20)
number_slider_8 = Slider(0.25, range=0..1)
number_slider_9 = Slider(20, range=0..20)

# ---- group: Writer / Potential Front Films
list_9 = ValueList({"Clear": "solar_glass", "Light Gray": "light_grey", "White": "basic_white"}, selected="Clear")
list_10 = ValueList({"Clear": "solar_glass", "Light Gray": "light_grey", "White": "basic_white"}, selected="White")
list_11 = ValueList({"Clear": "solar_glass", "Light Gray": "light_grey", "White": "basic_white"}, selected="Light Gray")

# ---- group: Writer / Write Path
concat = Concatenate(FragmentA=get_config_value_6.out_value, FragmentC="_", FragmentB=list_9)
python_3 = GhPythonScript(dir=locate_panelizer_dir.out_dir, file_name=concat, host_name=get_config_value_4.out_value)  # -> out, write_path
# ---------- python_3: Python ----------
__author__ = "jmccarty"

import rhinoscriptsyntax as rs
import os

write_path = os.path.join(dir,file_name+"_"+host_name+"_raw.pickle")
# ---------- end python_3 ----------

# ---- group: Get Cell and Module Information
file = ReadFile(File=cell_info_table, PerLineParse=True)
split = TextSplit(Text=file, Separators=",")
flip = FlipMatrix(Data=simplify(split))
panel_6 = Panel("{0;0}")
split_2 = SplitList(List=flip, Index=Slider(1, range=0..100))  # -> ListA, ListB
pd = PathDescription(Data=split_2.ListA)
cset_2 = CreateSet(List=flatten(split_2.ListA))  # -> Set, Map

# ---- group: Get Cell and Module Information / Values
split_3 = SplitTree(Data=split_2.ListB, Masks=flatten(panel_6))  # -> Positive, Negative

# ---- group: Get Cell and Module Information / Keys
split_4 = SplitTree(Data=split_2.ListA, Masks=flatten(panel_6))  # -> Positive, Negative

# ---- group: Get Cell and Module Information / Get Column
mindex_11 = MemberIndex(Set=cset_2.Set, Member="general_device_id")  # -> Index, Count
item_8 = ListItem(List=flatten(pd), Index=mindex_11.Index, Wrap=True)
branch_10 = TreeBranch(Tree=split_2.ListB, Path=item_8, MaintainPaths=True)

# ---- group: Get Cell and Module Information (continued)
mindex_12 = MemberIndex(Set=branch_10, Member=get_config_value_6.out_value)  # -> Index, Count

# ----
item_9 = ListItem(List=split_4.Negative, Index=mindex_12.Index, Wrap=True)  # -> flatten(Item)
item_10 = ListItem(List=split_3.Negative, Index=mindex_12.Index, Wrap=True)  # -> flatten(Item)
concat_2 = Concatenate(FragmentA=item_9, FragmentB=" : ", FragmentC=item_10)
panel_7 = Panel(concat_2)
read_module_info = GhPythonScript(keys=item_9, values=item_10)  # -> out, port, cell_type, cec_key, port_2, n_cols, cell_width, module_width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; inputs keys: list, values: list
# ---------- read_module_info: Python ----------
__author__ = "jmccarty"

import rhinoscriptsyntax as rs
from ast import literal_eval

string_keys = ["general_device_summary","general_device_id","scenario","general_cell_type","general_heterojunction","general_monolithic","general_description","module_shape_flex","shape_orientation"]
int_keys = ["module_shape_N_columns_typical","module_shape_N_rows_typical","bishop_N_s_typical","bishop_N_p_typical"]
mm_keys = ["general_cell_width_mm_typical","general_cell_height_mm_typical","module_shape_column_spacing_mm","module_shape_row_spacing_mm","module_shape_frame_thickness_mm","module_shape_width_mm","module_shape_height_mm"]

new_keys = []
new_values = []
for n, v in enumerate(values):
    k = keys[n]
    new_keys.append(k)
    
    if k in string_keys:
        new_values.append(v)
    elif k==int_keys:
        new_values.append(int(v))
    else:
        new_values.append(float(v))

final_keys = []
final_values = []

for n, v in enumerate(new_values):
    k = new_keys[n]
    final_keys.append(k)
    if k in mm_keys:
        final_values.append(float(v) / 1000)
    else:
        final_values.append(v)

parameters = dict(zip(final_keys,final_values))

for k,v in parameters.items():
    print(k,v, type(v))

#------------

cell_type = parameters["general_cell_type"]
cec_key = None#parameters["cec_database_key"]

n_cols = parameters['module_shape_N_columns_typical']
cell_width = parameters['general_cell_width_mm_typical']
module_width = parameters['module_shape_width_mm']
Nsubcell_col = parameters['module_n_subcell_cols_typical']
cell_col_spacing = parameters['module_shape_column_spacing_mm']
if n_cols==1:
    subcell_width = (n_cols*cell_width) / Nsubcell_col
else:
    subcell_width = cell_width
n_cols_subcell = int(n_cols * Nsubcell_col)
n_cols_ideal = int(parameters['module_shape_N_columns_typical'] * Nsubcell_col)


n_rows = parameters['module_shape_N_rows_typical']
cell_height = parameters['general_cell_height_mm_typical']
module_height = parameters['module_shape_height_mm']
Nsubcell_row = parameters['module_n_subcell_rows_typical']
cell_row_spacing = parameters['module_shape_row_spacing_mm']
if n_rows==1:
    subcell_height = (n_rows*cell_height) / Nsubcell_row
else:
    subcell_height = cell_height
n_rows_subcell = int(n_rows * Nsubcell_row)
n_rows_ideal = int(parameters['module_shape_N_rows_typical'] * Nsubcell_row)


min_cell_module = int((parameters['bishop_N_s_typical']*parameters['bishop_N_p_typical'])*0.25)#parameters['min_cell_module']
n_submodule = parameters['bishop_N_p_typical']

frame_size = parameters['module_shape_frame_thickness_mm']
# ---------- end read_module_info ----------
multiplication = Multiplication(A=read_module_info.n_cols_subcell, B=read_module_info.n_rows_subcell)

# ---- group: Panelizer Distribution / cell_spacing
cell_cols_spacing = Number(read_module_info.cell_col_spacing)
cell_row_spacing = Number(read_module_info.cell_row_spacing)

# ---- group: Panelizer Distribution / frame_thickness
num = Number(read_module_info.frame_size)

# ---- group: Panelizer Distribution / num_cell_columns
num_2 = Number(read_module_info.n_cols_subcell)

# ---- group: Panelizer Distribution / module_width
num_3 = Number(read_module_info.module_width)

# ---- group: Panelizer Distribution / num_cell_rows
num_4 = Number(read_module_info.n_rows_subcell)

# ---- group: Panelizer Distribution / cell_height
num_5 = Number(read_module_info.subcell_height)

# ---- group: Panelizer Distribution / module_height
num_6 = Number(read_module_info.module_height)

# ---- group: Panelizer Distribution / minimum_cell_count
num_7 = Number(read_module_info.min_cell_module)

# ---- group: Panelizer Distribution / cell_width
num_8 = Number(read_module_info.subcell_width)

# ---- group: Flat Roof PLanes
clean_4 = CleanTree(RemoveNulls=True, RemoveInvalid=True, RemoveEmpty=True, Tree=dispatch_4.ListA)
clean_5 = CleanTree(RemoveNulls=True, RemoveInvalid=True, RemoveEmpty=True, Tree=dispatch_2.ListA)
wires_2 = BrepWireframe(Brep=clean_5, Density=-1)
pt_2 = Point(clean_4)
trim_helper_2 = TrimHelper(output_paths=wires_2, input_paths=pt_2)

# ---- group: Flat Roof PLanes / Join boundary curves for each surface and find the outside curve by comparing the area of any curves in the set.
join = JoinCurves(Curves=trim_helper_2, Preserve=False)

# ---- group: Flat Roof PLanes (continued)
area_5 = Area(Geometry=join)  # -> Area, Centroid

# ---- group: Flat Roof PLanes / Join boundary curves for each surface and find the outside curve by comparing the area of any curves in the set. (continued)
sort_4 = SortList(Keys=area_5.Area, ValuesA=join)  # -> Keys, reverse(ValuesA)
item_11 = ListItem(List=sort_4.ValuesA, Index=0, Wrap=True)
trim_helper_3 = TrimHelper(output_paths=item_11, input_paths=pt_2)

# ---- group: Flat Roof PLanes / generate curve to all segments from boundary origin. test if midpoint of new curve intersects with the boundary curve. use this to build initial plane.
midpt_2 = CurveMiddle(Curve=trim_helper_2)
ln = Line(StartPoint=pt_2, EndPoint=midpt_2)
len = Length(Curve=ln)
sort_5 = SortList(Keys=len, ValuesA=ln)  # -> Keys, ValuesA
midpt_3 = CurveMiddle(Curve=sort_5.ValuesA)
incurve = PointInCurve(Point=midpt_3, Curve=trim_helper_3)  # -> Relationship, Point
equals = Equality(FirstNumber=incurve.Relationship, SecondNumber=Slider(1, range=0..1))  # -> Equality, Inequality
dispatch_6 = Dispatch(List=midpt_3, DispatchPattern=equals.Equality)  # -> ListA, ListB
pt_3 = Point(dispatch_6.ListA)
split_5 = SplitList(List=pt_3, Index=Slider(1, range=0..1))  # -> ListA, ListB
trim_helper_4 = TrimHelper(output_paths=split_5.ListB, input_paths=pt_3)
trim_helper_5 = TrimHelper(output_paths=split_5.ListA, input_paths=pt_3)
pl_3pt = Plane3Pt(PointA=pt_2, PointB=trim_helper_5, PointC=trim_helper_4)
deplane_3 = DeconstructPlane(Plane=pl_3pt)  # -> Origin, XAxis, YAxis, ZAxis

# ---- group: Flat Roof PLanes / Create base XY plane and align. Test aligns to see which has X and Y vectors that lie on the surface boundary
xy = XYPlane(Origin=pt_2)
align_3 = AlignPlane(Plane=xy, Direction=deplane_3.XAxis)  # -> Plane, Angle
align_4 = AlignPlane(Plane=xy, Direction=deplane_3.YAxis)  # -> Plane, Angle
deplane_4 = DeconstructPlane(Plane=align_3.Plane)  # -> Origin, XAxis, YAxis, ZAxis
deplane_5 = DeconstructPlane(Plane=align_4.Plane)  # -> Origin, XAxis, YAxis, ZAxis
vdis = VectorDisplay(Anchor=pt_2, Vector=deplane_5.XAxis)
vdis_2 = VectorDisplay(Anchor=pt_2, Vector=deplane_5.YAxis)
number_slider_10 = Slider(0.1, range=0..0.1)
line = LineSDL(Start=pt_2, Direction=deplane_4.XAxis, Length=number_slider_10)
line_2 = LineSDL(Start=pt_2, Direction=deplane_4.YAxis, Length=number_slider_10)
line_3 = LineSDL(Start=pt_2, Direction=deplane_5.XAxis, Length=number_slider_10)
line_4 = LineSDL(Start=pt_2, Direction=deplane_5.YAxis, Length=number_slider_10)
end = EndPoints(Curve=line)  # -> Start, End
end_2 = EndPoints(Curve=line_2)  # -> Start, End
end_3 = EndPoints(Curve=line_3)  # -> Start, End
end_4 = EndPoints(Curve=line_4)  # -> Start, End
incurve_2 = PointInCurve(Point=end_2.End, Curve=trim_helper_3)  # -> Relationship, Point
incurve_3 = PointInCurve(Point=end_4.End, Curve=trim_helper_3)  # -> Relationship, Point
incurve_4 = PointInCurve(Point=end_3.End, Curve=trim_helper_3)  # -> Relationship, Point
incurve_5 = PointInCurve(Point=end.End, Curve=trim_helper_3)  # -> Relationship, Point
addition = Addition(A=incurve_5.Relationship, B=incurve_2.Relationship)
number_slider_11 = Slider(2, range=0..10)
addition_2 = Addition(A=incurve_4.Relationship, B=incurve_3.Relationship)
equals_2 = Equality(FirstNumber=addition_2, SecondNumber=number_slider_11)  # -> Equality, Inequality
equals_3 = Equality(FirstNumber=addition, SecondNumber=number_slider_11)  # -> Equality, Inequality
dispatch_7 = Dispatch(List=align_3.Plane, DispatchPattern=equals_3.Equality)  # -> ListA, ListB
dispatch_8 = Dispatch(List=align_4.Plane, DispatchPattern=equals_2.Equality)  # -> ListA, ListB
merge_4 = Merge(Data1=dispatch_7.ListA, Data2=dispatch_8.ListA)

# ---- group: Planes
merge_5 = Merge(Data1=item_7, Data2=merge_4)

# ----
item_12 = ListItem(List=merge_5, Index=0, Wrap=True)
deplane_6 = DeconstructPlane(Plane=item_12)  # -> Origin, XAxis, YAxis, ZAxis

# ---- group: Panelizer Distribution / Surface Planes
plane = Plane(item_12)

# ---- group: Panelizer Distribution / Surface X Vector
vec_2 = Vector(deplane_6.XAxis)

# ---- group: Panelizer Distribution / Surface Y Vector
vec_3 = Vector(deplane_6.YAxis)

# ---- group: Panelizer Distribution / Surface Z Vector
vec_4 = Vector(deplane_6.ZAxis)

# ----
pln = Plane(item_12)

# ---- group: Surface Setup
pln_2 = Plane(plane)
trim_helper_6 = TrimHelper(output_paths=srf_2, input_paths=srf_2)
area_6 = Area(Geometry=trim_helper_6)  # -> Area, Centroid
sort_6 = SortList(Keys=area_6.Area, ValuesA=trim_helper_6)  # -> Keys, reverse(ValuesA)
item_13 = ListItem(List=sort_6.ValuesA, Index=0, Wrap=True)
brec = BoundingRectangle(Geometry=item_13, Plane=pln_2, Axis=0, Slide=0, Union=True)  # -> Bounding, DimensionX, DimensionY
rec = Rectangle(brec.Bounding)
txt = Text(rec)
trim_helper_7 = TrimHelper(output_paths=txt, input_paths=item_13)

# ----
brec_2 = BoundingRectangle(Geometry=item_13, Plane=pln_2, Axis=0, Slide=0, Union=True)  # -> Bounding, DimensionX, DimensionY

# ---- group: Modulize
python_4 = GhPythonScript(x=trim_helper_7)  # -> out, h, w
# ---------- python_4: Python ----------
__author__ = "jmccarty"

import rhinoscriptsyntax as rs



simple_dims = x.split("Rectangle (")[1].replace(")","")

w = simple_dims.split(",")[0].split("=")[-1]
h = simple_dims.split(",")[1].split("=")[-1]
# ---------- end python_4 ----------
number_slider_12 = Slider(1, range=0..1)
multiplication_2 = Multiplication(A=python_4.h, B=number_slider_12)
multiplication_3 = Multiplication(A=python_4.w, B=number_slider_12)
amp = Amplitude(Vector=vec_2, Amplitude=num_3)
division = Division(A=multiplication_3, B=num_3)
addition_3 = Addition(A=division, B=1)
move = Move(Geometry=pt, Motion=amp)  # -> Geometry, Transform
division_2 = Division(A=multiplication_2, B=num_6)
amp_2 = Amplitude(Vector=vec_3, Amplitude=num_6)
move_2 = Move(Geometry=move.Geometry, Motion=amp_2)  # -> Geometry, Transform
ceil = GhPythonScript(x=addition_3)  # -> out, a
# ---------- ceil: Python ----------
__author__ = "jmccarty"

import rhinoscriptsyntax as rs
import math

a = math.ceil(x)
# ---------- end ceil ----------
addition_4 = Addition(A=division_2, B=1)
rec_2pt = Rectangle2Pt(Plane=pln_2, PointA=pt, PointB=move_2.Geometry, Radius=0)  # -> Rectangle, Length
repeat = RepeatData(Data=num_3, Length=ceil.a)
trim_helper_8 = TrimHelper(output_paths=repeat, input_paths=ceil.a)
ma = MassAddition(Input=trim_helper_8)  # -> Result, PartialResults
number_slider_13 = Slider(0, range=0..100)
ins = InsertItems(List=ma.PartialResults, Item=number_slider_13, Indices=number_slider_13, Wrap=True)
trim_helper_9 = TrimHelper(output_paths=ins, input_paths=ma.PartialResults)
rev = Reverse(Vector=vec_2)
amp_3 = Amplitude(Vector=vec_2, Amplitude=ma.PartialResults)
amp_4 = Amplitude(Vector=rev, Amplitude=trim_helper_9)
move_3 = Move(Geometry=rec_2pt.Rectangle, Motion=amp_3)  # -> Geometry, Transform
move_4 = Move(Geometry=rec_2pt.Rectangle, Motion=amp_4)  # -> Geometry, Transform
ceil_2 = GhPythonScript(x=addition_4)  # -> out, a; same code as ceil
repeat_2 = RepeatData(Data=num_6, Length=ceil_2.a)
group = Group(Objects=[move_3.Geometry, move_4.Geometry])
trim_helper_10 = TrimHelper(output_paths=repeat_2, input_paths=ceil_2.a)
ma_2 = MassAddition(Input=trim_helper_10)  # -> Result, PartialResults
number_slider_14 = Slider(0, range=0..100)
ins_2 = InsertItems(List=ma_2.PartialResults, Item=number_slider_14, Indices=number_slider_14, Wrap=True)
trim_helper_11 = TrimHelper(output_paths=ins_2, input_paths=ma_2.PartialResults)
rev_2 = Reverse(Vector=vec_3)
amp_5 = Amplitude(Vector=vec_3, Amplitude=ma_2.PartialResults)
amp_6 = Amplitude(Vector=rev_2, Amplitude=trim_helper_11)
move_5 = Move(Geometry=group, Motion=amp_5)  # -> Geometry, Transform
move_6 = Move(Geometry=group, Motion=amp_6)  # -> Geometry, Transform
merge_6 = Merge(Data1=move_5.Geometry, Data2=move_6.Geometry)
ungroup = Ungroup(Group=merge_6)
diagonal_transform = DiagonalTransform_2(origin_point=pt, y_vector=vec_3, x_vector=vec_2, module_height=num_6, module_width=num_3)  # -> diagonal_transform, vector_amplitude
trim_helper_12 = TrimHelper(output_paths=ungroup, input_paths=move_6.Geometry)
group_2 = Group(Objects=trim_helper_12)
amp_7 = Amplitude(Vector=diagonal_transform.diagonal_transform, Amplitude=diagonal_transform.vector_amplitude)
move_7 = Move(Geometry=group_2, Motion=amp_7)  # -> Geometry, Transform
ungroup_2 = Ungroup(Group=move_7.Geometry)
trim_helper_13 = TrimHelper(output_paths=ungroup_2, input_paths=move_7.Geometry)

# ---- group: Radiance Writer
rad_cell_height = Number(get_config_value_2.out_value)
rad_cell_width = Number(get_config_value.out_value)
surface_planes = Plane(plane)
surface_z_vector = Vector(deplane_6.ZAxis)
surface_points = Point(item_4)
surface_x_vector = Vector(vec_2)
surface_y_vector = Vector(vec_3)
building_number_2 = Number(building_number)
surfaces = Surface(python_gate.out_object)

# ---- group: Radiance Writer / Convert mm ot meter
division_3 = Division(A=rad_cell_width, B=1000)

# ----
pln_3 = Plane(pln_2)
move_8 = Move(Geometry=pln_3, Motion=amp_3)  # -> Geometry, Transform
move_9 = Move(Geometry=pln_3, Motion=amp_4)  # -> Geometry, Transform
group_3 = Group(Objects=[move_8.Geometry, move_9.Geometry])
move_10 = Move(Geometry=group_3, Motion=amp_5)  # -> Geometry, Transform
move_11 = Move(Geometry=group_3, Motion=amp_6)  # -> Geometry, Transform
merge_7 = Merge(Data1=move_10.Geometry, Data2=move_11.Geometry)
ungroup_3 = Ungroup(Group=merge_7)
trim_helper_14 = TrimHelper(output_paths=ungroup_3, input_paths=move_11.Geometry)
group_4 = Group(Objects=trim_helper_14)
move_12 = Move(Geometry=group_4, Motion=amp_7)  # -> Geometry, Transform
ungroup_4 = Ungroup(Group=move_12.Geometry)
trim_helper_15 = TrimHelper(output_paths=ungroup_4, input_paths=move_12.Geometry)

# ---- group: Trim Modules / Surface Z Vector
rev_3 = Reverse(Vector=vec_4)

# ----
graft = GraftTree(Tree=trim_helper_15, IncludeEmptyLists=True, IncludeNullItems=True)

# ---- group: Surface Explore
number_slider_15 = Slider(1000, range=0..1000)
number_slider_16 = Slider(0, range=0..16)
path_2 = ConstructPath(Indices=[Slider(1008, range=0..10000), Slider(6, range=0..10)])
branch_11 = TreeBranch(Tree=surfaces, Path=path_2, MaintainPaths=True)

# ---- group: Radiance Writer
brec_3 = BoundingRectangle(Geometry=surfaces, Plane=surface_planes, Axis=0, Slide=0, Union=True)  # -> Bounding, DimensionX, DimensionY
rec_2 = Rectangle(brec_3.Bounding)
txt_2 = Text(rec_2)
trim_helper_16 = TrimHelper(output_paths=txt_2, input_paths=surfaces)
python_5 = GhPythonScript(x=trim_helper_16)  # -> out, h, w; same code as python_4

# ---- group: Radiance Writer / Cellulate
number_slider_17 = Slider(1, range=0..1)
multiplication_4 = Multiplication(A=python_5.h, B=number_slider_17)
multiplication_5 = Multiplication(A=python_5.w, B=number_slider_17)
division_4 = Division(A=multiplication_5, B=division_3)
addition_5 = Addition(A=division_4, B=1)
division_5 = Division(A=multiplication_4, B=division_3)
ceil_3 = GhPythonScript(x=addition_5)  # -> out, a; same code as ceil
addition_6 = Addition(A=division_5, B=1)
repeat_3 = RepeatData(Data=division_3, Length=ceil_3.a)
trim_helper_17 = TrimHelper(output_paths=repeat_3, input_paths=ceil_3.a)
ma_3 = MassAddition(Input=trim_helper_17)  # -> Result, PartialResults
number_slider_18 = Slider(0, range=0..100)
ins_3 = InsertItems(List=ma_3.PartialResults, Item=number_slider_18, Indices=number_slider_18, Wrap=True)
trim_helper_18 = TrimHelper(output_paths=ins_3, input_paths=ma_3.PartialResults)
rev_4 = Reverse(Vector=surface_x_vector)
amp_8 = Amplitude(Vector=surface_x_vector, Amplitude=trim_helper_18)
amp_9 = Amplitude(Vector=rev_4, Amplitude=trim_helper_18)
move_13 = Move(Geometry=surface_points, Motion=amp_9)  # -> Geometry, Transform
move_14 = Move(Geometry=surface_points, Motion=amp_8)  # -> Geometry, Transform
ceil_4 = GhPythonScript(x=addition_6)  # -> out, a; same code as ceil
repeat_4 = RepeatData(Data=division_3, Length=ceil_4.a)
trim_helper_19 = TrimHelper(output_paths=repeat_4, input_paths=ceil_4.a)
ma_4 = MassAddition(Input=trim_helper_19)  # -> Result, PartialResults
number_slider_19 = Slider(0, range=0..100)
ins_4 = InsertItems(List=ma_4.PartialResults, Item=number_slider_19, Indices=number_slider_19, Wrap=True)
trim_helper_20 = TrimHelper(output_paths=ins_4, input_paths=ma_4.PartialResults)
rev_5 = Reverse(Vector=surface_y_vector)
amp_10 = Amplitude(Vector=surface_y_vector, Amplitude=trim_helper_20)
amp_11 = Amplitude(Vector=rev_5, Amplitude=trim_helper_20)
diagonal_transform_2 = DiagonalTransform(origin_point=surface_points, y_vector=surface_y_vector, x_vector=surface_x_vector)
python_6 = GhPythonScript(x_increment=division_3, y_increment=division_3)  # -> out, a; same code as python
amp_12 = Amplitude(Vector=diagonal_transform_2, Amplitude=python_6.a)

# ----
split_6 = SplitList(List=move_13.Geometry, Index=1)  # -> ListA, ListB
trim_helper_21 = TrimHelper(output_paths=split_6.ListB, input_paths=move_13.Geometry)

# ---- group: Radiance Writer / Cellulate (continued)
group_5 = Group(Objects=[move_14.Geometry, trim_helper_21])
move_15 = Move(Geometry=group_5, Motion=amp_10)  # -> Geometry, Transform
move_16 = Move(Geometry=group_5, Motion=amp_11)  # -> Geometry, Transform

# ----
split_7 = SplitList(List=move_16.Geometry, Index=1)  # -> ListA, ListB
trim_helper_22 = TrimHelper(output_paths=split_7.ListB, input_paths=move_16.Geometry)

# ---- group: Radiance Writer / Cellulate (continued)
merge_8 = Merge(Data1=move_15.Geometry, Data2=trim_helper_22)
ungroup_5 = Ungroup(Group=merge_8)
trim_helper_23 = TrimHelper(output_paths=ungroup_5, input_paths=move_16.Geometry)
group_6 = Group(Objects=trim_helper_23)
move_17 = Move(Geometry=group_6, Motion=amp_12)  # -> Geometry, Transform

# ---- group: Radiance Writer / Offset from surface
amp_13 = Amplitude(Vector=surface_z_vector, Amplitude=Slider(0.01, range=0..0.01))
move_18 = Move(Geometry=move_17.Geometry, Motion=amp_13)  # -> Geometry, Transform
ungroup_6 = Ungroup(Group=move_18.Geometry)

# ---- group: Radiance Writer / Remove excess points
trim_helper_24 = TrimHelper(output_paths=ungroup_6, input_paths=move_18.Geometry)
rev_6 = Reverse(Vector=surface_z_vector)
meshray = MeshRay(Mesh=surfaces, Point=trim_helper_24, Direction=rev_6)  # -> Point, Hit
dispatch_9 = Dispatch(List=trim_helper_24, DispatchPattern=meshray.Hit)  # -> ListA, ListB

# ----
item_14 = ListItem(List=dispatch_9.ListA, Index=0, Wrap=True)

# ---- group: Trim Modules
brep_4 = Brep(item_13)
edges = BrepEdges(Brep=brep_4)  # -> Naked, Interior, NonManifold
trim_helper_25 = TrimHelper(output_paths=edges.Naked, input_paths=brep_4)
amp_14 = Amplitude(Vector=rev_3, Amplitude=0.1)
rev_7 = Reverse(Vector=rev_3)

# ---- group: Trim Modules / Check in Others
join_2 = JoinCurves(Curves=trim_helper_25, Preserve=False)
trim_helper_26 = TrimHelper(output_paths=join_2, input_paths=trim_helper_25)
null = NullItem(Item=trim_helper_26)  # -> NullFlags, InvalidFlags, Description
dispatch_10 = Dispatch(List=trim_helper_26, DispatchPattern=null.InvalidFlags)  # -> ListA, ListB
crv = Curve(dispatch_10.ListB)

# ---- group: Trim Modules (continued)
srfsplit = SurfaceSplit(Surface=trim_helper_13, Curves=crv)
area_7 = Area(Geometry=srfsplit)  # -> Area, Centroid
srf_cp = SurfaceClosestPoint(Point=area_7.Centroid, Surface=srfsplit)  # -> Point, UVPoint, Distance
trim_helper_27 = TrimHelper(output_paths=srf_cp.Point, input_paths=brep_4)
move_19 = Move(Geometry=trim_helper_27, Motion=amp_14)  # -> Geometry, Transform
trim_helper_28 = TrimHelper(output_paths=srfsplit, input_paths=brep_4)
meshray_2 = MeshRay(Mesh=brep_4, Point=move_19.Geometry, Direction=rev_7)  # -> Point, Hit
dispatch_11 = Dispatch(List=trim_helper_28, DispatchPattern=meshray_2.Hit)  # -> ListA, ListB

# ----
lng = ListLength(List=srfsplit)
repeat_5 = RepeatData(Data=graft, Length=lng)
trim_helper_29 = TrimHelper(output_paths=repeat_5, input_paths=srfsplit)
trim_helper_30 = TrimHelper(output_paths=trim_helper_29, input_paths=brep_4)
dispatch_12 = Dispatch(List=trim_helper_30, DispatchPattern=meshray_2.Hit)  # -> ListA, ListB

# ---- group: inputs
module_faces = Surface(dispatch_11.ListA)
cell_height = Number(num_5)
cell_width = Number(num_8)
analysis_normal = Vector(rev_3)
analysis_plane = Plane(plane)
minimum_cell_per_module = Number(num_7)
multiplication_6 = Multiplication(A=cell_width, B=cell_height)

# ----
module_plane = Plane(dispatch_12.ListA)
deplane_7 = DeconstructPlane(Plane=module_plane)  # -> Origin, XAxis, YAxis, ZAxis
amp_15 = Amplitude(Vector=deplane_7.XAxis, Amplitude=number_slider_3)
amp_16 = Amplitude(Vector=deplane_7.YAxis, Amplitude=number_slider_3)
vdis_3 = VectorDisplay(Anchor=deplane_7.Origin, Vector=amp_15)
vdis_4 = VectorDisplay(Anchor=deplane_7.Origin, Vector=amp_16)
item_15 = ListItem(List=deplane_7.Origin, Index=number_slider_4, Wrap=True)
item_16 = ListItem(List=module_faces, Index=number_slider_4, Wrap=True)

# ---- group: Verify Normals
area_8 = Area(Geometry=module_faces)  # -> Area, Centroid
evalsrf_5 = EvaluateSurface(Surface=module_faces, Point=area_8.Centroid)  # -> Point, Normal, UDirection, VDirection, Frame
lng_2 = ListLength(List=evalsrf_5.Normal)
repeat_6 = RepeatData(Data=analysis_normal, Length=lng_2)
trim_helper_31 = TrimHelper(output_paths=repeat_6, input_paths=evalsrf_5.Normal)
flip_2 = Flip(Surface=module_faces)  # -> Surface, Result
equals_4 = Equality(FirstNumber=evalsrf_5.Normal, SecondNumber=trim_helper_31)  # -> Equality, Inequality
dispatch_13 = Dispatch(List=module_faces, DispatchPattern=equals_4.Equality)  # -> ListA, ListB
dispatch_14 = Dispatch(List=flip_2.Surface, DispatchPattern=equals_4.Equality)  # -> ListA, ListB
merge_9 = Merge(Data1=dispatch_13.ListA, Data2=dispatch_14.ListB)

# ----
dispatch_15 = Dispatch(List=module_plane, DispatchPattern=equals_4.Equality)  # -> ListA, ListB
dispatch_16 = Dispatch(List=module_plane, DispatchPattern=equals_4.Equality)  # -> ListA, ListB
merge_10 = Merge(Data1=dispatch_15.ListA, Data2=dispatch_16.ListB)

# ---- group: Test for 4 sides
edges_2 = BrepEdges(Brep=merge_9)  # -> Naked, Interior, NonManifold
lng_3 = ListLength(List=edges_2.Naked)
module_is_regular = GhPythonScript(edge_count=lng_3)  # -> out, answer
# ---------- module_is_regular: Python ----------
__author__ = "jmccarty"

import rhinoscriptsyntax as rs

if 3 <= edge_count <= 4:
    answer=True
else:
    answer=False
# ---------- end module_is_regular ----------
trim_helper_32 = TrimHelper(output_paths=module_is_regular.answer, input_paths=merge_9)
dispatch_17 = Dispatch(List=merge_9, DispatchPattern=trim_helper_32)  # -> ListA, ListB

# ----
len_2 = Length(Curve=edges_2.Naked)
cset_3 = CreateSet(List=len_2)  # -> Set, Map
lng_4 = ListLength(List=cset_3.Set)
equals_5 = Equality(FirstNumber=lng_4, SecondNumber=2)  # -> Equality, Inequality
trim_helper_33 = TrimHelper(output_paths=equals_5.Equality, input_paths=merge_9)
trim_helper_34 = TrimHelper(output_paths=equals_5.Equality, input_paths=merge_9)
dispatch_18 = Dispatch(List=merge_10, DispatchPattern=trim_helper_33)  # -> ListA, ListB
dispatch_19 = Dispatch(List=merge_9, DispatchPattern=trim_helper_34)  # -> ListA, ListB
pln_4 = Plane(dispatch_18.ListA)
pln_5 = Plane(dispatch_18.ListB)
crv_2 = Curve(dispatch_19.ListA)
crv_3 = Curve(dispatch_19.ListB)
item_17 = ListItem(List=pln_4, Index=0, Wrap=True)
item_18 = ListItem(List=crv_2, Index=Slider(10, range=0..10), Wrap=True)

# ---- group: May be red, thats ok. Null testing follows
crv_4 = Curve(crv_3)

# ----
# TODO: Improve this script to minimize partitioning. Likely have to make all iterations of panel combinations and test for the largest and those that only have 4 side.
srf_3 = Surface(crv_4)
null_2 = NullItem(Item=srf_3)  # -> NullFlags, InvalidFlags, Description
dispatch_20 = Dispatch(List=srf_3, DispatchPattern=null_2.NullFlags)  # -> ListA, ListB
toggle_2 = BooleanToggle(True)
clean_6 = CleanTree(RemoveNulls=True, RemoveInvalid=True, RemoveEmpty=toggle_2, Tree=dispatch_20.ListB)
srf_4 = Surface(clean_6)
explode = Explode(Curve=clean_6, Recursive=True)  # -> Segments, Vertices
graft_2 = GraftTree(Tree=srf_4, IncludeEmptyLists=True, IncludeNullItems=True)
end_5 = EndPoints(Curve=explode.Segments)  # -> Start, End
pd_2 = PathDescription(Data=graft_2)
lng_5 = ListLength(List=graft_2)
cset_4 = CreateSet(List=[end_5.Start, end_5.End])  # -> Set, Map
vec_5 = Vector(analysis_normal)
end_6 = EndPoints(Curve=explode.Segments)  # -> Start, End
repeat_7 = RepeatData(Data=analysis_plane, Length=lng_5)
number_slider_20 = Slider(100, range=0..100)
trim_helper_35 = TrimHelper(output_paths=repeat_7, input_paths=analysis_plane)
ext = ExtendCurve(Curve=explode.Segments, Type=0, Start=number_slider_20, End=number_slider_20)
assign_paths = AssignPaths(InputData=flatten(trim_helper_35), PathsToAssign=flatten(pd_2))
pd_3 = PathDescription(Data=ext)
trim_helper_36 = TrimHelper(output_paths=ext, input_paths=vec_5)
lng_6 = ListLength(List=trim_helper_36)
pd_4 = PathDescription(Data=trim_helper_36)
item_19 = ListItem(List=pd_4, Index=0, Wrap=True)
branch_12 = TreeBranch(Tree=vec_5, Path=item_19, MaintainPaths=True)
repeat_8 = RepeatData(Data=branch_12, Length=lng_6)
assign_paths_2 = AssignPaths(InputData=flatten(repeat_8), PathsToAssign=flatten(pd_3))
item_20 = ListItem(List=assign_paths_2, Index=0, Wrap=True)
line_5 = LineSDL(Start=end_6.Start, Direction=item_20, Length=number_slider_20)
rotax = RotateAxis(Geometry=ext, Angle=degrees(Slider(90, range=0..100)), Axis=line_5)  # -> Geometry, Transform
merge_11 = Merge(Data1=ext, Data2=rotax.Geometry)
trim_3 = TrimWithRegion(Curve=merge_11, Region=graft_2, Plane=assign_paths)  # -> Inside, Outside
trim_helper_37 = TrimHelper(output_paths=trim_3.Inside, input_paths=ext)
srfsplit_2 = SurfaceSplit(Surface=graft_2, Curves=trim_helper_37)
trim_helper_38 = TrimHelper(output_paths=srfsplit_2, input_paths=graft_2)

panel_8 = Panel(item_18)
dispatch_21 = Dispatch(List=pln_5, DispatchPattern=null_2.NullFlags)  # -> ListA, ListB
clean_7 = CleanTree(RemoveNulls=True, RemoveInvalid=True, RemoveEmpty=toggle_2, Tree=dispatch_21.ListB)  # -> graft(Tree)

area_9 = Area(Geometry=trim_helper_38)  # -> Area, Centroid
bnd = Bounds(Numbers=area_9.Area)
dedomain = DeconstructDomain(Domain=bnd)  # -> Start, End
gradient = Gradient(
    LowerLimit=dedomain.Start,
    UpperLimit=dedomain.End,
    Parameter=area_9.Area,
    stops=[0: RGB(48, 18, 59), 0.0312: RGB(57, 41, 114), 0.0625: RGB(64, 64, 161), 0.0938: RGB(68, 86, 199), 0.125: RGB(70, 107, 227), 0.156: RGB(70, 127, 246)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])
preview = CustomPreview(Geometry=trim_helper_38, Shader=gradient)

lng_7 = ListLength(List=trim_helper_38)
repeat_9 = RepeatData(Data=clean_7, Length=lng_7)
trim_helper_39 = TrimHelper(output_paths=repeat_9, input_paths=graft_2)

# ---- group: Final Culling of non regaulr modules
edges_3 = BrepEdges(Brep=trim_helper_38)  # -> Naked, Interior, NonManifold
lng_8 = ListLength(List=edges_3.Naked)
module_is_regular_2 = GhPythonScript(edge_count=lng_8)  # -> out, answer; same code as module_is_regular
trim_helper_40 = TrimHelper(output_paths=module_is_regular_2.answer, input_paths=trim_helper_38)
dispatch_22 = Dispatch(List=trim_helper_38, DispatchPattern=trim_helper_40)  # -> ListA, ListB

# ---- group: This exlcudes triangles
equals_6 = Equality(FirstNumber=lng_8, SecondNumber=4)  # -> Equality, Inequality
trim_helper_41 = TrimHelper(output_paths=equals_6.Equality, input_paths=trim_helper_38)
dispatch_23 = Dispatch(List=trim_helper_38, DispatchPattern=trim_helper_41)  # -> ListA, ListB

# ----
dispatch_24 = Dispatch(List=trim_helper_39, DispatchPattern=trim_helper_41)  # -> ListA, ListB
dispatch_25 = Dispatch(List=trim_helper_39, DispatchPattern=trim_helper_40)  # -> ListA, ListB

# ---- group: These are the modules with very tiny cuts
dispatch_26 = Dispatch(List=crv_3, DispatchPattern=null_2.NullFlags)  # -> ListA, ListB
brec_4 = BoundingRectangle(Geometry=dispatch_26.ListA, Plane=analysis_plane, Axis=0, Slide=0, Union=Toggle(False))  # -> Bounding, DimensionX, DimensionY
trim_helper_42 = TrimHelper(output_paths=brec_4.Bounding, input_paths=dispatch_26.ListA)
preview_2 = CustomPreview(Geometry=trim_helper_42, Shader=ColourSwatch(SwatchColor=RGB(0, 0, 0)))

# ----
dispatch_27 = Dispatch(List=pln_5, DispatchPattern=null_2.NullFlags)  # -> ListA, ListB

# ---- group: Clean up extras and take first
brep_5 = Brep(dispatch_22.ListB)
clean_8 = CleanTree(RemoveNulls=True, RemoveInvalid=True, RemoveEmpty=True, Tree=brep_5)
clean_9 = CleanTree(RemoveNulls=True, RemoveInvalid=True, RemoveEmpty=True, Tree=dispatch_25.ListB)
item_21 = ListItem(List=clean_8, Index=0, Wrap=True)
item_22 = ListItem(List=clean_9, Index=0, Wrap=True)

# ----
trim_helper_43 = TrimHelper(output_paths=dispatch_27.ListA, input_paths=dispatch_26.ListA)

# ---- group: Radiance Writer (continued)
cullpt = CullDuplicates(Points=dispatch_9.ListA, Tolerance=0.1, CullMode=3)  # -> Points, Indices, Valence

# ----
trim_helper_44 = TrimHelper(output_paths=cullpt.Indices, input_paths=item_14)
cull_index = CullIndex(List=dispatch_9.ListA, Indices=trim_helper_44, Wrap=True)
trim_helper_45 = TrimHelper(output_paths=cull_index, input_paths=item_14)

# ---- group: Radiance Writer / Keep it Clean
area_10 = Area(Geometry=surfaces)  # -> Area, Centroid
item_23 = ListItem(List=trim_helper_45, Index=0, Wrap=True)
pd_5 = PathDescription(Data=item_23)
round = Round(Number=area_10.Area)  # -> Nearest, Floor, Ceiling
txt_3 = Text(pd_5)
naming_surfaces = GhPythonScript(surface_key=txt_3, area=round.Nearest)  # -> out, out_surface_name; inputs area: Int32
# ---------- naming_surfaces: Python ----------
__author__ = "jmccarty"

import rhinoscriptsyntax as rs

out_surface_name = "radiancesurface_"+str(surface_key)+"_"+str(area)+"sqm"
# ---------- end naming_surfaces ----------
lng_9 = ListLength(List=trim_helper_45)
repeat_10 = RepeatData(Data=surface_z_vector, Length=lng_9)
trim_helper_46 = TrimHelper(output_paths=repeat_10, input_paths=surface_z_vector)

# ---- group: Radiance Writer (continued)
lng_10 = ListLength(List=trim_helper_45)

# ---- group: Radiance Writer / Keep it Clean (continued)
naming_grids = GhPythonScript(surface_key=txt_3, n_sensors=lng_10)  # -> out, out_grid_name
# ---------- naming_grids: Python ----------
__author__ = "jmccarty"

import rhinoscriptsyntax as rs
surface_key = surface_key.replace("{","").replace("}","").replace(";","_")
out_grid_name = "radiancegrid_"+str(surface_key)+"_"+str(n_sensors)+"sensors"
# ---------- end naming_grids ----------

# ---- group: Radiance Writer / Remove Grids that are Smaller than Certain size
larger = LargerThan(FirstNumber=lng_10, SecondNumber=Slider(0, range=0..100))  # -> LargerThan, OrEqualTo
pd_6 = PathDescription(Data=lng_10)
dispatch_28 = Dispatch(List=pd_6, DispatchPattern=larger.LargerThan)  # -> ListA, ListB

# ---- group: Radiance Writer (continued)
branch_13 = TreeBranch(Tree=naming_grids.out_grid_name, Path=dispatch_28.ListA, MaintainPaths=True)
branch_14 = TreeBranch(Tree=trim_helper_45, Path=dispatch_28.ListA, MaintainPaths=True)
branch_15 = TreeBranch(Tree=trim_helper_46, Path=dispatch_28.ListA, MaintainPaths=True)

# ---- group: Radiance Writer / Grid
sensorgrid = HBSensorGrid(name=branch_13, positions=branch_14, directions=branch_15)  # -> grid; plug-in component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

# ---- group: Radiance Writer
model = HBModel(
    faces=flatten([face_3.faces, face.faces, face_2.faces]),
    apertures=flatten([aperture_2.apertures, aperture.apertures]),
    name="hb_model")  # -> report, model; plug-in component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
assigngridsviews = HBAssignGridsAndViews(model=model.model, grids=sensorgrid)  # -> model; plug-in component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

locate_radiance_folder = GhPythonScript(config_keys=panel_2, config_values=get_config_value_3.out_value)  # -> out, out_dir, out_name; inputs config_keys: list, config_values: list
# ---------- locate_radiance_folder: Python ----------
"""Creates the file path to save the 
    geometry file out of the template"""

__author__ = "jmccarty"

import os 
 

config_inputs = dict(zip(config_keys,config_values))

parent_dir = config_inputs['parent_dir']
project_name = config_inputs['project_name']
host_name = config_inputs['host_name']
scenario_name = config_inputs['scenario_name']

out_dir = os.path.join(parent_dir, project_name, "inputs", "hosts", host_name, scenario_name, 'radiance')
out_name = host_name
# ---------- end locate_radiance_folder ----------
branch_16 = TreeBranch(Tree=txt_3, Path=dispatch_28.ListA, MaintainPaths=True)
python_7 = GhPythonScript(dir=locate_radiance_folder.out_dir, building=locate_radiance_folder.out_name, surface=branch_16)  # -> out, a
# ---------- python_7: Python ----------
__author__ = "jmccarty"

import rhinoscriptsyntax as rs
import os

surface_clean = surface.replace("{","").replace("}","").replace(";","_")
out_dir = os.path.join(dir,surface_clean)

if os.path.exists(out_dir):
    pass
else:
    os.makedirs(out_dir)
a = out_dir
# ---------- end python_7 ----------
pd_7 = PathDescription(Data=branch_16)  # -> flatten(Paths)
assign_paths_3 = AssignPaths(InputData=flatten(python_7.a), PathsToAssign=flatten(pd_7))
modeltorad = HBModelToRadFolder(model=assigngridsviews, minimal=Toggle(False), folder=assign_paths_3, write=write_radiance)  # -> report, folder; plug-in component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

vizwiref = HBVisualizeWireframe(hb_objs=flatten(assigngridsviews))  # -> geo; plug-in component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

# ----
panel_9 = Panel(python_7.a)

# ---- group: Join Extra Pieces if Possible / Sort Area, Take largest 2, Join, Take 1st
area_11 = Area(Geometry=dispatch_23.ListA)  # -> Area, Centroid
sort_7 = SortList(Keys=area_11.Area, ValuesA=dispatch_23.ListA)  # -> Keys, reverse(ValuesA)

# ----
sort_8 = SortList(Keys=area_11.Area, ValuesA=dispatch_24.ListA)  # -> Keys, reverse(ValuesA)

# ---- group: Join Extra Pieces if Possible
toggle_3 = BooleanToggle(False)

# ---- group: Join Extra Pieces if Possible / Sort Area, Take largest 2, Join, Take 1st (continued)
item_24 = ListItem(List=sort_7.ValuesA, Index=[0, 1], Wrap=toggle_3)
join_3 = BrepJoin(Breps=item_24)  # -> Breps, Closed
item_25 = ListItem(List=join_3.Breps, Index=0, Wrap=True)

# ----
item_26 = ListItem(List=sort_8.ValuesA, Index=[0, 1], Wrap=toggle_3)
item_27 = ListItem(List=item_26, Index=0, Wrap=True)

# ---- group: Join Extra Pieces if Possible (continued)
fmerge = MergeFaces(Brep=item_25)  # -> Breps, Before, After
edges_4 = BrepEdges(Brep=fmerge.Breps)  # -> Naked, Interior, NonManifold
trim_helper_47 = TrimHelper(output_paths=edges_4.Naked, input_paths=fmerge.Breps)
lng_11 = ListLength(List=trim_helper_47)
larger_2 = LargerThan(FirstNumber=lng_11, SecondNumber=Slider(4, range=0..10))  # -> LargerThan, OrEqualTo
dispatch_29 = Dispatch(List=fmerge.Breps, DispatchPattern=larger_2.LargerThan)  # -> ListA, ListB
pd_8 = PathDescription(Data=dispatch_29.ListA)  # -> flatten(Paths)

# ----
dispatch_30 = Dispatch(List=item_27, DispatchPattern=larger_2.LargerThan)  # -> ListA, ListB
branch_17 = TreeBranch(Tree=dispatch_24.ListA, Path=pd_8, MaintainPaths=True)

# ---- group: Join Extra Pieces if Possible / If more than 4 sides to joined brep split those branches out and grab single elements
branch_18 = TreeBranch(Tree=dispatch_23.ListA, Path=pd_8, MaintainPaths=True)

# ----
pln_6 = Plane(dispatch_30.ListB)

# ---- group: Join Extra Pieces if Possible / rejoined modules
srf_5 = Surface(dispatch_29.ListB)

# ----
pln_7 = Plane(branch_17)

# ---- group: Join Extra Pieces if Possible (continued)
srf_6 = Surface(branch_18)

# ----
merge_12 = Merge(Data1=pln_7, Data2=pln_6, Data3=item_22, Data4=trim_helper_43)  # -> graft(Result)
merge_13 = Merge(Data1=srf_6, Data2=srf_5, Data3=item_21, Data4=brec_4.Bounding)  # -> graft(Result)
clean_10 = CleanParallel(PrimaryData=merge_13, SecondaryData1=merge_12, removeEmpty=True)  # -> PrimaryData, SecondaryData1

# ---- group: Final Check, if area of boudning rectangle is only so much bigger than original geomentry then use the bounding rectangle
analysis_plane_2 = Plane(plane)
trim_helper_48 = TrimHelper(output_paths=merge_13, input_paths=analysis_plane_2)  # disabled
clean_11 = CleanTree(RemoveNulls=True, RemoveInvalid=True, RemoveEmpty=True, Tree=merge_13)  # disabled
clean_12 = CleanTree(RemoveNulls=True, RemoveInvalid=True, RemoveEmpty=True, Tree=trim_helper_48)  # disabled
pd_9 = PathDescription(Data=clean_12)  # disabled
item_28 = ListItem(List=pd_9, Index=0, Wrap=True)  # disabled
branch_19 = TreeBranch(Tree=analysis_plane_2, Path=item_28, MaintainPaths=True)  # disabled
lng_12 = ListLength(List=clean_12)  # disabled
repeat_11 = RepeatData(Data=branch_19, Length=lng_12)  # disabled
pd_10 = PathDescription(Data=clean_11)  # disabled
assign_paths_4 = AssignPaths(InputData=flatten(repeat_11), PathsToAssign=flatten(pd_10))  # disabled
toggle_4 = BooleanToggle(False)
brec_5 = BoundingRectangle(Geometry=clean_11, Plane=assign_paths_4, Axis=0, Slide=0, Union=toggle_4)  # -> Bounding, DimensionX, DimensionY; disabled
area_12 = Area(Geometry=clean_10.PrimaryData)  # -> Area, Centroid

# ----
brec_6 = BoundingRectangle(Geometry=clean_10.PrimaryData, Plane=clean_10.SecondaryData1, Axis=0, Slide=0, Union=toggle_4)  # -> Bounding, DimensionX, DimensionY

# ---- group: Final Check, if area of boudning rectangle is only so much bigger than original geomentry then use the bounding rectangle (continued)
rec_3 = Rectangle(brec_6.Bounding)
trim_helper_49 = TrimHelper(output_paths=rec_3, input_paths=clean_10.PrimaryData)
area_13 = Area(Geometry=trim_helper_49)  # -> Area, Centroid
subtraction_2 = Subtraction(A=area_13.Area, B=area_12.Area)
smaller_4 = SmallerThan(FirstNumber=subtraction_2, SecondNumber=Slider(0.006, range=0..1))  # -> SmallerThan, OrEqualTo
dispatch_31 = Dispatch(List=trim_helper_49, DispatchPattern=smaller_4.SmallerThan)  # -> ListA, ListB
brep_6 = Brep(dispatch_31.ListA)
trim_helper_50 = TrimHelper(output_paths=brep_6, input_paths=crv_2)

# ----
dispatch_32 = Dispatch(List=clean_10.SecondaryData1, DispatchPattern=smaller_4.SmallerThan)  # -> ListA, ListB
pln_8 = Plane(dispatch_32.ListA)
trim_helper_51 = TrimHelper(output_paths=pln_8, input_paths=crv_2)
deplane_8 = DeconstructPlane(Plane=trim_helper_51)  # -> Origin, XAxis, YAxis, ZAxis

# ---- group: Merge Original and Cuts
fixed_regions = Surface(trim_helper_50)
area_14 = Area(Geometry=crv_2)  # -> Area, Centroid
area_15 = Area(Geometry=fixed_regions)  # -> Area, Centroid
is_face_large_enough = GhPythonScript(face_area=area_14.Area, min_cell_count=minimum_cell_per_module, cell_area=multiplication_6)  # -> out, answer
# ---------- is_face_large_enough: Python ----------
__author__ = "jmccarty"

import rhinoscriptsyntax as rs

min_area = cell_area * min_cell_count

if face_area < min_area:
    answer = False
else:
    answer = True
# ---------- end is_face_large_enough ----------
is_face_large_enough_2 = GhPythonScript(face_area=area_15.Area, min_cell_count=minimum_cell_per_module, cell_area=multiplication_6)  # -> out, answer; same code as is_face_large_enough
dispatch_33 = Dispatch(List=crv_2, DispatchPattern=is_face_large_enough.answer)  # -> ListA, ListB
dispatch_34 = Dispatch(List=fixed_regions, DispatchPattern=is_face_large_enough_2.answer)  # -> ListA, ListB
merge_14 = Merge(Data1=dispatch_34.ListA, Data2=dispatch_33.ListA)
area_16 = Area(Geometry=merge_14)  # -> Area, Centroid
is_face_large_enough_3 = GhPythonScript(face_area=area_16.Area, min_cell_count=minimum_cell_per_module, cell_area=multiplication_6)  # -> out, answer; same code as is_face_large_enough
dispatch_35 = Dispatch(List=merge_14, DispatchPattern=is_face_large_enough_3.answer)  # -> ListA, ListB

# ----
amp_17 = Amplitude(Vector=deplane_8.XAxis, Amplitude=number_slider_6)
amp_18 = Amplitude(Vector=deplane_8.YAxis, Amplitude=number_slider_6)
vdis_5 = VectorDisplay(Anchor=deplane_8.Origin, Vector=amp_17)
vdis_6 = VectorDisplay(Anchor=deplane_8.Origin, Vector=amp_18)
dispatch_36 = Dispatch(List=pln_4, DispatchPattern=is_face_large_enough.answer)  # -> ListA, ListB
item_29 = ListItem(List=deplane_8.Origin, Index=number_slider_7, Wrap=True)
item_30 = ListItem(List=trim_helper_50, Index=number_slider_7, Wrap=True)
dispatch_37 = Dispatch(List=trim_helper_51, DispatchPattern=is_face_large_enough_2.answer)  # -> ListA, ListB
merge_15 = Merge(Data1=dispatch_37.ListA, Data2=dispatch_36.ListA)
dispatch_38 = Dispatch(List=merge_15, DispatchPattern=is_face_large_enough_3.answer)  # -> ListA, ListB

# ---- group: Last, No Triangle Checkl
debrep_2 = DeconstructBrep(Brep=dispatch_35.ListA)  # -> Faces, Edges, Vertices
lng_13 = ListLength(List=debrep_2.Edges)
equals_7 = Equality(FirstNumber=lng_13, SecondNumber=4)  # -> Equality, Inequality
trim_helper_52 = TrimHelper(output_paths=equals_7.Equality, input_paths=dispatch_35.ListA)
dispatch_39 = Dispatch(List=dispatch_35.ListA, DispatchPattern=trim_helper_52)  # -> ListA, ListB
brep_7 = Brep(dispatch_39.ListA)

# ----
dispatch_40 = Dispatch(List=dispatch_38.ListA, DispatchPattern=trim_helper_52)  # -> ListA, ListB
pln_9 = Plane(dispatch_40.ListA)
clean_13 = CleanTree(RemoveNulls=True, RemoveInvalid=True, RemoveEmpty=True, Tree=pln_9)
graft_3 = GraftTree(Tree=clean_13, IncludeEmptyLists=True, IncludeNullItems=True)

# ---- group: Check again to remove irregular modules
clean_14 = CleanTree(RemoveNulls=True, RemoveInvalid=True, RemoveEmpty=True, Tree=brep_7)
item_31 = ListItem(List=clean_14, Index=0, Wrap=True)  # disabled
analysis_plane_3 = Plane(plane)  # disabled
pd_11 = PathDescription(Data=item_31)  # disabled
graft_4 = GraftTree(Tree=clean_14, IncludeEmptyLists=True, IncludeNullItems=True)
branch_20 = TreeBranch(Tree=analysis_plane_3, Path=pd_11, MaintainPaths=True)  # disabled
trim_helper_53 = TrimHelper(output_paths=graft_4, input_paths=branch_20)  # disabled
pd_12 = PathDescription(Data=graft_4)  # disabled
pd_13 = PathDescription(Data=trim_helper_53)  # disabled
item_32 = ListItem(List=pd_13, Index=0, Wrap=True)  # disabled
lng_14 = ListLength(List=trim_helper_53)  # disabled
branch_21 = TreeBranch(Tree=branch_20, Path=item_32, MaintainPaths=True)  # disabled
repeat_12 = RepeatData(Data=branch_21, Length=lng_14)  # disabled
assign_paths_5 = AssignPaths(InputData=flatten(repeat_12), PathsToAssign=flatten(pd_12))  # disabled
toggle_5 = BooleanToggle(False)
brec_7 = BoundingRectangle(Geometry=graft_4, Plane=assign_paths_5, Axis=0, Slide=0, Union=toggle_5)  # -> Bounding, DimensionX, DimensionY; disabled

# ----
brec_8 = BoundingRectangle(Geometry=graft_4, Plane=graft_3, Axis=0, Slide=0, Union=toggle_5)  # -> Bounding, DimensionX, DimensionY

# ---- group: Check again to remove irregular modules / Check to make sure min dimensions one the module are met
cell_height_2 = Number(read_module_info.cell_height)
cell_width_2 = Number(read_module_info.cell_width)
module_x = Number(brec_8.DimensionX)
module_y = Number(brec_8.DimensionY)
min = Minimum(A=cell_height_2, B=cell_width_2)
min_2 = Minimum(A=module_x, B=module_y)
trim_helper_54 = TrimHelper(output_paths=min_2, input_paths=graft_4)
smaller_5 = SmallerThan(FirstNumber=min, SecondNumber=trim_helper_54)  # -> SmallerThan, OrEqualTo
dispatch_41 = Dispatch(List=graft_4, DispatchPattern=smaller_5.SmallerThan)  # -> ListA, ListB

# ----
dispatch_42 = Dispatch(List=graft_3, DispatchPattern=smaller_5.SmallerThan)  # -> ListA, ListB
pln_10 = Plane(dispatch_42.ListA)

# ---- group: Check again to remove irregular modules (continued)
brep_8 = Brep(dispatch_41.ListA)
trim_helper_55 = TrimHelper(output_paths=brep_8, input_paths=crv_2)

# ----
trim_helper_56 = TrimHelper(output_paths=pln_10, input_paths=crv_2)
clean_15 = CleanParallel(PrimaryData=trim_helper_55, SecondaryData1=trim_helper_56, removeEmpty=True)  # -> PrimaryData, SecondaryData1

# ---- group: All Modules
clean_16 = CleanTree(RemoveNulls=True, RemoveInvalid=True, RemoveEmpty=True, Tree=trim_helper_55)  # disabled

# ----
graft_5 = GraftTree(Tree=clean_15.PrimaryData, IncludeEmptyLists=True, IncludeNullItems=True)
graft_6 = GraftTree(Tree=clean_15.SecondaryData1, IncludeEmptyLists=True, IncludeNullItems=True)

lng_15 = ListLength(List=clean_15.PrimaryData)  # disabled
pd_14 = PathDescription(Data=lng_15)  # disabled
brep_9 = Brep(clean_15.PrimaryData)  # disabled
pt_4 = Point(python_gate_3.out_object)  # disabled
graft_7 = GraftTree(Tree=brep_9, IncludeEmptyLists=True, IncludeNullItems=True)  # disabled
lng_16 = ListLength(List=brep_9)  # disabled
branch_22 = TreeBranch(Tree=pt_4, Path=pd_14, MaintainPaths=True)  # disabled
debrep_3 = DeconstructBrep(Brep=graft_7)  # -> Faces, Edges, Vertices; disabled
repeat_13 = RepeatData(Data=branch_22, Length=lng_16)  # disabled
trim_helper_57 = TrimHelper(output_paths=debrep_3.Vertices, input_paths=graft_7)  # disabled
trim_helper_58 = TrimHelper(output_paths=repeat_13, input_paths=branch_22)  # -> graft(data); disabled
ln_2 = Line(StartPoint=trim_helper_57, EndPoint=trim_helper_58)  # disabled
len_3 = Length(Curve=ln_2)  # disabled
sort_9 = SortList(Keys=len_3, ValuesA=trim_helper_57)  # -> Keys, ValuesA; disabled
item_33 = ListItem(List=sort_9.ValuesA, Index=0, Wrap=True)  # disabled
branch_23 = TreeBranch(Tree=plane, Path=pd_14, MaintainPaths=True)  # disabled
trim_helper_59 = TrimHelper(output_paths=item_33, input_paths=plane)  # disabled
pl_origin = PlaneOrigin(Base=branch_23, Origin=trim_helper_59)  # disabled
deplane_9 = DeconstructPlane(Plane=pl_origin)  # -> Origin, graft(XAxis), graft(YAxis), ZAxis; disabled

# ---- group: String Organisation Distrubution
module_planes = Plane(graft_6)
module_outer_curve = Curve(graft_5)
cell_height_3 = Number(num_5)
cell_width_3 = Number(num_8)
pd_15 = PathDescription(Data=module_outer_curve)
assign_paths_6 = AssignPaths(InputData=flatten(module_planes), PathsToAssign=flatten(pd_15))

# ---- group: Surface Explore (continued)
trim_helper_60 = TrimHelper(output_paths=module_outer_curve, input_paths=surfaces)
branch_24 = TreeBranch(Tree=trim_helper_60, Path=path_2, MaintainPaths=True)

# ----
deplane_10 = DeconstructPlane(Plane=module_planes)  # -> Origin, XAxis, YAxis, ZAxis
amp_19 = Amplitude(Vector=deplane_10.XAxis, Amplitude=number_slider_8)
amp_20 = Amplitude(Vector=deplane_10.YAxis, Amplitude=number_slider_8)
vdis_7 = VectorDisplay(Anchor=deplane_10.Origin, Vector=amp_19)
vdis_8 = VectorDisplay(Anchor=deplane_10.Origin, Vector=amp_20)
trim_4 = TrimTree(Tree=module_outer_curve, Depth=1)
trim_5 = TrimTree(Tree=deplane_10.Origin, Depth=1)
item_34 = ListItem(List=trim_5, Index=number_slider_9, Wrap=True)

# ---- group: Enable Cell Creation
python_gate_4 = GhPythonScript(object_to_pass=module_outer_curve, pass_object=enable_cell_creation)  # -> out, out_object; same code as python_gate
python_gate_5 = GhPythonScript(object_to_pass=assign_paths_6, pass_object=enable_cell_creation)  # -> out, out_object; same code as python_gate

# ----
item_35 = ListItem(List=trim_4, Index=number_slider_9, Wrap=True)

# ---- group: Cell Create Distrubution
deplane_11 = DeconstructPlane(Plane=python_gate_5.out_object)  # -> Origin, XAxis, YAxis, ZAxis
frame_thickness = Number(num)
cell_cols_spacing_2 = Number(cell_cols_spacing)
module_outer_curve_2 = Curve(python_gate_4.out_object)
cell_row_spacing_2 = Number(cell_row_spacing)
cell_width_4 = Number(cell_width_3)
n_cells_rows = Number(num_4)
module_plane_2 = Plane(python_gate_5.out_object)
module_origin_point = Point(deplane_11.Origin)
module_plane_x_vec = Vector(deplane_11.XAxis)
n_cells_columns = Number(num_2)
module_plane_y_vec = Vector(deplane_11.YAxis)
cell_height_4 = Number(cell_height_3)
module_plane_z_vec = Vector(deplane_11.ZAxis)
trim_helper_61 = TrimHelper(output_paths=module_plane_2, input_paths=module_outer_curve_2)
item_36 = ListItem(List=module_origin_point, Index=0, Wrap=True)

# ---- group: Pass area used data to end
windowless_surfaces = Surface(item_13)
trim_helper_62 = TrimHelper(output_paths=module_outer_curve, input_paths=windowless_surfaces)
pd_16 = PathDescription(Data=trim_helper_62)
area_17 = Area(Geometry=trim_helper_62)  # -> Area, Centroid
item_37 = ListItem(List=pd_16, Index=0, Wrap=True)
ma_5 = MassAddition(Input=area_17.Area)  # -> Result, PartialResults
branch_25 = TreeBranch(Tree=windowless_surfaces, Path=item_37, MaintainPaths=True)

# ---- group: Cell Builder / Inner Offset Module for frame thickness
neg = Negative(Value=frame_thickness)
offset = OffsetCurve(Curve=module_outer_curve_2, Distance=neg, Plane=trim_helper_61, Corners=1)
trim_helper_63 = TrimHelper(output_paths=offset, input_paths=module_outer_curve_2)

# ---- group: Check Area Utilization / Useful Surface Area
area_18 = Area(Geometry=branch_25)  # -> Area, Centroid

# ---- group: Check Area Utilization / Panelized Surface ARea
num_9 = Number(ma_5.Result)

# ---- group: Cellulate MOdules
number_slider_21 = Slider(1, range=1..2)
division_6 = Division(A=cell_width_4, B=number_slider_21)
number_slider_22 = Slider(1, range=0..1)
division_7 = Division(A=cell_height_4, B=number_slider_21)
multiplication_7 = Multiplication(A=num_6, B=number_slider_22)
multiplication_8 = Multiplication(A=num_3, B=number_slider_22)
division_8 = Division(A=multiplication_7, B=division_7)
division_9 = Division(A=multiplication_8, B=division_6)
addition_7 = Addition(A=division_9, B=1)
addition_8 = Addition(A=division_8, B=1)
ceil_5 = GhPythonScript(x=addition_7)  # -> out, a; same code as ceil
repeat_14 = RepeatData(Data=division_6, Length=ceil_5.a)
trim_helper_64 = TrimHelper(output_paths=repeat_14, input_paths=ceil_5.a)
ma_6 = MassAddition(Input=trim_helper_64)  # -> Result, PartialResults
number_slider_23 = Slider(0, range=0..100)
ins_5 = InsertItems(List=ma_6.PartialResults, Item=number_slider_23, Indices=number_slider_23, Wrap=True)
trim_helper_65 = TrimHelper(output_paths=ins_5, input_paths=ma_6.PartialResults)
rev_8 = Reverse(Vector=module_plane_x_vec)
amp_21 = Amplitude(Vector=rev_8, Amplitude=ins_5)
amp_22 = Amplitude(Vector=module_plane_x_vec, Amplitude=trim_helper_65)
move_20 = Move(Geometry=item_36, Motion=amp_22)  # -> Geometry, Transform
move_21 = Move(Geometry=item_36, Motion=amp_21)  # -> Geometry, Transform
ceil_6 = GhPythonScript(x=addition_8)  # -> out, a; same code as ceil
repeat_15 = RepeatData(Data=division_7, Length=ceil_6.a)
group_7 = Group(Objects=[move_20.Geometry, move_21.Geometry])
trim_helper_66 = TrimHelper(output_paths=repeat_15, input_paths=ceil_6.a)
ma_7 = MassAddition(Input=trim_helper_66)  # -> Result, PartialResults
number_slider_24 = Slider(0, range=0..100)
ins_6 = InsertItems(List=ma_7.PartialResults, Item=number_slider_24, Indices=number_slider_24, Wrap=True)
trim_helper_67 = TrimHelper(output_paths=ins_6, input_paths=ma_7.PartialResults)
rev_9 = Reverse(Vector=module_plane_y_vec)
amp_23 = Amplitude(Vector=rev_9, Amplitude=ins_6)
amp_24 = Amplitude(Vector=module_plane_y_vec, Amplitude=trim_helper_67)
move_22 = Move(Geometry=group_7, Motion=amp_23)  # -> Geometry, Transform
move_23 = Move(Geometry=group_7, Motion=amp_24)  # -> Geometry, Transform
merge_16 = Merge(Data1=move_22.Geometry, Data2=move_23.Geometry)
ungroup_7 = Ungroup(Group=merge_16)
trim_helper_68 = TrimHelper(output_paths=ungroup_7, input_paths=move_23.Geometry)
group_8 = Group(Objects=trim_helper_68)
python_8 = GhPythonScript(x_increment=frame_thickness, y_increment=frame_thickness)  # -> out, a; same code as python
amp_25 = Amplitude(Vector=module_plane_z_vec, Amplitude=Slider(0.01, range=0..0.01))
rev_10 = Reverse(Vector=module_plane_z_vec)

# ----
lng_17 = ListLength(List=ma_6.PartialResults)  # disabled
subtraction_3 = Subtraction(A=lng_17, B=1)  # disabled
repeat_16 = RepeatData(Data=cell_cols_spacing_2, Length=subtraction_3)  # disabled
number_slider_25 = Slider(0, range=0..100)  # disabled
ma_8 = MassAddition(Input=repeat_16)  # -> Result, PartialResults; disabled
ins_7 = InsertItems(List=ma_8.PartialResults, Item=number_slider_25, Indices=number_slider_25, Wrap=True)  # disabled
addition_9 = Addition(A=ma_6.PartialResults, B=ins_7)  # disabled

lng_18 = ListLength(List=ma_7.PartialResults)  # disabled
subtraction_4 = Subtraction(A=lng_18, B=1)  # disabled
repeat_17 = RepeatData(Data=cell_row_spacing_2, Length=subtraction_4)  # disabled
number_slider_26 = Slider(0, range=0..100)  # disabled
ma_9 = MassAddition(Input=repeat_17)  # -> Result, PartialResults; disabled
ins_8 = InsertItems(List=ma_9.PartialResults, Item=number_slider_26, Indices=number_slider_26, Wrap=True)  # disabled
addition_10 = Addition(A=ma_7.PartialResults, B=ins_8)  # disabled

diagonal_transform_3 = DiagonalTransform_2(
    origin_point=item_36,
    y_vector=module_plane_y_vec,
    x_vector=module_plane_x_vec,
    module_height=division_7,
    module_width=division_6)  # -> diagonal_transform, vector_amplitude

# ---- group: Cellulate MOdules (continued)
amp_26 = Amplitude(Vector=diagonal_transform_3.diagonal_transform, Amplitude=diagonal_transform_3.vector_amplitude)
move_24 = Move(Geometry=group_8, Motion=amp_26)  # -> Geometry, Transform
amp_27 = Amplitude(Vector=diagonal_transform_3.diagonal_transform, Amplitude=python_8.a)
move_25 = Move(Geometry=move_24.Geometry, Motion=amp_27)  # -> Geometry, Transform
ungroup_8 = Ungroup(Group=move_25.Geometry)
trim_helper_69 = TrimHelper(output_paths=ungroup_8, input_paths=move_25.Geometry)
move_26 = Move(Geometry=trim_helper_69, Motion=amp_25)  # -> Geometry, Transform
meshray_3 = MeshRay(Mesh=trim_helper_63, Point=move_26.Geometry, Direction=rev_10)  # -> Point, Hit
dispatch_43 = Dispatch(List=trim_helper_69, DispatchPattern=meshray_3.Hit)  # -> ListA, ListB
final_cell_centers = Point(dispatch_43.ListA)
cullpt_2 = CullDuplicates(Points=final_cell_centers, Tolerance=0.1, CullMode=3)  # -> Points, Indices, Valence
clean_17 = CleanTree(RemoveNulls=True, RemoveInvalid=True, RemoveEmpty=True, Tree=cullpt_2.Points)

# ---- group: Check cell count and rowxcolumn
trim_helper_70 = TrimHelper(output_paths=clean_17, input_paths=module_plane_2)

# ---- group: Check cell count and rowxcolumn / Test if cell distribution is recentangular
plcoord = PlaneCoordinates(Point=trim_helper_70, System=module_plane_2)  # -> XCoordinate, YCoordinate, ZCoordinate
cset_5 = CreateSet(List=plcoord.YCoordinate)  # -> Set, Map
cset_6 = CreateSet(List=plcoord.XCoordinate)  # -> Set, Map
lng_19 = ListLength(List=cset_5.Set)
lng_20 = ListLength(List=cset_6.Set)
multiplication_9 = Multiplication(A=lng_20, B=lng_19)
lng_21 = ListLength(List=clean_17)
int = Integer(multiplication_9)
trim_helper_71 = TrimHelper(output_paths=lng_21, input_paths=int)
trim_helper_72 = TrimHelper(output_paths=clean_17, input_paths=int)
equals_8 = Equality(FirstNumber=int, SecondNumber=trim_helper_71)  # -> Equality, Inequality
dispatch_44 = Dispatch(List=module_plane_2, DispatchPattern=equals_8.Equality)  # -> ListA, ListB
dispatch_45 = Dispatch(List=trim_helper_72, DispatchPattern=equals_8.Equality)  # -> ListA, ListB

# ---- group: Check cell count and rowxcolumn / Too many rows?
n_rows = Number(read_module_info.n_rows_subcell)
plcoord_2 = PlaneCoordinates(Point=dispatch_45.ListA, System=dispatch_44.ListA)  # -> XCoordinate, YCoordinate, ZCoordinate
cset_7 = CreateSet(List=plcoord_2.YCoordinate)  # -> Set, Map
lng_22 = ListLength(List=cset_7.Set)
larger_3 = LargerThan(FirstNumber=lng_22, SecondNumber=n_rows)  # -> LargerThan, OrEqualTo
dispatch_46 = Dispatch(List=dispatch_44.ListA, DispatchPattern=larger_3.LargerThan)  # -> ListA, ListB
dispatch_47 = Dispatch(List=dispatch_45.ListA, DispatchPattern=larger_3.LargerThan)  # -> ListA, ListB

# ---- group: Check cell count and rowxcolumn / Too many cols?
plcoord_3 = PlaneCoordinates(Point=dispatch_47.ListB, System=dispatch_46.ListB)  # -> XCoordinate, YCoordinate, ZCoordinate
n_cols = Number(read_module_info.n_cols_subcell)
cset_8 = CreateSet(List=plcoord_3.XCoordinate)  # -> Set, Map
lng_23 = ListLength(List=cset_8.Set)
larger_4 = LargerThan(FirstNumber=lng_23, SecondNumber=n_cols)  # -> LargerThan, OrEqualTo
dispatch_48 = Dispatch(List=dispatch_45.ListA, DispatchPattern=larger_4.LargerThan)  # -> ListA, ListB
dispatch_49 = Dispatch(List=dispatch_44.ListA, DispatchPattern=larger_4.LargerThan)  # -> ListA, ListB

# ----
dispatch_50 = Dispatch(List=module_outer_curve_2, DispatchPattern=equals_8.Equality)  # -> ListA, ListB
dispatch_51 = Dispatch(List=dispatch_50.ListA, DispatchPattern=larger_3.LargerThan)  # -> ListA, ListB
dispatch_52 = Dispatch(List=dispatch_51.ListB, DispatchPattern=larger_4.LargerThan)  # -> ListA, ListB

panel_10 = Panel(lng_23)

module_plane_3 = Plane(dispatch_49.ListB)
modules = Surface(dispatch_52.ListB)
deplane_12 = DeconstructPlane(Plane=module_plane_3)  # -> Origin, XAxis, YAxis, ZAxis
area_19 = Area(Geometry=modules)  # -> Area, Centroid

# ---- group: Order Points Row then Col
plcoord_4 = PlaneCoordinates(Point=dispatch_48.ListB, System=module_plane_3)  # -> XCoordinate, YCoordinate, ZCoordinate
cset_9 = CreateSet(List=plcoord_4.YCoordinate)  # -> Set, Map
mindex_13 = MemberIndex(Set=plcoord_4.YCoordinate, Member=cset_9.Set)  # -> Index, Count
trim_helper_73 = TrimHelper(output_paths=mindex_13.Index, input_paths=cset_9.Set)
pd_17 = PathDescription(Data=mindex_13.Index)
trim_helper_74 = TrimHelper(output_paths=pd_17, input_paths=cset_9.Set)
item_38 = ListItem(List=module_plane_3, Index=trim_helper_73, Wrap=True)
item_39 = ListItem(List=dispatch_48.ListB, Index=trim_helper_73, Wrap=True)
assign_paths_7 = AssignPaths(InputData=flatten(item_39), PathsToAssign=flatten(trim_helper_74))
assign_paths_8 = AssignPaths(InputData=flatten(item_38), PathsToAssign=flatten(trim_helper_74))
plcoord_5 = PlaneCoordinates(Point=assign_paths_7, System=assign_paths_8)  # -> XCoordinate, YCoordinate, ZCoordinate
sort_10 = SortList(Keys=plcoord_5.XCoordinate, ValuesA=assign_paths_7)  # -> Keys, ValuesA
trim_helper_75 = TrimHelper(output_paths=sort_10.ValuesA, input_paths=cset_9.Set)

# ----
lng_24 = ListLength(List=trim_helper_75)
plcoord_6 = PlaneCoordinates(Point=trim_helper_75, System=module_plane_3)  # -> XCoordinate, YCoordinate, ZCoordinate
repeat_18 = RepeatData(Data=deplane_12.ZAxis, Length=lng_24)
trim_helper_76 = TrimHelper(output_paths=repeat_18, input_paths=lng_24)
cset_10 = CreateSet(List=plcoord_6.XCoordinate)  # -> Set, Map
cset_11 = CreateSet(List=plcoord_6.YCoordinate)  # -> Set, Map
lng_25 = ListLength(List=cset_10.Set)
lng_26 = ListLength(List=cset_11.Set)
cells_xyz = Point(trim_helper_75)

# ---- group: Create Keys for Dict / Modules
pd_18 = PathDescription(Data=trim_helper_75)

# ---- group: Remap module cneter points to the surface plan origin
trim_helper_77 = TrimHelper(output_paths=area_19.Centroid, input_paths=pln)
lng_27 = ListLength(List=trim_helper_77)
repeat_19 = RepeatData(Data=pln, Length=lng_27)
trim_helper_78 = TrimHelper(output_paths=repeat_19, input_paths=pln)  # -> graft(data)
plcoord_7 = PlaneCoordinates(Point=area_19.Centroid, System=trim_helper_78)  # -> XCoordinate, YCoordinate, ZCoordinate
pt_5 = ConstructPoint(XCoordinate=plcoord_7.XCoordinate, YCoordinate=plcoord_7.YCoordinate, ZCoordinate=plcoord_7.ZCoordinate)

# ----
panel_11 = Panel(lng_26)

crv_5 = Curve(modules)
preview_3 = CustomPreview(Geometry=crv_5, Material=ColourSwatch(SwatchColor=RGB(0, 0, 0)))
preview_4 = CustomPreview(Geometry=brep, Material=ColourSwatch(SwatchColor=RGB(150, 150, 150)))
dots = DotDisplay(Point=cells_xyz, Colour=ColourSwatch(SwatchColor=RGB(255, 254, 254)), Size=Slider(0.03, range=0.01..0.1))

# ---- group: Writer / n_diodes
lng_28 = ListLength(List=trim_helper_75)
n_diodes_rule = GhPythonScript(n_cells=lng_28)  # -> out, n_diodes
# ---------- n_diodes_rule: Python ----------
__author__ = "jmccarty"

import rhinoscriptsyntax as rs

if n_cells <= 4:
    n_diodes=1
elif (n_cells > 4) & (n_cells < 100):
    n_diodes=2
else:
    n_diodes=3
# ---------- end n_diodes_rule ----------

# ---- group: Create Keys for Dict
txt_4 = Text(pd_18)
cset_12 = CreateSet(List=txt_4)  # -> Set, Map
trim_6 = TrimTree(Tree=trim_helper_75, Depth=1)

# ---- group: Create Keys for Dict / Modules Per String
trim_7 = TrimTree(Tree=cset_12.Set, Depth=1)

# ---- group: Create Keys for Dict / Surfaces
pd_19 = PathDescription(Data=trim_6)

# ---- group: Figure General Surface Direction/Roof
trim_helper_79 = TrimHelper(output_paths=deplane_12.ZAxis, input_paths=trim_7)
avr = Average(Input=trim_helper_79)
calc_angle_from_north_degrees = GhPythonScript(normal=avr)  # -> out, direction; inputs normal: Vector3d
# ---------- calc_angle_from_north_degrees: Python ----------
import math
a = (0,1)
b = (normal[0],normal[1])

ang1 = math.atan2(*a[::-1])
ang2 = math.atan2(*b[::-1])
direction = math.degrees((ang1 - ang2) % (2 * math.pi))
# ---------- end calc_angle_from_north_degrees ----------
devec_4 = DeconstructVector(Vector=avr)  # -> XComponent, YComponent, ZComponent
classify_angle_group = GhPythonScript(input_angle=calc_angle_from_north_degrees.direction)  # -> out, general_angle
# ---------- classify_angle_group: Python ----------
__author__ = "jmccarty"

import rhinoscriptsyntax as rs

if input_angle < 45:
    general_angle = "north"

elif 45<=input_angle<135:
    general_angle = "east"

elif 135<=input_angle<225:
    general_angle = "south"

elif 225<=input_angle<315:
    general_angle = "west"
    
else:
    general_angle = "north"
# ---------- end classify_angle_group ----------
replace_roof = GhPythonScript(general_angle=classify_angle_group.general_angle, z_normal=devec_4.ZComponent)  # -> out, updated_angle
# ---------- replace_roof: Python ----------
__author__ = "jmccarty"

import rhinoscriptsyntax as rs

if 0<z_normal<0.99:
    updated_angle = "r_"+general_angle
elif z_normal>=0.99:
    updated_angle = "flat_roof"
else:
    updated_angle = general_angle
# ---------- end replace_roof ----------

# ---- group: Create Keys for Dict (continued)
panel_12 = Panel(trim_7)
txt_5 = Text(pd_19)
cset_13 = CreateSet(List=txt_5)  # -> Set, Map

# ---- group: Create Keys for Dict / Surface per Object
trim_8 = TrimTree(Tree=cset_13.Set, Depth=1)

# ---- group: Create Keys for Dict (continued)
panel_13 = Panel(trim_8)

# ---- group: Check Area Utilization
division_10 = Division(A=num_9, B=area_18.Area)
pt_6 = Point(trim_helper_75)
lng_29 = ListLength(List=pt_6)
smaller_6 = SmallerThan(FirstNumber=lng_29, SecondNumber=read_module_info.min_cell_module)  # -> SmallerThan, OrEqualTo
larger_5 = LargerThan(FirstNumber=lng_29, SecondNumber=multiplication)  # -> LargerThan, OrEqualTo
pd_20 = PathDescription(Data=lng_29)
dispatch_53 = Dispatch(List=pd_20, DispatchPattern=larger_5.LargerThan)  # -> ListA, ListB
pd_21 = PathDescription(Data=division_10)  # -> flatten(Paths)
dispatch_54 = Dispatch(List=pd_20, DispatchPattern=smaller_6.SmallerThan)  # -> ListA, ListB
larger_6 = LargerThan(FirstNumber=flatten(division_10), SecondNumber=Slider(1.05, range=0..10))  # -> LargerThan, OrEqualTo
dispatch_55 = Dispatch(List=pd_21, DispatchPattern=larger_6.LargerThan)  # -> ListA, ListB

# ---- group: Check Area Utilization / Too Small
branch_26 = TreeBranch(Tree=dispatch_54.ListA, Path=dispatch_53.ListA, MaintainPaths=True)

# ---- group: Check Area Utilization / Too Big
branch_27 = TreeBranch(Tree=pt_6, Path=dispatch_53.ListA, MaintainPaths=True)

# ---- group: Check Area Utilization (continued)
panel_14 = Panel(branch_26)
panel_15 = Panel(branch_27)

# ---- group: Check Area Utilization / Area Utilisation over 100%
panel_16 = Panel(dispatch_55.ListA)

# ---- group: Writer
compile_key_dict = GhPythonScript(
    host_name=host_name_to_path.root,
    surface_keys=trim_8,
    general_surface_direction=replace_roof.updated_angle,
    module_center_points=area_19.Centroid,
    module_center_points_inplane=pt_5,
    module_normals=module_plane_z_vec,
    modules_tree=trim_7,
    n_cols_ideal=read_module_info.n_cols_ideal,
    n_cols_tree=lng_25,
    n_rows_ideal=read_module_info.n_rows_ideal,
    n_rows_tree=lng_26,
    n_diodes_tree=n_diodes_rule.n_diodes,
    cell_xyz_tree=trim_helper_75,
    cell_normals_tree=trim_helper_76,
    n_submodules=read_module_info.n_submodule,
    module_template=get_config_value_6.out_value,
    area_utilised=division_10,
    cell_type=read_module_info.cell_type,
    front_films=list_9,
    cec_key=read_module_info.cec_key,
    device_id=get_config_value_6.out_value,
    write_pickle=write_panelizer,
    pickle_out=python_3.write_path)  # -> out, object; inputs host_name: Int32, surface_keys: list, general_surface_direction: tree, module_center_points: tree of Point3d, module_center_points_inplane: tree of Point3d, module_normals: tree of Vector3d, modules_tree: tree, n_cols_tree: tree, n_rows_tree: tree, n_diodes_tree: tree, cell_xyz_tree: tree of Point3d, cell_normals_tree: tree of Vector3d, area_utilised: tree, front_films: list, pickle_out: list
# ---------- compile_key_dict: Python ----------
"""
The core compiling code for the output from the panelizer grasshopper script.

"""
__author__ = "jmccarty"

import rhinoscriptsyntax as rs
import os
import math
import itertools
import Grasshopper.Kernel.Data.GH_Path as ghpath
import pickle
from Rhino.Geometry import Point3d, Vector3d

#----------- FUNCTIONS -----------#
def generate_object_dict(key_dict, host, n_cols_ideal, n_rows_ideal, n_cols, n_rows, n_diodes, 
                         cells_xyz, cells_normal, n_submodules, template, front_film, cell_type, 
                         cec_key, general_surface_direction, module_center_points, module_normals,
                         pct_srf_area_used):
    
    base_dict = {'Host':
                     {'Name':host,
                      'Details':  {"module_type":template,
                                   "cell_type":cell_type,
                                   "cec_key":cec_key},
                      'Yield': {'central_inverter': generate_empty_results_dict(target='host'),
                                'string_inverter': generate_empty_results_dict(target='host'),
                                'micro_inverter': generate_empty_results_dict(target='host')
                                },
                      "Curves": {"Isys": {}, 
                                 "Vsys": {}
                                 },
                      "Surfaces": {}
                      }
                 }
    srf_keys = list(key_dict[host].keys())
    for srf_key in srf_keys:
        #mod_keys = list(key_dict[building][srf_key].keys())
        srf_branch = srf_key.replace("{","").replace("}","").split(";")
        srf_branch = [int(s) for s in srf_branch]
        srf_branch = ghpath(srf_branch[0], srf_branch[1])
        srf_dict = {srf_key: {"Details": {"area_utilised":round(100*pct_srf_area_used.Branch(srf_branch)[0],1),
                                          "surface_type":None,
                                          "radiance_surface_label":srf_key.replace("{","").replace("}","").replace(";","_"),
                                          "general_angle":general_surface_direction.Branch(srf_branch)[0],
                                          "cec_key": cec_key,
                                          "device_id": device_id},
                              'Yield': {
                                  'central_inverter': generate_empty_results_dict(target='surface'),
                                  'string_inverter': generate_empty_results_dict(target='surface'),
                                  'micro_inverter': generate_empty_results_dict(target='surface'),
                              },
                              "Curves": {"Isrf": {}, 
                                         "Vsrf": {}
                                         },
                              'ResultsDict': {},
                              "Strings": {}}}
        # for str_key in str_keys:
        mod_keys = list(key_dict[host][srf_key].keys())
        srf_dict[srf_key]["Strings"] = {}
        #srf_dict[srf_key]["Modules"] = {"Details": {"cec_key":cec_key,
        #                                            "module_type":template},
        #                                            "Modules": {}}
        srf_dict[srf_key]["Modules"] = {}
        
        for mod_key in mod_keys:
            mod_k = k_to_l(mod_key)
            n_col_mod = int(n_cols.Branch(mod_k[0], mod_k[1], mod_k[2])[0])
            n_row_mod = int(n_rows.Branch(mod_k[0], mod_k[1], mod_k[2])[0])
            n_diodes_mod = int(n_diodes.Branch(mod_k[0], mod_k[1], mod_k[2])[0])
            
            module_point = module_center_points.Branch(mod_k[0], mod_k[1], mod_k[2])
            mod_ctr_pt = []
            for point in module_point:
                p = Point3d(point)
                X = round(p.X,6)
                Y = round(p.Y,6)
                Z = round(p.Z,6)
                mod_ctr_pt.append([X,Y,Z])
            mod_ctr_pt = mod_ctr_pt[0]
            
            module_point_ip = module_center_points_inplane.Branch(mod_k[0], mod_k[1], mod_k[2])
            mod_ctr_pt_ip = []
            for point in module_point_ip:
                p = Point3d(point)
                X = round(p.X,6)
                Y = round(p.Y,6)
                Z = round(p.Z,6)
                mod_ctr_pt_ip.append([X,Y,Z])
            mod_ctr_pt_inplane = mod_ctr_pt_ip[0]
            
            module_normal = module_normals.Branch(mod_k[0], mod_k[1], mod_k[2])
            normal_list = []
            for vector in module_normal:
                v = Vector3d(vector)
                X = round(v.X,4)
                Y = round(v.Y,4)
                Z = round(v.Z,4)
                normal_list.append([X,Y,Z])
            mod_normal = normal_list[0]
            
            # use mod_key to access each of the variables below
            # variable_data_tree.Branch(mod_key)
            # n_diodes_repeat, n_submodules, template will be isngle input
            
            cell_xyz_mod = cells_xyz.Branch(mod_k[0], mod_k[1], mod_k[2])
            point_list = []
            for point in cell_xyz_mod:
                p = Point3d(point)
                X = round(p.X,6)
                Y = round(p.Y,6)
                Z = round(p.Z,6)
                point_list.append([X,Y,Z])
            
            cell_normals_mod = cells_normal.Branch(mod_k[0], mod_k[1], mod_k[2])
            normal_list = []
            for vector in cell_normals_mod:
                v = Vector3d(vector)
                X = round(v.X,4)
                Y = round(v.Y,4)
                Z = round(v.Z,4)
                normal_list.append([X,Y,Z])
            
            mod_dict = generate_sample_module_dict(n_cols_ideal, n_rows_ideal, n_col_mod, n_row_mod, 
                                                   template, n_diodes_mod, n_submodules, point_list, 
                                                   normal_list, front_film, cell_type, cec_key,
                                                   mod_ctr_pt, mod_ctr_pt_inplane, mod_normal)
            
            srf_dict[srf_key]['Modules'][mod_key] = mod_dict
            
            #srf_dict[srf_key]["Strings"][str_key]['Yield'] = {
            #    'central_inverter': generate_empty_results_dict(target='String'),
            #    'string_inverter': generate_empty_results_dict(target='String'),
            #    'micro_inverter': generate_empty_results_dict(target='String'),
            #}
            #srf_dict[srf_key]["Strings"][str_key]["Curves"] = {"Istr": {}, "Vstr": {}}

        base_dict['Host']['Surfaces'].update(srf_dict)
    return base_dict
    
def create_key_dict(host_name, surface_keys, modules_tree):
    key_dict = {host_name:{}}

    for surface in surface_keys:
        srf_key = surface.replace("{","").replace("}","").split(";")
        srf_key = [int(s) for s in srf_key]
        sel = ghpath(srf_key[0], srf_key[1])
        key_dict[host_name].update({str(surface):{}})
        
        #for string in strings_tree.Branch(sel):
         #   str_key = string.replace("{","").replace("}","").split(";")
          #  str_key = [int(s) for s in str_key]
           # sel = ghpath(str_key[0],str_key[1],str_key[2],str_key[3])
            #key_dict[building_name][surface].update({str(string):{}})
            
        for module in modules_tree.Branch(sel):
            key_dict[host_name][surface].update({str(module):{}})
    
    return key_dict
    
def generate_sample_module_dict(n_cols_ideal, n_rows_ideal, n_cols, n_rows, template, n_diodes, 
                                n_submodules, cells_xyz, cells_normals, front_film, cell_type, 
                                cec_key, mod_ctr_pt, mod_ctr_pt_inplane, mod_normal):
    
    if cell_type=='cdte':
        if n_cols_ideal>n_rows_ideal:
            n_rows=n_rows_ideal
        else:
            n_cols=n_cols_ideal
        
    
    module = {
        "Parameters" : {},
        "Details": {"panelizer_module_type":template,
                    "panelizer_cell_type":cell_type,
                    "panelizer_cec_key":cec_key,
                    "panelizer_n_cells":n_cols * n_rows,
                    "panelizer_n_cols":n_cols,
                    "panelizer_n_rows":n_rows,
                    "panelizer_n_cols_ideal":n_cols_ideal,
                    "panelizer_n_rows_ideal":n_rows_ideal,
                    "panelizer_n_diode":n_diodes,
                    "panelizer_n_submodules":n_submodules,
                    "panelizer_normal":mod_normal,
                    "panelizer_center_pt":mod_ctr_pt,
                    "panelizer_center_pt_inplane":mod_ctr_pt_inplane},
                    
        "Layers": {"panelizer_front_film":front_film,
                   "panelizer_front_cover":"4mm solar glass",
                   "panelizer_encapsulant":"EVA",
                   "panelizer_solar_cell":cell_type,
                   "panelizer_rear_cover":"4mm solar glass"
                   },
        "Maps": {
            "Submodules": None,
            "Diodes": None,
            "Subcells": None
        },
        "CellsXYZ": cells_xyz,
        "CellsNormals": cells_normals,
        "CellsIrradDirect": None,
        "CellsIrradDiffuse": None,
        "CellsIrradEff": None,
        "CellsTemp": None,
        "Yield": {'initial_simulation': generate_empty_results_dict(target='Module'),
                  'central_inverter': generate_empty_results_dict(target='Module'),
                  'string_inverter': generate_empty_results_dict(target='Module'),
                  'micro_inverter': generate_empty_results_dict(target='Module'),
                  'center_point': generate_empty_results_dict(target='Center'),
                  'cell_point': generate_empty_results_dict(target='Cell')},
        "Curves": {"Imod": {}, 
                   "Vmod": {}
                   }
    }
    return module
    

def create_repeating_list(n_int, n_repeat):
    lst = range(0, n_int)
    return list(itertools.chain.from_iterable(itertools.repeat(x, n_repeat) for x in lst))
    

def flatten_list(lst):
    return [j for i in lst for j in i]


def generate_empty_results_dict(target):
    empty_dict = {'imp': {},
                  'vmp': {},
                  'pmp': {},
                  'irrad': {},
                  'eff': {},
                  'area': {}}

    if target == 'String':

        empty_dict.pop('area', None)

    elif target == 'Surface':

        empty_dict.pop('area', None)

    elif target == 'Host':

        empty_dict.pop('imp', None)
        empty_dict.pop('vmp', None)
        empty_dict.pop('area', None)
    
    elif target == 'Center':
        
        empty_dict.pop('eff', None)
        empty_dict.pop('imp', None)
        empty_dict.pop('vmp', None)
    
    elif target == 'Cell':
        
        empty_dict.pop('eff', None)
        empty_dict.pop('imp', None)
        empty_dict.pop('vmp', None)
        

    return empty_dict


def k_to_l(key):
    k_l = key.replace("{","").replace("}","").split(";")
    return [int(k) for k in k_l]


#----------- MAIN -----------#

key_dict = create_key_dict(host_name, surface_keys, modules_tree)
for n, front_film in enumerate(front_films):
    object = generate_object_dict(key_dict, host_name, n_cols_ideal, n_rows_ideal, n_cols_tree, 
                                  n_rows_tree, n_diodes_tree, cell_xyz_tree, cell_normals_tree, 
                                  n_submodules, module_template, front_film, cell_type, cec_key, 
                                  general_surface_direction, module_center_points, module_normals,
                                  area_utilised)
    if write_pickle==True:
        with open(pickle_out[n], 'wb') as fp:
            pickle.dump(object, fp, protocol=pickle.HIGHEST_PROTOCOL)
# ---------- end compile_key_dict ----------

# ==== cluster TrimHelper
output_paths = ClusterInput()
input_paths = ClusterInput()
pd = PathDescription(Output_paths=output_paths)  # -> flatten(Paths)
pd_2 = PathDescription(Input_paths=input_paths)  # -> flatten(Paths)
item = ListItem(List=pd_2, Index=0, Wrap=True)
item_2 = ListItem(List=pd, Index=0, Wrap=True)
trim_if_path_longer = GhPythonScript(input_path=item, output_path=item_2)  # -> out, trim_bool, trim_number
# ---------- trim_if_path_longer: Python ----------
__author__ = "jmccarty"

import rhinoscriptsyntax as rs

input_ = len(input_path.split(";"))
output_ = len(output_path.split(";"))

if input_==output_:
    trim_bool = False
    trim_number = 0
else:
    trim_bool = True
    trim_number = output_ - input_
# ---------- end trim_if_path_longer ----------
trim = TrimTree(Input_data=output_paths, Depth=trim_if_path_longer.trim_number)
data = ClusterOutput(trim)

# ==== cluster DiagonalTransform
origin_point = ClusterInput()
x_vector = ClusterInput()
y_vector = ClusterInput()

# ---- group: Diag Transform
number_slider = Slider(1, range=0..1)
amp = Amplitude(Vector=x_vector, Amplitude=number_slider)
move = Move(Geometry=origin_point, Motion=amp)  # -> Geometry, Transform
amp_2 = Amplitude(Vector=y_vector, Amplitude=number_slider)
move_2 = Move(Geometry=move.Geometry, Motion=amp_2)  # -> Geometry, Transform
vec2pt = Vector2Pt(PointA=origin_point, PointB=move_2.Geometry, Unitize=True)  # -> Vector, Length

# ----
diagonal_transform = ClusterOutput(vec2pt.Vector)

# ==== cluster DiagonalTransform_2
module_height = ClusterInput()
module_width = ClusterInput()
origin_point = ClusterInput()
x_vector = ClusterInput()
y_vector = ClusterInput()
division = Division(A=module_height, B=2)
division_2 = Division(A=module_width, B=2)

# ---- group: Diag Transform
number_slider = Slider(1, range=0..1)
amp = Amplitude(Vector=x_vector, Amplitude=division_2)
move = Move(Geometry=origin_point, Motion=amp)  # -> Geometry, Transform
amp_2 = Amplitude(Vector=y_vector, Amplitude=division)
move_2 = Move(Geometry=move.Geometry, Motion=amp_2)  # -> Geometry, Transform
vec2pt = Vector2Pt(PointA=origin_point, PointB=move_2.Geometry, Unitize=True)  # -> Vector, Length

# ----
python = GhPythonScript(x_increment=module_width, y_increment=module_height)  # -> out, a
# ---------- python: Python ----------
__author__ = "jmccarty"

import rhinoscriptsyntax as rs
import math

a = math.sqrt((x_increment/2)**2 + (y_increment/2)**2)
# ---------- end python ----------
diagonal_transform = ClusterOutput(vec2pt.Vector)
vector_amplitude = ClusterOutput(python.a)
