# Grasshopper definition 1_workbench_panelizer_template.gh (Grasshopper 1.0.7)
# plug-ins: PTComponentLibrary, HDTTreeUtils, Pufferfish

list = ValueList({"management", "irradiance"}, selected="irradiance")
list_2 = ValueList({"management", "irradiance"}, selected="management")

project_config_file = FilePath("/Users/jmccarty/Desktop/test_project/test1/test1.config")
read_workbench_config = GhPythonScript(config_file=project_config_file, section=list_2)  # -> out, keys, values
# ---------- read_workbench_config: Python ----------
"""Read the config file for a workbench project."""

__author__ = "jmccarty"



with open(config_file) as fp:
    config = fp.readlines()
    
config = [c.replace("\n","").replace(r"[","").replace(r"]","") for c in config]

if section == 'management':
    management = {}

    for c in config:
        if c == 'management':
            pass
        elif c == 'irradiance':
            break
        elif c == "":
            pass
        else:
            #print(c)
            key = c.split(" = ")[0]
            #print(key)
            value = c.split(" = ")[1]
            #print(value)
            management[key] = value

    keys = list(management.keys())
    values = list(management.values())

elif section == 'irradiance':
    out_dict = {}
    line_start = 0
    for n, c in enumerate(config):
        if c == 'irradiance':
            line_start = n
            break
        else:
            pass
    for c in config[line_start:]:
        if c == "":
            pass
        else:
            #print(c)
            key = c.split(" = ")[0]
            #print(key)
            value = c.split(" = ")[1]
            #print(value)
            out_dict[key] = value

    keys = list(out_dict.keys())
    values = list(out_dict.values())
    
else:
    out = "section must be either 'irradiance' or 'management'"
# ---------- end read_workbench_config ----------
panel = Panel("""parent_dir
project_name
host_name
scenario_name""")
get_config_value = GhPythonScript(keys=read_workbench_config.keys, values=read_workbench_config.values, search_key=panel)  # -> out, out_value; inputs keys: list, values: list
# ---------- get_config_value: Python ----------
__author__ = "jmccarty"

import rhinoscriptsyntax as rs

config = dict(zip(keys,values))

out_value = config[search_key]
# ---------- end get_config_value ----------
list_3 = ValueList({"project_data", "raw_host_file", "latitude", "host_name", "exclude_surfaces", "base_epw", "longitude", "timezone", "elevation", "parent_dir", "project_name", "utc", "scenario_name", "tmy_name", "grid_x_mm", "grid_y_mm", "radiance_parameters"}, selected="parent_dir")
locate_device_data = GhPythonScript(config_keys=panel, config_values=get_config_value.out_value)  # -> out, out_dir, out_name, out_file; inputs config_keys: list, config_values: list
# ---------- locate_device_data: Python ----------
"""Creates the file path to save the 
    geometry file out of the template"""

__author__ = "jmccarty"

import os 
 

config_inputs = dict(zip(config_keys,config_values))

parent_dir = config_inputs['parent_dir']
project_name = config_inputs['project_name']
host_name = config_inputs['host_name']
scenario_name = config_inputs['scenario_name']

out_dir = os.path.join(parent_dir, project_name, "inputs", "shared", "cell_module_data")
out_name = "cell_module_datasheets.csv"

out_file = os.path.join(out_dir,out_name)
# ---------- end locate_device_data ----------
locate_geometry_file = GhPythonScript(config_keys=panel, config_values=get_config_value.out_value)  # -> out, out_dir, out_name, out_file; inputs config_keys: list, config_values: list
# ---------- locate_geometry_file: Python ----------
"""Creates the file path to save the 
    geometry file out of the template"""

__author__ = "jmccarty"

import os 
 

config_inputs = dict(zip(config_keys,config_values))

parent_dir = config_inputs['parent_dir']
project_name = config_inputs['project_name']
host_name = config_inputs['host_name']
scenario_name = config_inputs['scenario_name']

out_dir = os.path.join(parent_dir, project_name, "inputs", "hosts", host_name, scenario_name, "geometry")
out_name = "0_geometry.3dm"

out_file = os.path.join(out_dir,out_name)
# ---------- end locate_geometry_file ----------

read_workbench_config_2 = GhPythonScript(config_file=project_config_file, section=list)  # -> out, keys, values
# ---------- read_workbench_config_2: Python ----------
"""Read the config file for a workbench project."""

__author__ = "jmccarty"



with open(config_file) as fp:
    config = fp.readlines()
    
config = [c.replace("\n","").replace(r"[","").replace(r"]","") for c in config]

if section == 'management':
    management = {}

    for c in config:
        if c == 'management':
            pass
        elif c == 'irradiance':
            break
        elif c == "":
            pass
        else:
            #print(c)
            key = c.split(" = ")[0]
            #print(key)
            value = c.split(" = ")[1]
            #print(value)
            management[key] = value

    keys = list(management.keys())
    values = list(management.values())

elif section == 'irradiance':
    out_dict = {}
    line_start = 0
    for n, c in enumerate(config):
        if c == 'irradiance':
            line_start = n
            break
        else:
            pass
    for c in config[line_start:]:
        if c == "":
            pass
        elif c == "irradiance":
            pass
        
        else:
            print(c)
            key = c.split(" = ")[0]
            #print(key)
            value = c.split(" = ")[1]
            #print(value)
            out_dict[key] = value

    keys = list(out_dict.keys())
    values = list(out_dict.values())
    
else:
    out = "section must be either 'irradiance' or 'management'"
# ---------- end read_workbench_config_2 ----------
list_4 = ValueList({"project_data", "raw_host_file", "latitude", "host_name", "exclude_surfaces", "base_epw", "longitude", "timezone", "elevation", "parent_dir", "project_name", "utc", "scenario_name", "tmy_name", "grid_x_mm", "grid_y_mm", "radiance_parameters"}, selected="grid_x_mm")
get_config_value_2 = GhPythonScript(keys=read_workbench_config_2.keys, values=read_workbench_config_2.values, search_key=list_4)  # -> out, out_value; inputs keys: list, values: list; same code as get_config_value
list_5 = ValueList({"project_data", "raw_host_file", "latitude", "host_name", "exclude_surfaces", "base_epw", "longitude", "timezone", "elevation", "parent_dir", "project_name", "utc", "scenario_name", "tmy_name", "grid_x_mm", "grid_y_mm", "radiance_parameters"}, selected="grid_y_mm")
get_config_value_3 = GhPythonScript(keys=read_workbench_config_2.keys, values=read_workbench_config_2.values, search_key=list_5)  # -> out, out_value; inputs keys: list, values: list; same code as get_config_value
list_6 = ValueList({"project_data", "raw_host_file", "latitude", "host_name", "exclude_surfaces", "base_epw", "longitude", "timezone", "elevation", "parent_dir", "project_name", "utc", "scenario_name", "tmy_name", "grid_x_mm", "grid_y_mm", "radiance_parameters"}, selected="host_name")
get_config_value_4 = GhPythonScript(keys=read_workbench_config.keys, values=read_workbench_config.values, search_key=list_6)  # -> out, out_value; inputs keys: list, values: list; same code as get_config_value
cell_info_table = FilePath(locate_device_data.out_file)

# ---- group: Control Panel
enable_panelizer = BooleanToggle(True)
write_panelizer = BooleanToggle(False)
enable_cell_creation = BooleanToggle(True)
enable_radiance_writer = BooleanToggle(False)

# ----
write_radiance = BooleanToggle(False)
path = FilePath("/Users/jmccarty/Data/230110_cisbat_carbon/02_model/panelizer_models/")
host_name_to_path = GhPythonScript(host_name=get_config_value_4.out_value)  # -> out, root
# ---------- host_name_to_path: Python ----------
__author__ = "jmccarty"

import re
root = re.sub("[^0-9]", "", host_name)
# ---------- end host_name_to_path ----------

# ---- group: Deconstruct Template Model
panel_2 = Panel("""output_host
output_host_obstructions
output_terrain
output_host_windows
output_vegetation_seasonal
output_vegetation_constant
output_opaque_context
output_raised_surfaces
output_integrated_surfaces""")
_3dm = Import3DM(File=locate_geometry_file.out_file, Layer=graft(panel_2), Name="*")  # -> simplify(Geometry)
mindex = MemberIndex(Set=panel_2, Member="output_raised_surfaces")  # -> Index, Count
mindex_2 = MemberIndex(Set=panel_2, Member="output_integrated_surfaces")  # -> Index, Count
mindex_3 = MemberIndex(Set=panel_2, Member="output_vegetation_constant")  # -> Index, Count
mindex_4 = MemberIndex(Set=panel_2, Member="output_opaque_context")  # -> Index, Count
mindex_5 = MemberIndex(Set=panel_2, Member="output_host")  # -> Index, Count
mindex_6 = MemberIndex(Set=panel_2, Member="output_host_obstructions")  # -> Index, Count
mindex_7 = MemberIndex(Set=panel_2, Member="output_terrain")  # -> Index, Count
mindex_8 = MemberIndex(Set=panel_2, Member="output_host_windows")  # -> Index, Count
mindex_9 = MemberIndex(Set=panel_2, Member="output_vegetation_seasonal")  # -> Index, Count
branch = TreeBranch(Tree=_3dm, Path=mindex.Index, MaintainPaths=True)
branch_2 = TreeBranch(Tree=_3dm, Path=mindex_2.Index, MaintainPaths=True)
branch_3 = TreeBranch(Tree=_3dm, Path=mindex_3.Index, MaintainPaths=True)
branch_4 = TreeBranch(Tree=_3dm, Path=mindex_4.Index, MaintainPaths=True)
branch_5 = TreeBranch(Tree=_3dm, Path=mindex_5.Index, MaintainPaths=True)
branch_6 = TreeBranch(Tree=_3dm, Path=mindex_6.Index, MaintainPaths=True)
branch_7 = TreeBranch(Tree=_3dm, Path=mindex_7.Index, MaintainPaths=True)
branch_8 = TreeBranch(Tree=_3dm, Path=mindex_8.Index, MaintainPaths=True)
branch_9 = TreeBranch(Tree=_3dm, Path=mindex_9.Index, MaintainPaths=True)
flatten = FlattenTree(Tree=branch_5, Path=host_name_to_path.root)
terrain = Brep(branch_7)
flatten_2 = FlattenTree(Tree=branch_6, Path=host_name_to_path.root)
merge = Merge(Data1=branch, Data2=branch_2)
flatten_3 = FlattenTree(Tree=merge, Path=host_name_to_path.root)  # -> graft(Tree)

# ---- group: Remove down facing surfaces
brep = Brep(flatten_3)
area = Area(Geometry=brep)  # -> Area, Centroid
evalsrf = EvaluateSurface(Surface=brep, Point=area.Centroid)  # -> Point, Normal, UDirection, VDirection, Frame
devec = DeconstructVector(Vector=evalsrf.Normal)  # -> XComponent, YComponent, ZComponent
smaller = SmallerThan(FirstNumber=devec.ZComponent, SecondNumber=0)  # -> SmallerThan, OrEqualTo
dispatch = Dispatch(List=brep, DispatchPattern=smaller.SmallerThan)  # -> ListA, ListB
brep_2 = Brep(dispatch.ListB)

# ---- group: Get Lower Left
flatten_4 = FlattenTree(Tree=brep_2, Path=host_name_to_path.root)  # -> graft(Tree)
area_2 = Area(Geometry=flatten_4)  # -> Area, Centroid
vec = VectorXYZ(XComponent=Slider(0, range=0..100), YComponent=Slider(1, range=0..1), ZComponent=Slider(0, range=0..100))  # -> Vector, Length
evalsrf_2 = EvaluateSurface(Surface=flatten_4, Point=area_2.Centroid)  # -> Point, Normal, UDirection, VDirection, Frame
debrep = DeconstructBrep(Brep=flatten_4)  # -> Faces, Edges, Vertices
trim = TrimTree(Tree=debrep.Vertices, Depth=1)
pdecon = Deconstruct(Point=trim)  # -> XComponent, YComponent, ZComponent
sort = SortList(Keys=pdecon.ZComponent)  # -> Keys, ValuesA
cset = CreateSet(List=sort.Keys)  # -> Set, Map
item = ListItem(List=cset.Set, Index=0, Wrap=True)
mindex_10 = MemberIndex(Set=pdecon.ZComponent, Member=item)  # -> Index, Count
trim_2 = TrimTree(Tree=mindex_10.Index, Depth=1)
item_2 = ListItem(List=trim, Index=trim_2, Wrap=True)
calc_angle_from_north = GhPythonScript(north_vector=vec.Vector, vector_b=evalsrf_2.Normal)  # -> out, angle; inputs north_vector: Vector3d, vector_b: Vector3d
# ---------- calc_angle_from_north: Python ----------
__author__ = "jmccarty_teach"

import rhinoscriptsyntax as rs
import math


x1 = north_vector.X
x2 = vector_b.X
y1 = north_vector.Y
y2 = vector_b.Y

a = (x1,y1)
b = (x2,y2)

ang1 = math.atan2(*a[::-1])
ang2 = math.atan2(*b[::-1])

angle = math.degrees((ang1 - ang2) % (2 * math.pi))
# ---------- end calc_angle_from_north ----------
pdecon_2 = Deconstruct(Point=item_2)  # -> XComponent, YComponent, ZComponent
angle_sorter = GhPythonScript(angle=calc_angle_from_north.angle, X=pdecon_2.XComponent, Y=pdecon_2.YComponent)  # -> out, dir, key; inputs X: list, Y: list
# ---------- angle_sorter: Python ----------
__author__ = "jmccarty_teach"

import rhinoscriptsyntax as rs
if angle < 90:
    print("North, largest X")
    dir = "X"
    key = max(X)
elif 90 <= angle < 180:
    print("East, lowest Y")
    dir = "Y"
    key = min(Y)
elif 180 <= angle < 270:
    print("South, lowest X")
    dir = "X"
    key = min(X)
elif angle >= 270:
    print("West, largest Y")
    dir = "Y"
    key = max(Y)
# ---------- end angle_sorter ----------
python = GhPythonScript(dir=angle_sorter.dir, key=angle_sorter.key, x_list=pdecon_2.XComponent, y_list=pdecon_2.YComponent)  # -> out, out_dir, index; inputs x_list: list, y_list: list
# ---------- python: Python ----------
__author__ = "jmccarty_teach"

import rhinoscriptsyntax as rs

if dir=="X":
    out_dir = "X"
    index = x_list.index(key)
else:
    out_dir = "Y"
    index = y_list.index(key)
# ---------- end python ----------
item_3 = ListItem(List=item_2, Index=python.index, Wrap=True)

# ---- group: Dispatch Flat Roof
evalsrf_3 = EvaluateSurface(Surface=flatten_4, Point=item_3)  # -> Point, Normal, UDirection, VDirection, Frame
devec_2 = DeconstructVector(Vector=evalsrf_3.Normal)  # -> XComponent, YComponent, ZComponent
equalst = EqualityWithinTolerance(FirstNumber=devec_2.ZComponent, SecondNumber=Slider(1, range=-1..1), Tolerance=Slider(1e-05, range=0..1e-05))  # -> Equality, Inequality
dispatch_2 = Dispatch(List=flatten_4, DispatchPattern=equalst.Equality)  # -> ListA, ListB
dispatch_3 = Dispatch(List=evalsrf_3.Normal, DispatchPattern=equalst.Equality)  # -> ListA, ListB
dispatch_4 = Dispatch(List=item_3, DispatchPattern=equalst.Equality)  # -> ListA, ListB
clean = CleanTree(RemoveNulls=True, RemoveInvalid=True, RemoveEmpty=True, Tree=dispatch_2.ListB)
clean_2 = CleanTree(RemoveNulls=True, RemoveInvalid=True, RemoveEmpty=True, Tree=dispatch_4.ListB)
clean_3 = CleanTree(RemoveNulls=True, RemoveInvalid=True, RemoveEmpty=True, Tree=dispatch_3.ListB)

# ---- group: Tilted Surfaces
wires = BrepWireframe(Brep=clean, Density=-1)
trim_helper = TrimHelper(output_paths=wires, input_paths=clean_2)
crv_cp = CurveClosestPoint(Point=clean_2, Curve=trim_helper)  # -> Point, Parameter, Distance
smaller_2 = SmallerThan(FirstNumber=crv_cp.Distance, SecondNumber=Slider(0.002, range=0..0.01))  # -> SmallerThan, OrEqualTo
dispatch_5 = Dispatch(List=trim_helper, DispatchPattern=smaller_2.SmallerThan)  # -> ListA, ListB
midpt = CurveMiddle(Curve=dispatch_5.ListA)
pdecon_3 = Deconstruct(Point=midpt)  # -> XComponent, YComponent, ZComponent
pdecon_4 = Deconstruct(Point=clean_2)  # -> XComponent, YComponent, ZComponent
subtraction = Subtraction(A=pdecon_4.ZComponent, B=pdecon_3.ZComponent)
abs = Absolute(Value=subtraction)
sort_2 = SortList(Keys=abs, ValuesA=midpt)  # -> Keys, ValuesA
pl = PlaneNormal(Origin=clean_2, ZAxis=clean_3)
item_4 = ListItem(List=sort_2.ValuesA, Index=-1, Wrap=True)
item_5 = ListItem(List=sort_2.ValuesA, Index=0, Wrap=True)
toggle = BooleanToggle(True)
vec2pt = Vector2Pt(PointA=clean_2, PointB=item_5, Unitize=toggle)  # -> Vector, Length
vec2pt_2 = Vector2Pt(PointA=clean_2, PointB=item_4, Unitize=toggle)  # -> Vector, Length
align = AlignPlane(Plane=pl, Direction=vec2pt_2.Vector)  # -> Plane, Angle
align_2 = AlignPlane(Plane=pl, Direction=vec2pt.Vector)  # -> Plane, Angle

# ----
deplane = DeconstructPlane(Plane=align_2.Plane)  # -> Origin, XAxis, YAxis, ZAxis
deplane_2 = DeconstructPlane(Plane=align.Plane)  # -> Origin, XAxis, YAxis, ZAxis
angle = Angle(VectorA=vec2pt_2.Vector, VectorB=deplane.YAxis)  # -> Angle, Reflex
angle_2 = Angle(VectorA=vec2pt.Vector, VectorB=deplane_2.YAxis)  # -> Angle, Reflex
merge_2 = Merge(Data1=angle.Angle, Data2=angle_2.Angle)
merge_3 = Merge(Data1=align_2.Plane, Data2=align.Plane)
sort_3 = SortList(Keys=merge_2, ValuesA=merge_3)  # -> Keys, ValuesA
item_6 = ListItem(List=sort_3.ValuesA, Index=0, Wrap=True)

path_2 = ConstructPath(Indices=[Slider(1000, range=0..1000), Slider(7, range=0..16)])

# ---- group: Panelizer Distribution / Surface Origins
pt = Point(item_3)

# ---- group: Panelizer Distribution / Original Surfaces
srf = Surface(flatten_4)

# ---- group: Panelizer Distribution / Building
building_number = Number(host_name_to_path.root)

# ----
concat = Concatenate(FragmentA="{?;0;", FragmentB=Slider(1, range=0..11), FragmentC="}")
split = SplitTree(Data=srf, Masks=flatten(concat))  # -> Positive, Negative

# ---- group: Enable Radiance Model Builder
python_gate = GhPythonScript(object_to_pass=srf, pass_object=enable_radiance_writer)  # -> out, out_object
# ---------- python_gate: Python ----------
__author__ = "jmccarty"

import rhinoscriptsyntax as rs

if pass_object:
    out_object=object_to_pass
else:
    out_object=None
# ---------- end python_gate ----------

# ---- group: Enable Panelizer
python_gate_2 = GhPythonScript(object_to_pass=srf, pass_object=enable_panelizer)  # -> out, out_object; same code as python_gate
python_gate_3 = GhPythonScript(object_to_pass=pt, pass_object=enable_panelizer)  # -> out, out_object; same code as python_gate

# ---- group: Surface Setup / Base Surface
srf_2 = Surface(python_gate_2.out_object)

# ----
number_slider = Slider(1, range=0..1)
number_slider_2 = Slider(0, range=0..100)
number_slider_3 = Slider(0, range=0..100)

brep_3 = Brep(terrain)
area_3 = Area(Geometry=brep_3)  # -> Area, Centroid
evalsrf_4 = EvaluateSurface(Surface=brep_3, Point=area_3.Centroid)  # -> Point, Normal, UDirection, VDirection, Frame
number_slider_4 = Slider(0.5, range=0..1)
number_slider_5 = Slider(0.5, range=0..1)
devec_3 = DeconstructVector(Vector=evalsrf_4.Normal)  # -> XComponent, YComponent, ZComponent
searchmods = HBSearchMofidiers(keywords="context")  # -> modifiers; plug-in component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
smaller_3 = SmallerThan(FirstNumber=devec_3.ZComponent, SecondNumber=0)  # -> SmallerThan, OrEqualTo
glassmod3 = HBGlassModifier3(
    name="seasonal_hull",
    r_trans=number_slider_4,
    g_trans=number_slider_4,
    b_trans=number_slider_4,
    refract=Slider(1.2, range=0..10))  # -> modifier; plug-in component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
glassmod3_2 = HBGlassModifier3(
    name="constant_hull",
    r_trans=number_slider_5,
    g_trans=number_slider_5,
    b_trans=number_slider_5,
    refract=Slider(1.2, range=0..10))  # -> modifier; plug-in component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
python_2 = GhPythonScript(down=smaller_3.SmallerThan, normal=brep_3)  # -> out, a; inputs down: Boolean, normal: Surface
# ---------- python_2: Python ----------
__author__ = "jmccarty"

import rhinoscriptsyntax as rs
import Rhino
import ghpythonlib.components as ghc

srf =Rhino.Geometry.Brep.CreateFromSurface(normal)
if down==True:
    flippedSrf, success = ghc.Flip(normal)
    a = flippedSrf
else:
    print("Up")
    a = normal
# ---------- end python_2 ----------
face = HBFace(geo=flatten, name="host", rad_mod=searchmods)  # -> report, faces; plug-in component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
face_2 = HBFace(geo=branch_9, name="seasonal_vegetation", rad_mod=glassmod3)  # -> report, faces; plug-in component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
face_3 = HBFace(geo=flatten([flatten_2, branch_4]), name="context", rad_mod=searchmods)  # -> report, faces; plug-in component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
face_4 = HBFace(geo=branch_3, name="constant_vegetation", rad_mod=glassmod3_2)  # -> report, faces; plug-in component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
face_5 = HBFace(geo=python_2.a, name="terrain", rad_mod=searchmods)  # -> report, faces; plug-in component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

path_3 = ConstructPath(Indices=[Slider(1000, range=0..1000), Slider(1, range=0..16)])

# ---- group: Check again to remove irregular modules / This is a sensitive metric
number_slider_6 = Slider(0.007, range=0..1)

# ----
list_7 = ValueList({"Clear": "solar_glass", "Light Gray": "light_grey", "White": "basic_white"}, selected="Clear")
list_8 = ValueList({"Clear": "solar_glass", "Light Gray": "light_grey", "White": "basic_white"}, selected="White")
list_9 = ValueList({"Clear": "solar_glass", "Light Gray": "light_grey", "White": "basic_white"}, selected="Light Gray")
merge_4 = Merge(Data1=list_7, Data2=list_9, Data3=list_8)
python_3 = GhPythonScript(dir=path, sub="objects", building=get_config_value_4.out_value)  # -> out, a
# ---------- python_3: Python ----------
__author__ = "jmccarty"

import rhinoscriptsyntax as rs

import os

out_dir = os.path.join(dir,sub,building,"panelizer")

if os.path.exists(out_dir):
    pass
    
else:
    os.makedirs(out_dir)
    
a = out_dir
# ---------- end python_3 ----------

# ---- group: Get Cell and Module Information
file = ReadFile(File=cell_info_table, PerLineParse=True)
number_slider_7 = Slider(12, range=0..12)
split_2 = TextSplit(Text=file, Separators=",")
flip = FlipMatrix(Data=simplify(split_2))
panel_3 = Panel("{0;0}")
split_3 = SplitList(List=flip, Index=Slider(1, range=0..100))  # -> ListA, ListB
pd = PathDescription(Data=split_3.ListA)
cset_2 = CreateSet(List=flatten(split_3.ListA))  # -> Set, Map

# ---- group: Get Cell and Module Information / Values
split_4 = SplitTree(Data=split_3.ListB, Masks=flatten(panel_3))  # -> Positive, Negative

# ---- group: Get Cell and Module Information / Keys
split_5 = SplitTree(Data=split_3.ListA, Masks=flatten(panel_3))  # -> Positive, Negative

# ---- group: Get Cell and Module Information / Get Column
mindex_11 = MemberIndex(Set=cset_2.Set, Member="device_name")  # -> Index, Count
item_7 = ListItem(List=flatten(pd), Index=mindex_11.Index, Wrap=True)
branch_10 = TreeBranch(Tree=split_3.ListB, Path=item_7, MaintainPaths=True)

# ---- group: Get Cell and Module Information (continued)
panel_4 = Panel(branch_10)

# ----
item_8 = ListItem(List=flatten(branch_10), Index=number_slider_7, Wrap=True)
panel_5 = Panel(item_8)
item_9 = ListItem(List=split_5.Negative, Index=number_slider_7, Wrap=True)  # -> flatten(Item)
item_10 = ListItem(List=split_4.Negative, Index=number_slider_7, Wrap=True)  # -> flatten(Item)
concat_2 = Concatenate(FragmentA=item_9, FragmentB=" : ", FragmentC=item_10)
panel_6 = Panel(concat_2)
read_module_info = GhPythonScript(keys=item_9, values=item_10)  # -> out, port, cell_type, cec_key, port_2, n_cols, cell_width, module_width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; inputs keys: list, values: list
# ---------- read_module_info: Python ----------
__author__ = "jmccarty"

import rhinoscriptsyntax as rs
from ast import literal_eval

string_keys = ["scenario","cell","orientation","cec_database_key",]
int_keys = ["n_cols_ideal","n_rows_ideal", "n_cols","n_rows","total_cells","min_cell_module","N_s","N_p","n_submodule","Nsubcell_col","Nsubcell_row"]
mm_keys = ["cell_width","cell_height","cell_col_spacing","cell_row_spacing","frame_size","module_width","module_height"]

new_keys = []
new_values = []
for n, v in enumerate(values):
    k = keys[n]
    new_keys.append(k)
    
    
    if k in string_keys:
        new_values.append(v)
    elif k==int_keys:
        new_values.append(int(v))
    else:
        new_values.append(float(v))

final_keys = []
final_values = []

for n, v in enumerate(new_values):
    k = new_keys[n]
    final_keys.append(k)
    if k in mm_keys:
        final_values.append(float(v) / 1000)
    else:
        final_values.append(v)

parameters = dict(zip(final_keys,final_values))

for k,v in parameters.items():
    print(k,v, type(v))

#------------

cell_type = parameters["cell"]
cec_key = parameters["cec_database_key"]

n_cols = parameters['n_cols']
cell_width = parameters['cell_width']
module_width = parameters['module_width']
Nsubcell_col = parameters['Nsubcell_col']
cell_col_spacing = parameters['cell_col_spacing']
if n_cols==1:
    subcell_width = (n_cols*cell_width) / Nsubcell_col
else:
    subcell_width = cell_width
n_cols_subcell = int(n_cols * Nsubcell_col)
n_cols_ideal = int(parameters['n_cols_ideal'] * Nsubcell_col)


n_rows = parameters['n_rows']
cell_height = parameters['cell_height']
module_height = parameters['module_height']
Nsubcell_row = parameters['Nsubcell_row']
cell_row_spacing = parameters['cell_row_spacing']
if n_rows==1:
    subcell_height = (n_rows*cell_height) / Nsubcell_row
else:
    subcell_height = cell_height
n_rows_subcell = int(n_rows * Nsubcell_row)
n_rows_ideal = int(parameters['n_rows_ideal'] * Nsubcell_row)


min_cell_module = parameters['min_cell_module']
n_submodule = parameters['n_submodule']

frame_size = parameters['frame_size']
# ---------- end read_module_info ----------
multiplication = Multiplication(A=read_module_info.n_cols_subcell, B=read_module_info.n_rows_subcell)

# ---- group: Panelizer Distribution / cell_spacing
cell_cols_spacing = Number(read_module_info.cell_col_spacing)
cell_row_spacing = Number(read_module_info.cell_row_spacing)

# ---- group: Panelizer Distribution / cell_height
num = Number(read_module_info.subcell_height)

# ---- group: Panelizer Distribution / module_height
num_2 = Number(read_module_info.module_height)

# ---- group: Panelizer Distribution / frame_thickness
num_3 = Number(read_module_info.frame_size)

# ---- group: Panelizer Distribution / num_cell_columns
num_4 = Number(read_module_info.n_cols_subcell)

# ---- group: Panelizer Distribution / cell_width
num_5 = Number(read_module_info.subcell_width)

# ---- group: Panelizer Distribution / module_width
num_6 = Number(read_module_info.module_width)

# ---- group: Panelizer Distribution / num_cell_rows
num_7 = Number(read_module_info.n_rows_subcell)

# ---- group: Panelizer Distribution / minimum_cell_count
num_8 = Number(read_module_info.min_cell_module)

# ----
frame_thickness = Number(num_3)
cell_cols_spacing_2 = Number(cell_cols_spacing)
concat_3 = Concatenate(FragmentA=item_8, FragmentC="_", FragmentB=merge_4)
python_4 = GhPythonScript(dir=python_3.a, file_name=concat_3, building=host_name_to_path.root)  # -> out, write_path
# ---------- python_4: Python ----------
__author__ = "jmccarty"

import rhinoscriptsyntax as rs
import os

write_path = os.path.join(dir,file_name+"_B"+building+"_raw.pickle")
# ---------- end python_4 ----------

# ---- group: Flat Roof PLanes
clean_4 = CleanTree(RemoveNulls=True, RemoveInvalid=True, RemoveEmpty=True, Tree=dispatch_4.ListA)
clean_5 = CleanTree(RemoveNulls=True, RemoveInvalid=True, RemoveEmpty=True, Tree=dispatch_2.ListA)
wires_2 = BrepWireframe(Brep=clean_5, Density=-1)
pt_2 = Point(clean_4)
trim_helper_2 = TrimHelper(output_paths=wires_2, input_paths=pt_2)

# ---- group: Flat Roof PLanes / Join boundary curves for each surface and find the outside curve by comparing the area of any curves in the set.
join = JoinCurves(Curves=trim_helper_2, Preserve=False)

# ---- group: Flat Roof PLanes (continued)
area_4 = Area(Geometry=join)  # -> Area, Centroid

# ---- group: Flat Roof PLanes / Join boundary curves for each surface and find the outside curve by comparing the area of any curves in the set. (continued)
sort_4 = SortList(Keys=area_4.Area, ValuesA=join)  # -> Keys, reverse(ValuesA)
item_11 = ListItem(List=sort_4.ValuesA, Index=0, Wrap=True)
trim_helper_3 = TrimHelper(output_paths=item_11, input_paths=pt_2)

# ---- group: Flat Roof PLanes / generate curve to all segments from boundary origin. test if midpoint of new curve intersects with the boundary curve. use this to build initial plane.
midpt_2 = CurveMiddle(Curve=trim_helper_2)
ln = Line(StartPoint=pt_2, EndPoint=midpt_2)
len = Length(Curve=ln)
sort_5 = SortList(Keys=len, ValuesA=ln)  # -> Keys, ValuesA
midpt_3 = CurveMiddle(Curve=sort_5.ValuesA)
incurve = PointInCurve(Point=midpt_3, Curve=trim_helper_3)  # -> Relationship, Point
equals = Equality(FirstNumber=incurve.Relationship, SecondNumber=Slider(1, range=0..1))  # -> Equality, Inequality
dispatch_6 = Dispatch(List=midpt_3, DispatchPattern=equals.Equality)  # -> ListA, ListB
pt_3 = Point(dispatch_6.ListA)
split_6 = SplitList(List=pt_3, Index=Slider(1, range=0..1))  # -> ListA, ListB
trim_helper_4 = TrimHelper(output_paths=split_6.ListB, input_paths=pt_3)
trim_helper_5 = TrimHelper(output_paths=split_6.ListA, input_paths=pt_3)
pl_3pt = Plane3Pt(PointA=pt_2, PointB=trim_helper_5, PointC=trim_helper_4)
deplane_3 = DeconstructPlane(Plane=pl_3pt)  # -> Origin, XAxis, YAxis, ZAxis

# ---- group: Flat Roof PLanes / Create base XY plane and align. Test aligns to see which has X and Y vectors that lie on the surface boundary
xy = XYPlane(Origin=pt_2)
align_3 = AlignPlane(Plane=xy, Direction=deplane_3.XAxis)  # -> Plane, Angle
align_4 = AlignPlane(Plane=xy, Direction=deplane_3.YAxis)  # -> Plane, Angle
deplane_4 = DeconstructPlane(Plane=align_3.Plane)  # -> Origin, XAxis, YAxis, ZAxis
deplane_5 = DeconstructPlane(Plane=align_4.Plane)  # -> Origin, XAxis, YAxis, ZAxis
vdis = VectorDisplay(Anchor=pt_2, Vector=deplane_5.XAxis)
vdis_2 = VectorDisplay(Anchor=pt_2, Vector=deplane_5.YAxis)
number_slider_8 = Slider(0.1, range=0..0.1)
line = LineSDL(Start=pt_2, Direction=deplane_4.XAxis, Length=number_slider_8)
line_2 = LineSDL(Start=pt_2, Direction=deplane_4.YAxis, Length=number_slider_8)
line_3 = LineSDL(Start=pt_2, Direction=deplane_5.XAxis, Length=number_slider_8)
line_4 = LineSDL(Start=pt_2, Direction=deplane_5.YAxis, Length=number_slider_8)
end = EndPoints(Curve=line)  # -> Start, End
end_2 = EndPoints(Curve=line_2)  # -> Start, End
end_3 = EndPoints(Curve=line_3)  # -> Start, End
end_4 = EndPoints(Curve=line_4)  # -> Start, End
incurve_2 = PointInCurve(Point=end_2.End, Curve=trim_helper_3)  # -> Relationship, Point
incurve_3 = PointInCurve(Point=end_4.End, Curve=trim_helper_3)  # -> Relationship, Point
incurve_4 = PointInCurve(Point=end_3.End, Curve=trim_helper_3)  # -> Relationship, Point
incurve_5 = PointInCurve(Point=end.End, Curve=trim_helper_3)  # -> Relationship, Point
addition = Addition(A=incurve_5.Relationship, B=incurve_2.Relationship)
number_slider_9 = Slider(2, range=0..10)
addition_2 = Addition(A=incurve_4.Relationship, B=incurve_3.Relationship)
equals_2 = Equality(FirstNumber=addition_2, SecondNumber=number_slider_9)  # -> Equality, Inequality
equals_3 = Equality(FirstNumber=addition, SecondNumber=number_slider_9)  # -> Equality, Inequality
dispatch_7 = Dispatch(List=align_3.Plane, DispatchPattern=equals_3.Equality)  # -> ListA, ListB
dispatch_8 = Dispatch(List=align_4.Plane, DispatchPattern=equals_2.Equality)  # -> ListA, ListB
merge_5 = Merge(Data1=dispatch_7.ListA, Data2=dispatch_8.ListA)

# ---- group: Planes
merge_6 = Merge(Data1=item_6, Data2=merge_5)

# ----
item_12 = ListItem(List=merge_6, Index=0, Wrap=True)
deplane_6 = DeconstructPlane(Plane=item_12)  # -> Origin, XAxis, YAxis, ZAxis

# ---- group: Panelizer Distribution / Surface Planes
plane = Plane(item_12)

# ---- group: Panelizer Distribution / Surface X Vector
vec_2 = Vector(deplane_6.XAxis)

# ---- group: Panelizer Distribution / Surface Y Vector
vec_3 = Vector(deplane_6.YAxis)

# ----
rad_cell_height = Number(get_config_value_3.out_value)
rad_cell_width = Number(get_config_value_2.out_value)
surface_planes = Plane(plane)
surface_z_vector = Vector(deplane_6.ZAxis)
surface_x_vector = Vector(vec_2)
surface_y_vector = Vector(vec_3)
surface_points = Point(item_3)
building_number_2 = Number(building_number)
surfaces = Surface(python_gate.out_object)

branch_11 = TreeBranch(Tree=surface_points, Path=path_2, MaintainPaths=True)

# ---- group: Convert mm ot meter
division = Division(A=rad_cell_width, B=1000)
division_2 = Division(A=rad_cell_height, B=1000)

# ----
vdis_3 = VectorDisplay(Anchor=surface_points, Vector=surface_y_vector)
vdis_4 = VectorDisplay(Anchor=surface_points, Vector=surface_x_vector)

# ---- group: Panelizer Distribution / Surface Z Vector
vec_4 = Vector(deplane_6.ZAxis)

# ----
brec = BoundingRectangle(Geometry=surfaces, Plane=surface_planes, Axis=0, Slide=0, Union=True)  # -> Bounding, DimensionX, DimensionY
rec = Rectangle(brec.Bounding)
txt = Text(rec)
trim_helper_6 = TrimHelper(output_paths=txt, input_paths=surfaces)
vdis_5 = VectorDisplay(Anchor=pt, Vector=vec_2)
vdis_6 = VectorDisplay(Anchor=pt, Vector=vec_3)
python_5 = GhPythonScript(x=trim_helper_6)  # -> out, h, w
# ---------- python_5: Python ----------
__author__ = "jmccarty"

import rhinoscriptsyntax as rs



simple_dims = x.split("Rectangle (")[1].replace(")","")

w = simple_dims.split(",")[0].split("=")[-1]
h = simple_dims.split(",")[1].split("=")[-1]
# ---------- end python_5 ----------

# ---- group: Cellulate
number_slider_10 = Slider(1, range=0..1)
multiplication_2 = Multiplication(A=python_5.h, B=number_slider_10)
multiplication_3 = Multiplication(A=python_5.w, B=number_slider_10)
division_3 = Division(A=multiplication_3, B=division)
addition_3 = Addition(A=division_3, B=1)
division_4 = Division(A=multiplication_2, B=division)
ceil = GhPythonScript(x=addition_3)  # -> out, a
# ---------- ceil: Python ----------
__author__ = "jmccarty"

import rhinoscriptsyntax as rs
import math

a = math.ceil(x)
# ---------- end ceil ----------
addition_4 = Addition(A=division_4, B=1)
repeat = RepeatData(Data=division, Length=ceil.a)
trim_helper_7 = TrimHelper(output_paths=repeat, input_paths=ceil.a)
ma = MassAddition(Input=trim_helper_7)  # -> Result, PartialResults
number_slider_11 = Slider(0, range=0..100)
ins = InsertItems(List=ma.PartialResults, Item=number_slider_11, Indices=number_slider_11, Wrap=True)
trim_helper_8 = TrimHelper(output_paths=ins, input_paths=ma.PartialResults)
rev = Reverse(Vector=surface_x_vector)
amp = Amplitude(Vector=surface_x_vector, Amplitude=trim_helper_8)
amp_2 = Amplitude(Vector=rev, Amplitude=trim_helper_8)
move = Move(Geometry=surface_points, Motion=amp_2)  # -> Geometry, Transform
move_2 = Move(Geometry=surface_points, Motion=amp)  # -> Geometry, Transform
ceil_2 = GhPythonScript(x=addition_4)  # -> out, a; same code as ceil
repeat_2 = RepeatData(Data=division, Length=ceil_2.a)
group = Group(Objects=[move_2.Geometry, move.Geometry])
trim_helper_9 = TrimHelper(output_paths=repeat_2, input_paths=ceil_2.a)
ma_2 = MassAddition(Input=trim_helper_9)  # -> Result, PartialResults
number_slider_12 = Slider(0, range=0..100)
ins_2 = InsertItems(List=ma_2.PartialResults, Item=number_slider_12, Indices=number_slider_12, Wrap=True)
trim_helper_10 = TrimHelper(output_paths=ins_2, input_paths=ma_2.PartialResults)
rev_2 = Reverse(Vector=surface_y_vector)
amp_3 = Amplitude(Vector=surface_y_vector, Amplitude=trim_helper_10)
amp_4 = Amplitude(Vector=rev_2, Amplitude=trim_helper_10)
move_3 = Move(Geometry=group, Motion=amp_3)  # -> Geometry, Transform
move_4 = Move(Geometry=group, Motion=amp_4)  # -> Geometry, Transform
merge_7 = Merge(Data1=move_3.Geometry, Data2=move_4.Geometry)
ungroup = Ungroup(Group=merge_7)
trim_helper_11 = TrimHelper(output_paths=ungroup, input_paths=move_4.Geometry)
diagonal_transform = DiagonalTransform(origin_point=surface_points, y_vector=surface_y_vector, x_vector=surface_x_vector)
python_6 = GhPythonScript(x_increment=division, y_increment=division)  # -> out, a
# ---------- python_6: Python ----------
__author__ = "jmccarty"

import rhinoscriptsyntax as rs
import math

a = math.sqrt((x_increment/2)**2 + (y_increment/2)**2)
# ---------- end python_6 ----------
group_2 = Group(Objects=trim_helper_11)
amp_5 = Amplitude(Vector=diagonal_transform, Amplitude=python_6.a)
move_5 = Move(Geometry=group_2, Motion=amp_5)  # -> Geometry, Transform

# ----
rev_3 = Reverse(Vector=vec_2)

# ---- group: Offset from surface
amp_6 = Amplitude(Vector=surface_z_vector, Amplitude=Slider(0.01, range=0..0.01))
move_6 = Move(Geometry=move_5.Geometry, Motion=amp_6)  # -> Geometry, Transform
ungroup_2 = Ungroup(Group=move_6.Geometry)

# ----
rev_4 = Reverse(Vector=vec_3)

# ---- group: Remove excess points
trim_helper_12 = TrimHelper(output_paths=ungroup_2, input_paths=move_6.Geometry)
rev_5 = Reverse(Vector=surface_z_vector)
meshray = MeshRay(Mesh=surfaces, Point=trim_helper_12, Direction=rev_5)  # -> Point, Hit
dispatch_9 = Dispatch(List=trim_helper_12, DispatchPattern=meshray.Hit)  # -> ListA, ListB
pt_4 = Point(dispatch_9.ListA)

# ---- group: Surface Z Vector
rev_6 = Reverse(Vector=vec_4)

# ----
cullpt = CullDuplicates(Points=dispatch_9.ListA, Tolerance=0.1, CullMode=3)  # -> Points, Indices, Valence
diagonal_transform_2 = DiagonalTransform(origin_point=pt, y_vector=vec_3, x_vector=vec_2)
lng = ListLength(List=cullpt.Points)

# ---- group: Keep it Clean
area_5 = Area(Geometry=surfaces)  # -> Area, Centroid
item_13 = ListItem(List=cullpt.Points, Index=0, Wrap=True)
pd_2 = PathDescription(Data=item_13)
round = Round(Number=area_5.Area)  # -> Nearest, Floor, Ceiling
txt_2 = Text(pd_2)
naming_surfaces = GhPythonScript(surface_key=txt_2, area=round.Nearest)  # -> out, out_surface_name; inputs area: Int32
# ---------- naming_surfaces: Python ----------
__author__ = "jmccarty"

import rhinoscriptsyntax as rs

out_surface_name = "radiancesurface_"+str(surface_key)+"_"+str(area)+"sqm"
# ---------- end naming_surfaces ----------
lng_2 = ListLength(List=cullpt.Points)
repeat_3 = RepeatData(Data=surface_z_vector, Length=lng_2)
trim_helper_13 = TrimHelper(output_paths=repeat_3, input_paths=surface_z_vector)
naming_grids = GhPythonScript(surface_key=txt_2, n_sensors=lng)  # -> out, out_grid_name
# ---------- naming_grids: Python ----------
__author__ = "jmccarty"

import rhinoscriptsyntax as rs
surface_key = surface_key.replace("{","").replace("}","").replace(";","_")
out_grid_name = "radiancegrid_"+str(surface_key)+"_"+str(n_sensors)+"sensors"
# ---------- end naming_grids ----------

# ---- group: Remove Grids that are Smaller than Certain size
larger = LargerThan(FirstNumber=lng, SecondNumber=Slider(0, range=0..100))  # -> LargerThan, OrEqualTo
pd_3 = PathDescription(Data=lng)
dispatch_10 = Dispatch(List=pd_3, DispatchPattern=larger.LargerThan)  # -> ListA, ListB

# ----
branch_12 = TreeBranch(Tree=naming_grids.out_grid_name, Path=dispatch_10.ListA, MaintainPaths=True)
branch_13 = TreeBranch(Tree=cullpt.Points, Path=dispatch_10.ListA, MaintainPaths=True)
branch_14 = TreeBranch(Tree=trim_helper_13, Path=dispatch_10.ListA, MaintainPaths=True)

# ---- group: Grid
sensorgrid = HBSensorGrid(name=branch_12, positions=branch_13, directions=branch_14)  # -> grid; plug-in component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

# ----
model = HBModel(faces=flatten([face_5.faces, face.faces, face_3.faces, face_2.faces]), name="hb_model")  # -> report, model; plug-in component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
assigngridsviews = HBAssignGridsAndViews(model=model.model, grids=sensorgrid)  # -> model; plug-in component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

locate_radiance_folder = GhPythonScript(config_keys=panel, config_values=get_config_value.out_value)  # -> out, out_dir, out_name; inputs config_keys: list, config_values: list
# ---------- locate_radiance_folder: Python ----------
"""Creates the file path to save the 
    geometry file out of the template"""

__author__ = "jmccarty"

import os 
 

config_inputs = dict(zip(config_keys,config_values))

parent_dir = config_inputs['parent_dir']
project_name = config_inputs['project_name']
host_name = config_inputs['host_name']
scenario_name = config_inputs['scenario_name']

out_dir = os.path.join(parent_dir, project_name, "inputs", "hosts", host_name, scenario_name, 'radiance')
out_name = host_name
# ---------- end locate_radiance_folder ----------
branch_15 = TreeBranch(Tree=txt_2, Path=dispatch_10.ListA, MaintainPaths=True)
python_7 = GhPythonScript(dir=locate_radiance_folder.out_dir, building=locate_radiance_folder.out_name, surface=branch_15)  # -> out, a
# ---------- python_7: Python ----------
__author__ = "jmccarty"

import rhinoscriptsyntax as rs
import os

surface_clean = surface.replace("{","").replace("}","").replace(";","_")
out_dir = os.path.join(dir,"surface_" + surface_clean)

if os.path.exists(out_dir):
    pass
else:
    os.makedirs(out_dir)
a = out_dir
# ---------- end python_7 ----------
pd_4 = PathDescription(Data=branch_15)  # -> flatten(Paths)
assign_paths = AssignPaths(InputData=flatten(python_7.a), PathsToAssign=flatten(pd_4))
modeltorad = HBModelToRadFolder(model=assigngridsviews, minimal=Toggle(False), folder=assign_paths, write=write_radiance)  # -> report, folder; plug-in component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

vizwiref = HBVisualizeWireframe(hb_objs=flatten(assigngridsviews))  # -> geo; plug-in component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

# ---- group: Surface Setup
pln = Plane(plane)
trim_helper_14 = TrimHelper(output_paths=srf_2, input_paths=srf_2)
area_6 = Area(Geometry=trim_helper_14)  # -> Area, Centroid
sort_6 = SortList(Keys=area_6.Area, ValuesA=trim_helper_14)  # -> Keys, reverse(ValuesA)
item_14 = ListItem(List=sort_6.ValuesA, Index=0, Wrap=True)

# ----
brec_2 = BoundingRectangle(Geometry=item_14, Plane=pln, Axis=0, Slide=0, Union=True)  # -> Bounding, DimensionX, DimensionY

# ---- group: Surface Setup (continued)
rec_2 = Rectangle(brec_2.Bounding)
txt_3 = Text(rec_2)
trim_helper_15 = TrimHelper(output_paths=txt_3, input_paths=item_14)

# ---- group: Surface Bounds Width and Height
python_8 = GhPythonScript(x=trim_helper_15)  # -> out, h, w; same code as python_5

# ----
module_height = Number(num_2)
module_width = Number(num_6)
division_5 = Division(A=python_8.h, B=module_height)
division_6 = Division(A=python_8.w, B=module_width)
addition_5 = Addition(A=division_5, B=1)
addition_6 = Addition(A=division_6, B=1)
round_2 = Round(Number=addition_5)  # -> Nearest, Floor, Ceiling
round_3 = Round(Number=addition_6)  # -> Nearest, Floor, Ceiling
ptplanar = PlanarGrid(
    BasePoint=pt,
    IDir=vec_2,
    JDir=vec_3,
    IDistance=module_height,
    JDistance=module_width,
    INumber=round_2.Nearest,
    JNumber=round_3.Nearest)
ptcell = Cellulate(Grid=ptplanar)  # -> Wires, Cells, Meshes
trim_3 = TrimTree(Tree=ptcell.Cells, Depth=1)
lng_3 = ListLength(List=trim_3)
repeat_4 = RepeatData(Data=pt, Length=lng_3)  # -> simplify(Data)
pd_5 = PathDescription(Data=ptcell.Cells)
assign_paths_2 = AssignPaths(InputData=flatten(repeat_4), PathsToAssign=flatten(pd_5))
join_2 = JoinCurves(Curves=ptcell.Wires, Preserve=False)
ln_2 = Line(StartPoint=ptcell.Cells, EndPoint=assign_paths_2)
trim_helper_16 = TrimHelper(output_paths=join_2, input_paths=ptcell.Wires)
len_2 = Length(Curve=ln_2)
sort_7 = SortList(Keys=len_2, ValuesA=ptcell.Cells)  # -> Keys, ValuesA

amp_7 = Amplitude(Vector=vec_2, Amplitude=module_width)
move_7 = Move(Geometry=pt, Motion=amp_7)  # -> Geometry, Transform
amp_8 = Amplitude(Vector=vec_3, Amplitude=module_height)
move_8 = Move(Geometry=move_7.Geometry, Motion=amp_8)  # -> Geometry, Transform
python_9 = GhPythonScript(x=trim_helper_15)  # -> out, h, w; same code as python_5
multiplication_4 = Multiplication(A=python_9.h, B=number_slider)
multiplication_5 = Multiplication(A=python_9.w, B=number_slider)
division_7 = Division(A=multiplication_5, B=module_width)
addition_7 = Addition(A=division_7, B=1)
division_8 = Division(A=multiplication_4, B=module_height)
ceil_3 = GhPythonScript(x=addition_7)  # -> out, a; same code as ceil
addition_8 = Addition(A=division_8, B=1)
rec_2pt = Rectangle2Pt(Plane=pln, PointA=pt, PointB=move_8.Geometry, Radius=0)  # -> Rectangle, Length
repeat_5 = RepeatData(Data=module_width, Length=ceil_3.a)
trim_helper_17 = TrimHelper(output_paths=repeat_5, input_paths=ceil_3.a)
ma_3 = MassAddition(Input=trim_helper_17)  # -> Result, PartialResults
ins_3 = InsertItems(List=ma_3.PartialResults, Item=number_slider_2, Indices=number_slider_2, Wrap=True)
trim_helper_18 = TrimHelper(output_paths=ins_3, input_paths=ma_3.PartialResults)
amp_9 = Amplitude(Vector=vec_2, Amplitude=ma_3.PartialResults)
amp_10 = Amplitude(Vector=rev_3, Amplitude=trim_helper_18)
move_9 = Move(Geometry=rec_2pt.Rectangle, Motion=amp_10)  # -> Geometry, Transform
move_10 = Move(Geometry=rec_2pt.Rectangle, Motion=amp_9)  # -> Geometry, Transform
ceil_4 = GhPythonScript(x=addition_8)  # -> out, a; same code as ceil
repeat_6 = RepeatData(Data=module_height, Length=ceil_4.a)
group_3 = Group(Objects=[move_10.Geometry, move_9.Geometry])
trim_helper_19 = TrimHelper(output_paths=repeat_6, input_paths=ceil_4.a)
ma_4 = MassAddition(Input=trim_helper_19)  # -> Result, PartialResults
ins_4 = InsertItems(List=ma_4.PartialResults, Item=number_slider_3, Indices=number_slider_3, Wrap=True)
trim_helper_20 = TrimHelper(output_paths=ins_4, input_paths=ma_4.PartialResults)
amp_11 = Amplitude(Vector=vec_3, Amplitude=ma_4.PartialResults)
amp_12 = Amplitude(Vector=rev_4, Amplitude=trim_helper_20)
move_11 = Move(Geometry=group_3, Motion=amp_11)  # -> Geometry, Transform
move_12 = Move(Geometry=group_3, Motion=amp_12)  # -> Geometry, Transform
merge_8 = Merge(Data1=move_11.Geometry, Data2=move_12.Geometry)
ungroup_3 = Ungroup(Group=merge_8)
trim_helper_21 = TrimHelper(output_paths=ungroup_3, input_paths=move_12.Geometry)
python_10 = GhPythonScript(x_increment=module_width, y_increment=module_height)  # -> out, a; same code as python_6
group_4 = Group(Objects=trim_helper_21)
amp_13 = Amplitude(Vector=diagonal_transform_2, Amplitude=python_10.a)
move_13 = Move(Geometry=group_4, Motion=amp_13)  # -> Geometry, Transform
ungroup_4 = Ungroup(Group=move_13.Geometry)
trim_helper_22 = TrimHelper(output_paths=ungroup_4, input_paths=move_13.Geometry)

# ---- group: Trim Module
simplify = SimplifyTree(Tree=item_14, Front=False)  # disabled
analysis_normals = Vector(rev_6)
trim_helper_23 = TrimHelper(output_paths=trim_helper_22, input_paths=simplify)  # disabled
number_slider_13 = Slider(0, range=0..1)  # disabled
brep_4 = Brep(item_14)
edges = BrepEdges(Brep=brep_4)  # -> Naked, Interior, NonManifold
trim_helper_24 = TrimHelper(output_paths=edges.Naked, input_paths=brep_4)
normal = Vector(analysis_normals)

# ---- group: Pull last branch index forward and reassign to keep surfaces in correct position in case not all were selected.
dpath = DeconstructPath()  # disabled
item_15 = ListItem(List=dpath, Index=-1, Wrap=True)  # -> simplify(Item); disabled
lng_4 = ListLength(List=trim_helper_23)  # disabled
repeat_7 = RepeatData(Data=item_15, Length=lng_4)  # disabled
assign_paths_3 = AssignPaths(InputData=flatten(trim_helper_23), PathsToAssign=flatten(repeat_7))  # disabled

# ---- group: Trim Module / Check in Others
join_3 = JoinCurves(Curves=trim_helper_24, Preserve=False)
trim_helper_25 = TrimHelper(output_paths=join_3, input_paths=trim_helper_24)
null = NullItem(Item=trim_helper_25)  # -> NullFlags, InvalidFlags, Description
dispatch_11 = Dispatch(List=trim_helper_25, DispatchPattern=null.InvalidFlags)  # -> ListA, ListB
crv = Curve(dispatch_11.ListB)

# ----
amp_14 = Amplitude(Vector=normal, Amplitude=0.1)
rev_7 = Reverse(Vector=normal)

# ---- group: Trim Module (continued)
path_mapper = PathMapper(assign_paths_3, source="{x}", target="{9999;0;x}")  # disabled
pd_6 = PathDescription(Data=path_mapper)  # disabled
python_11 = GhPythonScript(og_path=pd_6, new_index=building_number, replace_idx=number_slider_13)  # -> out, new_path; inputs replace_idx: Int32; disabled
# ---------- python_11: Python ----------
__author__ = "jmccarty"

import rhinoscriptsyntax as rs

og_path = og_path.replace("{","").replace("}","")
path_list = og_path.split(";")
path_list[replace_idx] = new_index

new_path = ";".join(path_list)

new_path = str("{" + new_path +"}")
# ---------- end python_11 ----------
assign_paths_4 = AssignPaths(InputData=flatten(path_mapper), PathsToAssign=flatten(python_11.new_path))  # disabled
generic_panels = Surface(assign_paths_4)  # disabled
srfsplit = SurfaceSplit(Surface=trim_helper_22, Curves=crv)
area_7 = Area(Geometry=srfsplit)  # -> Area, Centroid
srf_cp = SurfaceClosestPoint(Point=area_7.Centroid, Surface=srfsplit)  # -> Point, UVPoint, Distance
trim_helper_26 = TrimHelper(output_paths=srf_cp.Point, input_paths=brep_4)
trim_helper_27 = TrimHelper(output_paths=srfsplit, input_paths=brep_4)

# ----
move_14 = Move(Geometry=trim_helper_26, Motion=amp_14)  # -> Geometry, Transform
meshray_2 = MeshRay(Mesh=brep_4, Point=move_14.Geometry, Direction=rev_7)  # -> Point, Hit

# ---- group: Trim Module (continued)
dispatch_12 = Dispatch(List=trim_helper_27, DispatchPattern=meshray_2.Hit)  # -> ListA, ListB

# ----
branch_16 = TreeBranch(Tree=dispatch_12.ListA, Path=path_3, MaintainPaths=True)
srf_3 = Surface(branch_16)

# ---- group: inputs
module_faces = Surface(dispatch_12.ListA)
cell_height = Number(num)
cell_width = Number(num_5)
analysis_normal = Vector(rev_6)
analysis_plane = Plane(plane)
minimum_cell_per_module = Number(num_8)
multiplication_6 = Multiplication(A=cell_width, B=cell_height)

# ---- group: Verify Normals
area_8 = Area(Geometry=module_faces)  # -> Area, Centroid
evalsrf_5 = EvaluateSurface(Surface=module_faces, Point=area_8.Centroid)  # -> Point, Normal, UDirection, VDirection, Frame
lng_5 = ListLength(List=evalsrf_5.Normal)
repeat_8 = RepeatData(Data=analysis_normal, Length=lng_5)
trim_helper_28 = TrimHelper(output_paths=repeat_8, input_paths=evalsrf_5.Normal)
flip_2 = Flip(Surface=module_faces)  # -> Surface, Result
equals_4 = Equality(FirstNumber=evalsrf_5.Normal, SecondNumber=trim_helper_28)  # -> Equality, Inequality
dispatch_13 = Dispatch(List=module_faces, DispatchPattern=equals_4.Equality)  # -> ListA, ListB
dispatch_14 = Dispatch(List=flip_2.Surface, DispatchPattern=equals_4.Equality)  # -> ListA, ListB
merge_9 = Merge(Data1=dispatch_13.ListA, Data2=dispatch_14.ListB)

# ---- group: Test for 4 sides
edges_2 = BrepEdges(Brep=merge_9)  # -> Naked, Interior, NonManifold
lng_6 = ListLength(List=edges_2.Naked)
module_is_regular = GhPythonScript(edge_count=lng_6)  # -> out, answer
# ---------- module_is_regular: Python ----------
__author__ = "jmccarty"

import rhinoscriptsyntax as rs

if 3 <= edge_count <= 4:
    answer=True
else:
    answer=False
# ---------- end module_is_regular ----------
trim_helper_29 = TrimHelper(output_paths=module_is_regular.answer, input_paths=merge_9)
dispatch_15 = Dispatch(List=merge_9, DispatchPattern=trim_helper_29)  # -> ListA, ListB

# ---- group: May be red, thats ok. Null testing follows
crv_2 = Curve(dispatch_15.ListB)

# ----
# TODO: Improve this script to minimize partitioning. Likely have to make all iterations of panel combinations and test for the largest and those that only have 4 side.
srf_4 = Surface(crv_2)
null_2 = NullItem(Item=srf_4)  # -> NullFlags, InvalidFlags, Description
dispatch_16 = Dispatch(List=srf_4, DispatchPattern=null_2.NullFlags)  # -> ListA, ListB
clean_6 = CleanTree(RemoveNulls=True, RemoveInvalid=True, RemoveEmpty=Toggle(True), Tree=dispatch_16.ListB)
srf_5 = Surface(clean_6)
explode = Explode(Curve=clean_6, Recursive=True)  # -> Segments, Vertices
graft = GraftTree(Tree=srf_5, IncludeEmptyLists=True, IncludeNullItems=True)
end_5 = EndPoints(Curve=explode.Segments)  # -> Start, End
pd_7 = PathDescription(Data=graft)
lng_7 = ListLength(List=graft)
cset_3 = CreateSet(List=[end_5.Start, end_5.End])  # -> Set, Map
vec_5 = Vector(analysis_normal)
end_6 = EndPoints(Curve=explode.Segments)  # -> Start, End
repeat_9 = RepeatData(Data=analysis_plane, Length=lng_7)
number_slider_14 = Slider(100, range=0..100)
trim_helper_30 = TrimHelper(output_paths=repeat_9, input_paths=analysis_plane)
ext = ExtendCurve(Curve=explode.Segments, Type=0, Start=number_slider_14, End=number_slider_14)
assign_paths_5 = AssignPaths(InputData=flatten(trim_helper_30), PathsToAssign=flatten(pd_7))
pd_8 = PathDescription(Data=ext)
trim_helper_31 = TrimHelper(output_paths=ext, input_paths=vec_5)
lng_8 = ListLength(List=trim_helper_31)
pd_9 = PathDescription(Data=trim_helper_31)
item_16 = ListItem(List=pd_9, Index=0, Wrap=True)
branch_17 = TreeBranch(Tree=vec_5, Path=item_16, MaintainPaths=True)
repeat_10 = RepeatData(Data=branch_17, Length=lng_8)
assign_paths_6 = AssignPaths(InputData=flatten(repeat_10), PathsToAssign=flatten(pd_8))
item_17 = ListItem(List=assign_paths_6, Index=0, Wrap=True)
line_5 = LineSDL(Start=end_6.Start, Direction=item_17, Length=number_slider_14)
rotax = RotateAxis(Geometry=ext, Angle=degrees(Slider(90, range=0..100)), Axis=line_5)  # -> Geometry, Transform
merge_10 = Merge(Data1=ext, Data2=rotax.Geometry)
trim_4 = TrimWithRegion(Curve=merge_10, Region=graft, Plane=assign_paths_5)  # -> Inside, Outside
trim_helper_32 = TrimHelper(output_paths=trim_4.Inside, input_paths=ext)
end_7 = EndPoints(Curve=trim_helper_32)  # -> Start, End
merge_11 = Merge(Data1=end_7.Start, Data2=end_7.End)
cset_4 = CreateSet(List=merge_11)  # -> Set, Map
intersection = SetIntersection(SetA=cset_3.Set, SetB=cset_4.Set)
null_3 = NullItem(Item=intersection)  # -> NullFlags, InvalidFlags, Description
dispatch_17 = Dispatch(List=trim_helper_32, DispatchPattern=invert(null_3.NullFlags))  # -> ListA, ListB
srfsplit_2 = SurfaceSplit(Surface=graft, Curves=trim_helper_32)
trim_helper_33 = TrimHelper(output_paths=srfsplit_2, input_paths=graft)

area_9 = Area(Geometry=trim_helper_33)  # -> Area, Centroid
bnd = Bounds(Numbers=area_9.Area)
dedomain = DeconstructDomain(Domain=bnd)  # -> Start, End
gradient = Gradient(
    LowerLimit=dedomain.Start,
    UpperLimit=dedomain.End,
    Parameter=area_9.Area,
    stops=[0: RGB(48, 18, 59), 0.0312: RGB(57, 41, 114), 0.0625: RGB(64, 64, 161), 0.0938: RGB(68, 86, 199), 0.125: RGB(70, 107, 227), 0.156: RGB(70, 127, 246)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])
preview = CustomPreview(Geometry=trim_helper_33, Shader=gradient)

# ---- group: Final Culling of non regaulr modules
edges_3 = BrepEdges(Brep=trim_helper_33)  # -> Naked, Interior, NonManifold
lng_9 = ListLength(List=edges_3.Naked)
module_is_regular_2 = GhPythonScript(edge_count=lng_9)  # -> out, answer; same code as module_is_regular
trim_helper_34 = TrimHelper(output_paths=module_is_regular_2.answer, input_paths=trim_helper_33)

# ----
equals_5 = Equality(FirstNumber=lng_9, SecondNumber=4)  # -> Equality, Inequality
trim_helper_35 = TrimHelper(output_paths=equals_5.Equality, input_paths=trim_helper_33)

# ---- group: This exlcudes triangles
dispatch_18 = Dispatch(List=trim_helper_33, DispatchPattern=trim_helper_35)  # -> ListA, ListB
dispatch_19 = Dispatch(List=trim_helper_33, DispatchPattern=trim_helper_34)  # -> ListA, ListB

# ---- group: These are the modules with very tiny cuts
dispatch_20 = Dispatch(List=dispatch_15.ListB, DispatchPattern=null_2.NullFlags)  # -> ListA, ListB
brec_3 = BoundingRectangle(Geometry=dispatch_20.ListA, Plane=analysis_plane, Axis=0, Slide=0, Union=Toggle(False))  # -> Bounding, DimensionX, DimensionY
trim_helper_36 = TrimHelper(output_paths=brec_3.Bounding, input_paths=dispatch_20.ListA)
preview_2 = CustomPreview(Geometry=trim_helper_36, Shader=ColourSwatch(SwatchColor=RGB(0, 0, 0)))

# ---- group: Clean up extras and take first
brep_5 = Brep(dispatch_19.ListB)
clean_7 = CleanTree(RemoveNulls=True, RemoveInvalid=True, RemoveEmpty=True, Tree=brep_5)
item_18 = ListItem(List=clean_7, Index=0, Wrap=True)

# ---- group: Join Extra Pieces if Possible / Sort Area, Take largest 2, Join, Take 1st
area_10 = Area(Geometry=dispatch_18.ListA)  # -> Area, Centroid
sort_8 = SortList(Keys=area_10.Area, ValuesA=dispatch_18.ListA)  # -> Keys, reverse(ValuesA)

# ---- group: Join Extra Pieces if Possible
toggle_2 = BooleanToggle(False)

# ---- group: Join Extra Pieces if Possible / Sort Area, Take largest 2, Join, Take 1st (continued)
item_19 = ListItem(List=sort_8.ValuesA, Index=[0, 1], Wrap=toggle_2)
join_4 = BrepJoin(Breps=item_19)  # -> Breps, Closed
item_20 = ListItem(List=join_4.Breps, Index=0, Wrap=True)

# ---- group: Join Extra Pieces if Possible (continued)
fmerge = MergeFaces(Brep=item_20)  # -> Breps, Before, After
edges_4 = BrepEdges(Brep=fmerge.Breps)  # -> Naked, Interior, NonManifold
trim_helper_37 = TrimHelper(output_paths=edges_4.Naked, input_paths=fmerge.Breps)
lng_10 = ListLength(List=trim_helper_37)
larger_2 = LargerThan(FirstNumber=lng_10, SecondNumber=Slider(4, range=0..10))  # -> LargerThan, OrEqualTo
dispatch_21 = Dispatch(List=fmerge.Breps, DispatchPattern=larger_2.LargerThan)  # -> ListA, ListB
pd_10 = PathDescription(Data=dispatch_21.ListA)  # -> flatten(Paths)

# ---- group: Join Extra Pieces if Possible / If more than 4 sides to joined brep split those branches out and grab single elements
branch_18 = TreeBranch(Tree=dispatch_18.ListA, Path=pd_10, MaintainPaths=True)

# ---- group: Join Extra Pieces if Possible / rejoined modules
srf_6 = Surface(dispatch_21.ListB)

# ---- group: Join Extra Pieces if Possible (continued)
srf_7 = Surface(branch_18)

# ----
merge_12 = Merge(Data1=srf_7, Data2=srf_6, Data3=item_18, Data4=brec_3.Bounding)  # -> graft(Result)
clean_8 = CleanTree(RemoveNulls=True, RemoveInvalid=True, RemoveEmpty=True, Tree=merge_12)

# ---- group: Final Check, if area of boudning rectangle is only so much bigger than original geomentry then use the bounding rectangle
analysis_plane_2 = Plane(plane)
trim_helper_38 = TrimHelper(output_paths=merge_12, input_paths=analysis_plane_2)
pd_11 = PathDescription(Data=clean_8)
area_11 = Area(Geometry=clean_8)  # -> Area, Centroid

# ----
clean_9 = CleanTree(RemoveNulls=True, RemoveInvalid=True, RemoveEmpty=True, Tree=trim_helper_38)

# ---- group: Final Check, if area of boudning rectangle is only so much bigger than original geomentry then use the bounding rectangle (continued)
pd_12 = PathDescription(Data=clean_9)
item_21 = ListItem(List=pd_12, Index=0, Wrap=True)
branch_19 = TreeBranch(Tree=analysis_plane_2, Path=item_21, MaintainPaths=True)
lng_11 = ListLength(List=clean_9)
repeat_11 = RepeatData(Data=branch_19, Length=lng_11)
assign_paths_7 = AssignPaths(InputData=flatten(repeat_11), PathsToAssign=flatten(pd_11))
brec_4 = BoundingRectangle(Geometry=clean_8, Plane=assign_paths_7, Axis=0, Slide=0, Union=Toggle(False))  # -> Bounding, DimensionX, DimensionY

# ----
rec_3 = Rectangle(brec_4.Bounding)

# ---- group: Final Check, if area of boudning rectangle is only so much bigger than original geomentry then use the bounding rectangle (continued)
trim_helper_39 = TrimHelper(output_paths=rec_3, input_paths=clean_8)
area_12 = Area(Geometry=trim_helper_39)  # -> Area, Centroid
subtraction_2 = Subtraction(A=area_12.Area, B=area_11.Area)
smaller_4 = SmallerThan(FirstNumber=subtraction_2, SecondNumber=Slider(0.006, range=0..1))  # -> SmallerThan, OrEqualTo
dispatch_22 = Dispatch(List=trim_helper_39, DispatchPattern=smaller_4.SmallerThan)  # -> ListA, ListB
brep_6 = Brep(dispatch_22.ListA)
trim_helper_40 = TrimHelper(output_paths=brep_6, input_paths=dispatch_15.ListA)

# ---- group: Merge Original and Cuts
fixed_regions = Surface(trim_helper_40)
area_13 = Area(Geometry=dispatch_15.ListA)  # -> Area, Centroid
area_14 = Area(Geometry=fixed_regions)  # -> Area, Centroid
is_face_large_enough = GhPythonScript(face_area=area_13.Area, min_cell_count=minimum_cell_per_module, cell_area=multiplication_6)  # -> out, answer
# ---------- is_face_large_enough: Python ----------
__author__ = "jmccarty"

import rhinoscriptsyntax as rs

min_area = cell_area * min_cell_count

if face_area < min_area:
    answer = False
else:
    answer = True
# ---------- end is_face_large_enough ----------
is_face_large_enough_2 = GhPythonScript(face_area=area_14.Area, min_cell_count=minimum_cell_per_module, cell_area=multiplication_6)  # -> out, answer; same code as is_face_large_enough
dispatch_23 = Dispatch(List=dispatch_15.ListA, DispatchPattern=is_face_large_enough.answer)  # -> ListA, ListB
dispatch_24 = Dispatch(List=fixed_regions, DispatchPattern=is_face_large_enough_2.answer)  # -> ListA, ListB
merge_13 = Merge(Data1=dispatch_24.ListA, Data2=dispatch_23.ListA)
area_15 = Area(Geometry=merge_13)  # -> Area, Centroid
is_face_large_enough_3 = GhPythonScript(face_area=area_15.Area, min_cell_count=minimum_cell_per_module, cell_area=multiplication_6)  # -> out, answer; same code as is_face_large_enough
dispatch_25 = Dispatch(List=merge_13, DispatchPattern=is_face_large_enough_3.answer)  # -> ListA, ListB

# ---- group: Last, No Triangle Checkl
debrep_2 = DeconstructBrep(Brep=dispatch_25.ListA)  # -> Faces, Edges, Vertices
lng_12 = ListLength(List=debrep_2.Edges)
equals_6 = Equality(FirstNumber=lng_12, SecondNumber=4)  # -> Equality, Inequality
trim_helper_41 = TrimHelper(output_paths=equals_6.Equality, input_paths=dispatch_25.ListA)
dispatch_26 = Dispatch(List=dispatch_25.ListA, DispatchPattern=trim_helper_41)  # -> ListA, ListB
brep_7 = Brep(dispatch_26.ListA)

# ----
clean_10 = CleanTree(RemoveNulls=True, RemoveInvalid=True, RemoveEmpty=True, Tree=brep_7)
item_22 = ListItem(List=clean_10, Index=0, Wrap=True)
pd_13 = PathDescription(Data=item_22)

# ---- group: Sometimes surfaces get tossed out for not having modules. Need to consider this with the planes too
pln_2 = Plane(plane)  # disabled

# ---- group: String Organisation / Reorder Modules Y,X
number_slider_15 = Slider(0.25, range=0..1)  # disabled
number_slider_16 = Slider(1000, range=0..1000)  # disabled
series = Series(Start=0, Step=number_slider_15, Count=number_slider_16)  # disabled

# ---- group: Check again to remove irregular modules
analysis_plane_3 = Plane(plane)
graft_2 = GraftTree(Tree=clean_10, IncludeEmptyLists=True, IncludeNullItems=True)
pd_14 = PathDescription(Data=graft_2)
area_16 = Area(Geometry=graft_2)  # -> Area, Centroid

# ----
branch_20 = TreeBranch(Tree=analysis_plane_3, Path=pd_13, MaintainPaths=True)

# ---- group: Check again to remove irregular modules (continued)
trim_helper_42 = TrimHelper(output_paths=graft_2, input_paths=branch_20)
pd_15 = PathDescription(Data=trim_helper_42)
item_23 = ListItem(List=pd_15, Index=0, Wrap=True)
lng_13 = ListLength(List=trim_helper_42)
branch_21 = TreeBranch(Tree=branch_20, Path=item_23, MaintainPaths=True)
repeat_12 = RepeatData(Data=branch_21, Length=lng_13)
assign_paths_8 = AssignPaths(InputData=flatten(repeat_12), PathsToAssign=flatten(pd_14))
brec_5 = BoundingRectangle(Geometry=graft_2, Plane=assign_paths_8, Axis=0, Slide=0, Union=Toggle(False))  # -> Bounding, DimensionX, DimensionY
trim_helper_43 = TrimHelper(output_paths=brec_5.Bounding, input_paths=graft_2)
area_17 = Area(Geometry=trim_helper_43)  # -> Area, Centroid
subtraction_3 = Subtraction(A=area_17.Area, B=area_16.Area)
smaller_5 = SmallerThan(FirstNumber=subtraction_3, SecondNumber=number_slider_6)  # -> SmallerThan, OrEqualTo
dispatch_27 = Dispatch(List=trim_helper_43, DispatchPattern=smaller_5.SmallerThan)  # -> ListA, ListB
brep_8 = Brep(dispatch_27.ListA)
trim_helper_44 = TrimHelper(output_paths=brep_8, input_paths=dispatch_15.ListA)

# ---- group: All Modules
clean_11 = CleanTree(RemoveNulls=True, RemoveInvalid=True, RemoveEmpty=True, Tree=trim_helper_44)

# ----
lng_14 = ListLength(List=clean_11)
pd_16 = PathDescription(Data=lng_14)
brep_9 = Brep(clean_11)
pt_5 = Point(python_gate_3.out_object)
graft_3 = GraftTree(Tree=brep_9, IncludeEmptyLists=True, IncludeNullItems=True)
lng_15 = ListLength(List=brep_9)
branch_22 = TreeBranch(Tree=pt_5, Path=pd_16, MaintainPaths=True)
debrep_3 = DeconstructBrep(Brep=graft_3)  # -> Faces, Edges, Vertices
repeat_13 = RepeatData(Data=branch_22, Length=lng_15)
trim_helper_45 = TrimHelper(output_paths=debrep_3.Vertices, input_paths=graft_3)
trim_helper_46 = TrimHelper(output_paths=repeat_13, input_paths=branch_22)  # -> graft(data)
ln_3 = Line(StartPoint=trim_helper_45, EndPoint=trim_helper_46)
len_3 = Length(Curve=ln_3)
sort_9 = SortList(Keys=len_3, ValuesA=trim_helper_45)  # -> Keys, ValuesA
item_24 = ListItem(List=sort_9.ValuesA, Index=0, Wrap=True)
branch_23 = TreeBranch(Tree=plane, Path=pd_16, MaintainPaths=True)
trim_helper_47 = TrimHelper(output_paths=item_24, input_paths=plane)
pl_origin = PlaneOrigin(Base=branch_23, Origin=trim_helper_47)
deplane_7 = DeconstructPlane(Plane=pl_origin)  # -> Origin, graft(XAxis), graft(YAxis), ZAxis

# ---- group: String Organisation Distrubution
module_outer_curve = Curve(graft_3)
cell_height_2 = Number(num)
cell_width_2 = Number(num_5)
module_planes = Plane(pl_origin)

# ----
module_planes_2 = Plane(module_planes)  # disabled

# ---- group: Sometimes surfaces get tossed out for not having modules. Need to consider this with the planes too (continued)
crv_3 = Curve(module_outer_curve)  # disabled
trim_helper_48 = TrimHelper(output_paths=crv_3, input_paths=pln_2)  # disabled
item_25 = ListItem(List=trim_helper_48, Index=0, Wrap=True)  # disabled
pd_17 = PathDescription(Data=item_25)  # disabled
branch_24 = TreeBranch(Tree=pln_2, Path=pd_17, MaintainPaths=True)  # disabled

# ----
trim_helper_49 = TrimHelper(output_paths=module_planes_2, input_paths=branch_24)  # disabled
pd_18 = PathDescription(Data=module_outer_curve)

# ---- group: Pass area used data to end
windowless_surfaces = Surface(item_14)
trim_helper_50 = TrimHelper(output_paths=module_outer_curve, input_paths=windowless_surfaces)
pd_19 = PathDescription(Data=trim_helper_50)
area_18 = Area(Geometry=trim_helper_50)  # -> Area, Centroid
item_26 = ListItem(List=pd_19, Index=0, Wrap=True)
ma_5 = MassAddition(Input=area_18.Area)  # -> Result, PartialResults
branch_25 = TreeBranch(Tree=windowless_surfaces, Path=item_26, MaintainPaths=True)

# ----
assign_paths_9 = AssignPaths(InputData=flatten(module_planes), PathsToAssign=flatten(pd_18))

# ---- group: Enable Cell Creation
python_gate_4 = GhPythonScript(object_to_pass=module_outer_curve, pass_object=enable_cell_creation)  # -> out, out_object; same code as python_gate
python_gate_5 = GhPythonScript(object_to_pass=assign_paths_9, pass_object=enable_cell_creation)  # -> out, out_object; same code as python_gate

# ----
deplane_8 = DeconstructPlane(Plane=python_gate_5.out_object)  # -> Origin, XAxis, YAxis, ZAxis

# ---- group: Cell Create Distrubution
module_outer_curve_2 = Curve(python_gate_4.out_object)
cell_row_spacing_2 = Number(cell_row_spacing)
cell_width_3 = Number(cell_width_2)
n_cells_rows = Number(num_7)
module_plane = Plane(python_gate_5.out_object)
module_origin_point = Point(deplane_8.Origin)
module_plane_x_vec = Vector(deplane_8.XAxis)
n_cells_columns = Number(num_4)
module_plane_y_vec = Vector(deplane_8.YAxis)
cell_height_3 = Number(cell_height_2)
module_plane_z_vec = Vector(deplane_8.ZAxis)
trim_helper_51 = TrimHelper(output_paths=module_plane, input_paths=module_outer_curve_2)
item_27 = ListItem(List=module_origin_point, Index=0, Wrap=True)

# ---- group: Cell Builder / Inner Offset Module for frame thickness
neg = Negative(Value=frame_thickness)
offset = OffsetCurve(Curve=module_outer_curve_2, Distance=neg, Plane=trim_helper_51, Corners=1)
trim_helper_52 = TrimHelper(output_paths=offset, input_paths=module_outer_curve_2)

# ---- group: Cellulate MOdules
number_slider_17 = Slider(1, range=1..2)
division_9 = Division(A=cell_height_3, B=number_slider_17)
division_10 = Division(A=cell_width_3, B=number_slider_17)
number_slider_18 = Slider(1, range=0..1)
multiplication_7 = Multiplication(A=num_2, B=number_slider_18)
multiplication_8 = Multiplication(A=num_6, B=number_slider_18)
division_11 = Division(A=multiplication_8, B=division_10)
addition_9 = Addition(A=division_11, B=1)
division_12 = Division(A=multiplication_7, B=division_9)
ceil_5 = GhPythonScript(x=addition_9)  # -> out, a; same code as ceil
addition_10 = Addition(A=division_12, B=1)
repeat_14 = RepeatData(Data=division_10, Length=ceil_5.a)
trim_helper_53 = TrimHelper(output_paths=repeat_14, input_paths=ceil_5.a)
ma_6 = MassAddition(Input=trim_helper_53)  # -> Result, PartialResults
number_slider_19 = Slider(0, range=0..100)
ins_5 = InsertItems(List=ma_6.PartialResults, Item=number_slider_19, Indices=number_slider_19, Wrap=True)
trim_helper_54 = TrimHelper(output_paths=ins_5, input_paths=ma_6.PartialResults)
rev_8 = Reverse(Vector=module_plane_x_vec)
amp_15 = Amplitude(Vector=rev_8, Amplitude=ins_5)
amp_16 = Amplitude(Vector=module_plane_x_vec, Amplitude=trim_helper_54)
move_15 = Move(Geometry=item_27, Motion=amp_16)  # -> Geometry, Transform
move_16 = Move(Geometry=item_27, Motion=amp_15)  # -> Geometry, Transform
ceil_6 = GhPythonScript(x=addition_10)  # -> out, a; same code as ceil
repeat_15 = RepeatData(Data=division_9, Length=ceil_6.a)
group_5 = Group(Objects=[move_15.Geometry, move_16.Geometry])
trim_helper_55 = TrimHelper(output_paths=repeat_15, input_paths=ceil_6.a)
ma_7 = MassAddition(Input=trim_helper_55)  # -> Result, PartialResults
number_slider_20 = Slider(0, range=0..100)
ins_6 = InsertItems(List=ma_7.PartialResults, Item=number_slider_20, Indices=number_slider_20, Wrap=True)
trim_helper_56 = TrimHelper(output_paths=ins_6, input_paths=ma_7.PartialResults)
rev_9 = Reverse(Vector=module_plane_y_vec)
amp_17 = Amplitude(Vector=rev_9, Amplitude=ins_6)
amp_18 = Amplitude(Vector=module_plane_y_vec, Amplitude=trim_helper_56)
move_17 = Move(Geometry=group_5, Motion=amp_17)  # -> Geometry, Transform
move_18 = Move(Geometry=group_5, Motion=amp_18)  # -> Geometry, Transform
merge_14 = Merge(Data1=move_17.Geometry, Data2=move_18.Geometry)
ungroup_5 = Ungroup(Group=merge_14)
trim_helper_57 = TrimHelper(output_paths=ungroup_5, input_paths=move_18.Geometry)
diagonal_transform_3 = DiagonalTransform(origin_point=item_27, y_vector=module_plane_y_vec, x_vector=module_plane_x_vec)
python_12 = GhPythonScript(x_increment=division_10, y_increment=division_9)  # -> out, a; same code as python_6
group_6 = Group(Objects=trim_helper_57)
amp_19 = Amplitude(Vector=diagonal_transform_3, Amplitude=python_12.a)
move_19 = Move(Geometry=group_6, Motion=amp_19)  # -> Geometry, Transform
python_13 = GhPythonScript(x_increment=frame_thickness, y_increment=frame_thickness)  # -> out, a; same code as python_6
amp_20 = Amplitude(Vector=diagonal_transform_3, Amplitude=python_13.a)
move_20 = Move(Geometry=move_19.Geometry, Motion=amp_20)  # -> Geometry, Transform
ungroup_6 = Ungroup(Group=move_20.Geometry)
trim_helper_58 = TrimHelper(output_paths=ungroup_6, input_paths=move_20.Geometry)
amp_21 = Amplitude(Vector=module_plane_z_vec, Amplitude=Slider(0.01, range=0..0.01))
move_21 = Move(Geometry=trim_helper_58, Motion=amp_21)  # -> Geometry, Transform
rev_10 = Reverse(Vector=module_plane_z_vec)
meshray_3 = MeshRay(Mesh=trim_helper_52, Point=move_21.Geometry, Direction=rev_10)  # -> Point, Hit
dispatch_28 = Dispatch(List=trim_helper_58, DispatchPattern=meshray_3.Hit)  # -> ListA, ListB
final_cell_centers = Point(dispatch_28.ListA)
cullpt_2 = CullDuplicates(Points=final_cell_centers, Tolerance=0.1, CullMode=3)  # -> Points, Indices, Valence
clean_12 = CleanTree(RemoveNulls=True, RemoveInvalid=True, RemoveEmpty=True, Tree=cullpt_2.Points)

# ---- group: Check cell count and rowxcolumn
trim_helper_59 = TrimHelper(output_paths=clean_12, input_paths=module_plane)

# ---- group: Check cell count and rowxcolumn / Test if cell distribution is recentangular
plcoord = PlaneCoordinates(Point=trim_helper_59, System=module_plane)  # -> XCoordinate, YCoordinate, ZCoordinate
cset_5 = CreateSet(List=plcoord.YCoordinate)  # -> Set, Map
cset_6 = CreateSet(List=plcoord.XCoordinate)  # -> Set, Map
lng_16 = ListLength(List=cset_5.Set)
lng_17 = ListLength(List=cset_6.Set)
multiplication_9 = Multiplication(A=lng_17, B=lng_16)
int = Integer(multiplication_9)
lng_18 = ListLength(List=clean_12)
trim_helper_60 = TrimHelper(output_paths=lng_18, input_paths=int)
trim_helper_61 = TrimHelper(output_paths=clean_12, input_paths=int)
equals_7 = Equality(FirstNumber=int, SecondNumber=trim_helper_60)  # -> Equality, Inequality
dispatch_29 = Dispatch(List=module_plane, DispatchPattern=equals_7.Equality)  # -> ListA, ListB
dispatch_30 = Dispatch(List=trim_helper_61, DispatchPattern=equals_7.Equality)  # -> ListA, ListB

# ---- group: Check cell count and rowxcolumn / Too many rows?
n_rows = Number(read_module_info.n_rows_subcell)
plcoord_2 = PlaneCoordinates(Point=dispatch_30.ListA, System=dispatch_29.ListA)  # -> XCoordinate, YCoordinate, ZCoordinate
cset_7 = CreateSet(List=plcoord_2.YCoordinate)  # -> Set, Map
lng_19 = ListLength(List=cset_7.Set)
larger_3 = LargerThan(FirstNumber=n_rows, SecondNumber=lng_19)  # -> LargerThan, OrEqualTo
dispatch_31 = Dispatch(List=dispatch_30.ListA, DispatchPattern=larger_3.LargerThan)  # -> ListA, ListB
dispatch_32 = Dispatch(List=dispatch_29.ListA, DispatchPattern=larger_3.LargerThan)  # -> ListA, ListB

# ---- group: Check cell count and rowxcolumn / Too many cols?
plcoord_3 = PlaneCoordinates(Point=dispatch_31.ListB, System=dispatch_32.ListB)  # -> XCoordinate, YCoordinate, ZCoordinate
n_cols = Number(read_module_info.n_cols_subcell)
cset_8 = CreateSet(List=plcoord_3.XCoordinate)  # -> Set, Map
lng_20 = ListLength(List=cset_8.Set)
larger_4 = LargerThan(FirstNumber=n_cols, SecondNumber=lng_20)  # -> LargerThan, OrEqualTo
dispatch_33 = Dispatch(List=dispatch_30.ListA, DispatchPattern=larger_4.LargerThan)  # -> ListA, ListB
dispatch_34 = Dispatch(List=dispatch_29.ListA, DispatchPattern=larger_4.LargerThan)  # -> ListA, ListB

# ----
module_plane_2 = Plane(dispatch_34.ListB)
cells_xyz = Point(dispatch_33.ListB)
modules = Surface(module_outer_curve_2)
deplane_9 = DeconstructPlane(Plane=module_plane_2)  # -> Origin, XAxis, YAxis, ZAxis
plcoord_4 = PlaneCoordinates(Point=cells_xyz, System=module_plane_2)  # -> XCoordinate, YCoordinate, ZCoordinate
cset_9 = CreateSet(List=plcoord_4.XCoordinate)  # -> Set, Map
cset_10 = CreateSet(List=plcoord_4.YCoordinate)  # -> Set, Map
lng_21 = ListLength(List=cset_9.Set)
area_19 = Area(Geometry=modules)  # -> Area, Centroid
lng_22 = ListLength(List=cset_10.Set)

# ---- group: Create Keys for Dict / Modules
pd_20 = PathDescription(Data=cells_xyz)

# ----
lng_23 = ListLength(List=cells_xyz)
n_diodes_rule = GhPythonScript(n_cells=lng_23)  # -> out, n_diodes
# ---------- n_diodes_rule: Python ----------
__author__ = "jmccarty"

import rhinoscriptsyntax as rs

if n_cells <= 40:
    n_diodes=1
elif (n_cells > 40) & (n_cells < 100):
    n_diodes=2
else:
    n_diodes=3
# ---------- end n_diodes_rule ----------

# ---- group: Useful Surface Area
area_20 = Area(Geometry=branch_25)  # -> Area, Centroid

# ---- group: Panelized Surface ARea
num_9 = Number(ma_5.Result)

# ---- group: String Organisation
cell_height_4 = Number(cell_height_2)  # disabled
cell_width_4 = Number(cell_width_2)  # disabled
module_outer_frame = Curve(trim_helper_48)  # disabled

# ---- group: String Organisation / Reorder Modules Y,X (continued)
area_21 = Area(Geometry=module_outer_frame)  # -> Area, Centroid; disabled
plcoord_5 = PlaneCoordinates(Point=area_21.Centroid, System=branch_24)  # -> XCoordinate, YCoordinate, ZCoordinate; disabled
roundn = RoundToNearest(NumbersX=plcoord_5.YCoordinate, NumbersY=series, RemapX=False)  # -> Nearest, Index, Difference, RemappedX; disabled

# ---- group: String Organisation (continued)
trim_helper_62 = TrimHelper(output_paths=roundn.Nearest, input_paths=plcoord_5.YCoordinate)  # disabled

# ---- group: String Organisation / Reorder Modules Y,X (continued)
sort_10 = SortList(Keys=trim_helper_62, ValuesA=module_outer_frame)  # -> Keys, ValuesA; disabled
cset_11 = CreateSet(List=sort_10.Keys)  # -> Set, Map; disabled
mindex_12 = MemberIndex(Set=sort_10.Keys, Member=cset_11.Set)  # -> Index, Count; disabled
pd_21 = PathDescription(Data=mindex_12.Index)  # -> flatten(Paths); disabled
assign_paths_10 = AssignPaths(InputData=flatten(sort_10.ValuesA), PathsToAssign=flatten(pd_21))  # disabled
area_22 = Area(Geometry=assign_paths_10)  # -> Area, Centroid; disabled

# ----
sort_11 = SortList(Keys=trim_helper_62, ValuesA=trim_helper_49)  # -> Keys, ValuesA; disabled

# ---- group: String Organisation / Add extra planes for strings
pd_22 = PathDescription(Data=area_22.Centroid)  # disabled
trim_helper_63 = TrimHelper(output_paths=area_22.Centroid, input_paths=branch_24)  # disabled
trim_helper_64 = TrimHelper(output_paths=pd_22, input_paths=branch_24)  # disabled
lng_24 = ListLength(List=trim_helper_63)  # disabled
repeat_16 = RepeatData(Data=branch_24, Length=lng_24)  # disabled
assign_paths_11 = AssignPaths(InputData=flatten(repeat_16), PathsToAssign=flatten(trim_helper_64))  # disabled
item_28 = ListItem(List=assign_paths_11, Index=0, Wrap=True)  # disabled

# ----
assign_paths_12 = AssignPaths(InputData=flatten(sort_11.ValuesA), PathsToAssign=flatten(pd_21))  # disabled

# ---- group: String Organisation (continued)
plcoord_6 = PlaneCoordinates(Point=area_22.Centroid, System=item_28)  # -> XCoordinate, YCoordinate, ZCoordinate; disabled
sort_12 = SortList(Keys=plcoord_6.XCoordinate, ValuesA=assign_paths_10)  # -> Keys, ValuesA; disabled

# ----
sort_13 = SortList(Keys=plcoord_6.XCoordinate, ValuesA=assign_paths_12)  # -> Keys, ValuesA; disabled

# ---- group: String Organisation
# Branch by Y, List Order by X
module_outer_frame_2 = Curve(sort_12.ValuesA)  # disabled

# ---- group: String Organisation / Organize Small Modules into SEries
area_23 = Area(Geometry=module_outer_frame_2)  # -> Area, Centroid; disabled
number_slider_21 = Slider(6, range=0..10)  # disabled
multiplication_10 = Multiplication(A=cell_width_4, B=cell_height_4)  # disabled
roundd = RoundToDecimalPlace(NumberX=area_23.Area, DecimalPlace=number_slider_21, RoundType=0)  # -> Rounded, Difference; disabled
python_14 = GhPythonScript(cell_area=multiplication_10, module_area=roundd.Rounded)  # -> out, number_cells; disabled
# ---------- python_14: Python ----------
__author__ = "jmccarty"

import rhinoscriptsyntax as rs
import math



number_cells = module_area / cell_area
number_cells = round(math.floor(number_cells),0)
# ---------- end python_14 ----------
number_slider_22 = Slider(1, range=0..1)  # disabled

# ---- group: String Organisation / Create unique list of sizes, then using trim and member index reorder the oroginal list by the new sizing sequence and then reassign the new levels of paths.
cset_12 = CreateSet(List=python_14.number_cells)  # -> Set, Map; disabled
mindex_13 = MemberIndex(Set=python_14.number_cells, Member=cset_12.Set)  # -> Index, Count; disabled
trim_5 = TrimTree(Tree=mindex_13.Index, Depth=1)  # disabled
pd_23 = PathDescription(Data=mindex_13.Index)  # -> flatten(Paths); disabled
item_29 = ListItem(List=module_outer_frame_2, Index=trim_5, Wrap=True)  # disabled
assign_paths_13 = AssignPaths(InputData=flatten(item_29), PathsToAssign=flatten(pd_23))  # disabled

# ----
item_30 = ListItem(List=sort_13.ValuesA, Index=trim_5, Wrap=True)  # disabled
assign_paths_14 = AssignPaths(InputData=flatten(item_30), PathsToAssign=flatten(pd_23))  # disabled

# ---- group: String Organisation / Organize Small Modules into SEries (continued)
area_24 = Area(Geometry=assign_paths_13)  # -> Area, Centroid; disabled

# ---- group: String Organisation (continued)
roundd_2 = RoundToDecimalPlace(NumberX=area_24.Area, DecimalPlace=number_slider_21, RoundType=0)  # -> Rounded, Difference; disabled

# ---- group: String Organisation / Organize Small Modules into SEries (continued)
python_15 = GhPythonScript(cell_area=multiplication_10, module_area=roundd_2.Rounded)  # -> out, number_cells; disabled; same code as python_14
lng_25 = ListLength(List=python_15.number_cells)  # disabled
panel_7 = Panel(lng_25)  # disabled
pd_24 = PathDescription(Data=lng_25)  # disabled
larger_5 = LargerThan(FirstNumber=lng_25, SecondNumber=number_slider_22)  # -> LargerThan, OrEqualTo; disabled
dispatch_35 = Dispatch(List=pd_24, DispatchPattern=larger_5.LargerThan)  # -> MultipleModules, Only1Module; disabled
branch_26 = TreeBranch(Tree=assign_paths_13, Path=dispatch_35.Only1Module, MaintainPaths=True)  # disabled
branch_27 = TreeBranch(Tree=assign_paths_13, Path=dispatch_35.MultipleModules, MaintainPaths=True)  # disabled

# ----
branch_28 = TreeBranch(Tree=assign_paths_14, Path=dispatch_35.Only1Module, MaintainPaths=True)  # disabled
branch_29 = TreeBranch(Tree=assign_paths_14, Path=dispatch_35.MultipleModules, MaintainPaths=True)  # disabled

# ---- group: String Organisation
# Take the strings with less than the minimum amount and put them into a new branch at the end of the string set
pd_25 = PathDescription(Data=branch_26)  # disabled
txt_4 = Text(pd_25)  # disabled
trim_6 = TrimTree(Tree=txt_4, Depth=1)  # disabled
python_16 = GhPythonScript(x=trim_6)  # -> out, a; disabled
# ---------- python_16: Python ----------
__author__ = "jmccarty"

import rhinoscriptsyntax as rs

a = str.split(str.split(x,";")[2],"}")[0]
# ---------- end python_16 ----------
lng_26 = ListLength(List=trim_6)  # disabled
number_slider_23 = Slider(5, range=0..10)  # disabled
item_31 = ListItem(List=python_16.a, Index=0, Wrap=True)  # disabled
repeat_17 = RepeatData(Data=item_31, Length=lng_26)  # disabled
panel_8 = Panel(trim_6)  # disabled
panel_9 = Panel(repeat_17)  # disabled

trim_helper_65 = TrimHelper(output_paths=repeat_17, input_paths=item_31)  # disabled

python_17 = GhPythonScript(original_path=trim_6, new_index=trim_helper_65, index_number=number_slider_23)  # -> out, a; inputs index_number: Int32; disabled
# ---------- python_17: Python ----------
__author__ = "jmccarty"

import rhinoscriptsyntax as rs

s = original_path


element_a = s.split(";")[0]
element_b = s.split(";")[1].strip("}")
element_c = str(new_index)


#print(element_a)
#print(element_b)
#print(element_c)

a = str(element_a) + ";" + str(element_b) + ";" + str(element_c) + "}"

print(a)
# ---------- end python_17 ----------
assign_paths_15 = AssignPaths(InputData=flatten(branch_26), PathsToAssign=flatten(python_17.a))  # disabled
panel_10 = Panel(python_17.a)  # disabled
panel_11 = Panel(assign_paths_15)  # disabled

# ----
assign_paths_16 = AssignPaths(InputData=flatten(branch_28), PathsToAssign=flatten(python_17.a))  # disabled

# ---- group: String Organisation / Parition merged trees based on original size of string (rein
lng_27 = ListLength(List=branch_27)  # disabled
lng_28 = ListLength(List=assign_paths_15)  # disabled
trim_helper_66 = TrimHelper(output_paths=lng_27, input_paths=lng_28)  # disabled
trim_helper_67 = TrimHelper(output_paths=branch_27, input_paths=lng_28)  # disabled
merge_15 = Merge(Data1=trim_helper_67, Data2=assign_paths_15)  # disabled
merge_16 = Merge(Data1=trim_helper_66, Data2=lng_28)  # disabled
partition = PartitionList(List=merge_15, Size=merge_16)  # disabled

# ----
trim_helper_68 = TrimHelper(output_paths=branch_29, input_paths=lng_28)  # disabled

# ---- group: String Organisation
panel_12 = Panel("{?;0;0;*}")  # disabled
split_7 = SplitTree(Data=partition, Masks=flatten(panel_12))  # -> Positive, Negative; disabled
number_slider_24 = Slider(2, range=0..48)  # disabled
item_32 = ListItem(List=split_7.Positive, Index=number_slider_24, Wrap=True)  # disabled
brep_10 = Brep(item_32)  # disabled
panel_13 = Panel("{?;0;41;99}")  # disabled

# ----
merge_17 = Merge(Data1=trim_helper_68, Data2=assign_paths_16)  # disabled
partition_2 = PartitionList(List=merge_17, Size=merge_16)  # disabled

# ---- group: String Organisation / Parition merged trees based on original size of string (rein / Combination of Strings
module_outer_frame_3 = Curve(partition)  # disabled

# ---- group: Create Keys for Dict
txt_5 = Text(pd_20)
trim_7 = TrimTree(Tree=cells_xyz, Depth=1)
cset_13 = CreateSet(List=txt_5)  # -> Set, Map
trim_8 = TrimTree(Tree=trim_7, Depth=1)

# ---- group: Create Keys for Dict / Modules Per String
trim_9 = TrimTree(Tree=cset_13.Set, Depth=1)

# ---- group: Create Keys for Dict / Strings
pd_26 = PathDescription(Data=trim_7)

# ---- group: Create Keys for Dict / Surfaces
pd_27 = PathDescription(Data=trim_8)

# ---- group: Create Keys for Dict (continued)
panel_14 = Panel(trim_9)
txt_6 = Text(pd_26)
cset_14 = CreateSet(List=txt_6)  # -> Set, Map
txt_7 = Text(pd_27)
cset_15 = CreateSet(List=txt_7)  # -> Set, Map

# ---- group: Create Keys for Dict / Strings Per Surface
trim_10 = TrimTree(Tree=cset_14.Set, Depth=1)

# ----
trim_helper_69 = TrimHelper(output_paths=deplane_9.ZAxis, input_paths=trim_10)
avr = Average(Input=trim_helper_69)
calc_angle_from_north_degrees = GhPythonScript(normal=avr)  # -> out, direction; inputs normal: Vector3d
# ---------- calc_angle_from_north_degrees: Python ----------
import math
a = (0,1)
b = (normal[0],normal[1])

ang1 = math.atan2(*a[::-1])
ang2 = math.atan2(*b[::-1])
direction = math.degrees((ang1 - ang2) % (2 * math.pi))
# ---------- end calc_angle_from_north_degrees ----------
devec_4 = DeconstructVector(Vector=avr)  # -> XComponent, YComponent, ZComponent
classify_angle_group = GhPythonScript(input_angle=calc_angle_from_north_degrees.direction)  # -> out, general_angle
# ---------- classify_angle_group: Python ----------
__author__ = "jmccarty"

import rhinoscriptsyntax as rs

if input_angle < 45:
    general_angle = "north"

elif 45<=input_angle<135:
    general_angle = "east"

elif 135<=input_angle<225:
    general_angle = "south"

elif 225<=input_angle<315:
    general_angle = "west"
    
else:
    general_angle = "north"
# ---------- end classify_angle_group ----------
replace_roof = GhPythonScript(general_angle=classify_angle_group.general_angle, z_normal=devec_4.ZComponent)  # -> out, updated_angle
# ---------- replace_roof: Python ----------
__author__ = "jmccarty"

import rhinoscriptsyntax as rs

if 0<z_normal<0.9:
    updated_angle = "r_"+general_angle
elif z_normal>=0.9:
    updated_angle = "flat_roof"
else:
    updated_angle = general_angle
# ---------- end replace_roof ----------

# ---- group: Create Keys for Dict / Surface per Object
trim_11 = TrimTree(Tree=cset_15.Set, Depth=1)

# ---- group: Create Keys for Dict (continued)
panel_15 = Panel(trim_10)
panel_16 = Panel(trim_11)

# ----
compile_key_dict = GhPythonScript(
    building_name=host_name_to_path.root,
    surface_keys=trim_11,
    general_surface_direction=replace_roof.updated_angle,
    strings_tree=trim_10,
    module_center_points=area_19.Centroid,
    module_normals=module_plane_z_vec,
    modules_tree=trim_9,
    n_cols_ideal=read_module_info.n_cols_ideal,
    n_cols_tree=lng_21,
    n_rows_ideal=read_module_info.n_rows_ideal,
    n_rows_tree=lng_22,
    n_diodes_tree=n_diodes_rule.n_diodes,
    cell_xyz_tree=cells_xyz,
    cell_normals_tree=module_plane_z_vec,
    n_submodules=read_module_info.n_submodule,
    module_template=item_8,
    cell_type=read_module_info.cell_type,
    front_films=merge_4,
    cec_key=read_module_info.cec_key,
    write_pickle=write_panelizer,
    pickle_out=python_4.write_path)  # -> out, object; inputs building_name: Int32, surface_keys: list, general_surface_direction: tree, strings_tree: tree, module_center_points: tree of Point3d, module_normals: tree of Vector3d, modules_tree: tree, n_cols_tree: tree, n_rows_tree: tree, n_diodes_tree: tree, cell_xyz_tree: tree of Point3d, cell_normals_tree: tree of Vector3d, front_films: list, pickle_out: list
# ---------- compile_key_dict: Python ----------
__author__ = "jmccarty"

import rhinoscriptsyntax as rs
import os
import math
import itertools
import Grasshopper.Kernel.Data.GH_Path as ghpath
import pickle
from Rhino.Geometry import Point3d, Vector3d

#----------- FUNCTIONS -----------#
def generate_object_dict(key_dict, building, n_cols_ideal, n_rows_ideal, n_cols, n_rows, n_diodes, cells_xyz, cells_normal, n_submodules, template, front_film, cell_type, cec_key, general_surface_direction, module_center_points, module_normals):
    
    base_dict = {'BUILDING':
                     {'NAME':building,
                      'DETAILS': {},
                      'YIELD': {'central_inverter': generate_empty_results_dict(target='OBJECT'),
                                'string_inverter': generate_empty_results_dict(target='OBJECT'),
                                'micro_inverter': generate_empty_results_dict(target='OBJECT')
                                },
                      "CURVES": {"Isys": {}, 
                                 "Vsys": {}
                                 },
                      "SURFACES": {}
                      }
                 }
    srf_keys = list(key_dict[building].keys())
    for srf_key in srf_keys:
        str_keys = list(key_dict[building][srf_key].keys())
        srf_branch = srf_key.replace("{","").replace("}","").split(";")
        srf_branch = [int(s) for s in srf_branch]
        srf_branch = ghpath(srf_branch[0],srf_branch[1],srf_branch[2])
        srf_dict = {srf_key: {"DETAILS": {"area_utilised":None,
                                          "surface_type":None,
                                          "radiance_surface_label":srf_key.replace("{","").replace("}","").replace(";","_"),
                                          "general_angle":general_surface_direction.Branch(srf_branch)[0]
                                          },
                              'YIELD': {
                                  'central_inverter': generate_empty_results_dict(target='SURFACE'),
                                  'string_inverter': generate_empty_results_dict(target='SURFACE'),
                                  'micro_inverter': generate_empty_results_dict(target='SURFACE'),
                              },
                              "CURVES": {"Isrf": {}, 
                                         "Vsrf": {}
                                         },
                              'RESULTSDICT': {},
                              "STRINGS": {}}}
        for str_key in str_keys:
            mod_keys = list(key_dict[building][srf_key][str_key])

            srf_dict[srf_key]["STRINGS"][str_key] = {"DETAILS": {"cec_key":cec_key,
                                                                 "module_type":template},
                                                     "MODULES": {}}
            for mod_key in mod_keys:
                mod_k = k_to_l(mod_key)
                n_col_mod = int(n_cols.Branch(mod_k[0],mod_k[1],mod_k[2],mod_k[3],mod_k[4])[0])
                n_row_mod = int(n_rows.Branch(mod_k[0],mod_k[1],mod_k[2],mod_k[3],mod_k[4])[0])
                n_diodes_mod = int(n_diodes.Branch(mod_k[0],mod_k[1],mod_k[2],mod_k[3],mod_k[4])[0])
                
                module_point = module_center_points.Branch(mod_k[0],mod_k[1],mod_k[2],mod_k[3],mod_k[4])
                mod_ctr_pt = []
                for point in module_point:
                    p = Point3d(point)
                    X = round(p.X,6)
                    Y = round(p.Y,6)
                    Z = round(p.Z,6)
                    mod_ctr_pt.append([X,Y,Z])
                mod_ctr_pt = mod_ctr_pt[0]
                
                module_normal = module_normals.Branch(mod_k[0],mod_k[1],mod_k[2],mod_k[3],mod_k[4])
                normal_list = []
                for vector in module_normal:
                    v = Vector3d(vector)
                    X = round(v.X,4)
                    Y = round(v.Y,4)
                    Z = round(v.Z,4)
                    normal_list.append([X,Y,Z])
                mod_normal = normal_list[0]
                
                # use mod_key to access each of the variables below
                # variable_data_tree.Branch(mod_key)
                # n_diodes_repeat, n_submodules, template will be isngle input
                
                cell_xyz_mod = cells_xyz.Branch(mod_k[0],mod_k[1],mod_k[2],mod_k[3],mod_k[4])
                point_list = []
                for point in cell_xyz_mod:
                    p = Point3d(point)
                    X = round(p.X,6)
                    Y = round(p.Y,6)
                    Z = round(p.Z,6)
                    point_list.append([X,Y,Z])
                
                cell_normals_mod = cells_normal.Branch(mod_k[0],mod_k[1],mod_k[2],mod_k[3],mod_k[4])
                normal_list = []
                for vector in cell_normals_mod:
                    v = Vector3d(vector)
                    X = round(v.X,4)
                    Y = round(v.Y,4)
                    Z = round(v.Z,4)
                    normal_list.append([X,Y,Z])
            
                srf_dict[srf_key]["STRINGS"][str_key]['MODULES'][mod_key] = generate_sample_module_dict(n_cols_ideal, n_rows_ideal, n_col_mod, n_row_mod, template, n_diodes_mod, n_submodules, point_list, normal_list, front_film, cell_type, cec_key, mod_ctr_pt, mod_normal)
                srf_dict[srf_key]["STRINGS"][str_key]['YIELD'] = {
                    'central_inverter': generate_empty_results_dict(target='STRING'),
                    'string_inverter': generate_empty_results_dict(target='STRING'),
                    'micro_inverter': generate_empty_results_dict(target='STRING'),
                }
                srf_dict[srf_key]["STRINGS"][str_key]["CURVES"] = {"Istr": {}, "Vstr": {}}

        base_dict['BUILDING']['SURFACES'].update(srf_dict)
    return base_dict
    
def create_key_dict(building_name, surface_keys, strings_tree, modules_tree):
    key_dict = {building_name:{}}

    for surface in surface_keys:
        srf_key = surface.replace("{","").replace("}","").split(";")
        srf_key = [int(s) for s in srf_key]
        sel = ghpath(srf_key[0],srf_key[1],srf_key[2])
        key_dict[building_name].update({str(surface):{}})
        
        for string in strings_tree.Branch(sel):
            str_key = string.replace("{","").replace("}","").split(";")
            str_key = [int(s) for s in str_key]
            sel = ghpath(str_key[0],str_key[1],str_key[2],str_key[3])
            key_dict[building_name][surface].update({str(string):{}})
            
            for module in modules_tree.Branch(sel):
                key_dict[building_name][surface][string].update({str(module):{}})
    
    return key_dict
    
def generate_sample_module_dict(n_cols_ideal, n_rows_ideal, n_cols, n_rows, template, n_diodes, n_submodules, cells_xyz, cells_normals, front_film, cell_type, cec_key, mod_ctr_pt, mod_normal):
    
    if cell_type=='cdte':
        if n_cols_ideal>n_rows_ideal:
            n_rows=n_rows_ideal
        else:
            n_cols=n_cols_ideal
        
    
    sample_module = {
        "PARAMETERS" : {},
        "DETAILS": {"module_type":template,
                    "cell_type":cell_type,
                    "cec_key":cec_key,
                    "n_cols":n_cols,
                    "n_rows":n_rows,
                    "n_cols_ideal":n_cols_ideal,
                    "n_rows_ideal":n_rows_ideal,
                    "n_diode":n_diodes,
                    "n_submodules":n_submodules,
                    "normal":mod_normal,
                    "center_pt":mod_ctr_pt},
                    
        "LAYERS": {"front_film":front_film,
                   "front_cover":"4mm solar glass",
                   "encapsulant":"EVA",
                   "solar_cell":cell_type,
                   "rear_cover":"4mm solar glass"
                   },
        "MAPS": {
            "SUBMODULES": None,
            "DIODES": None,
            "SUBCELLS": None
        },
        "CELLSXYZ": cells_xyz,
        "CELLSNORMALS": cells_normals,
        "CELLSIRRADDIRECT": None,
        "CELLSIRRADDIFFUSE": None,
        "CELLSIRRADEFF": None,
        "CELLSTEMP": None,
        "YIELD": {'initial_simulation': generate_empty_results_dict(target='MODULE'),
                  'central_inverter': generate_empty_results_dict(target='MODULE'),
                  'string_inverter': generate_empty_results_dict(target='MODULE'),
                  'micro_inverter': generate_empty_results_dict(target='MODULE'),
                  'center_point': generate_empty_results_dict(target='CENTER'),
                  'cell_point': generate_empty_results_dict(target='CELL')},
        "CURVES": {"Imod": {}, 
                   "Vmod": {}
                   }
    }
    return sample_module
    

def create_repeating_list(n_int, n_repeat):
    lst = range(0, n_int)
    return list(itertools.chain.from_iterable(itertools.repeat(x, n_repeat) for x in lst))
    

def flatten_list(lst):
    return [j for i in lst for j in i]


def generate_empty_results_dict(target):
    empty_dict = {'imp': {},
                  'vmp': {},
                  'pmp': {},
                  'irrad': {},
                  'eff': {},
                  'area': {}}

    if target == 'STRING':

        empty_dict.pop('area', None)

    elif target == 'SURFACE':

        empty_dict.pop('area', None)

    elif target == 'OBJECT':

        empty_dict.pop('imp', None)
        empty_dict.pop('vmp', None)
        empty_dict.pop('area', None)
    
    elif target == 'CENTER':
        
        empty_dict.pop('eff', None)
        empty_dict.pop('imp', None)
        empty_dict.pop('vmp', None)
    
    elif target == 'CELL':
        
        empty_dict.pop('eff', None)
        empty_dict.pop('imp', None)
        empty_dict.pop('vmp', None)
        

    return empty_dict


def k_to_l(key):
    k_l = key.replace("{","").replace("}","").split(";")
    return [int(k) for k in k_l]


#----------- MAIN -----------#

key_dict = create_key_dict(building_name, surface_keys, strings_tree, modules_tree)
for n, front_film in enumerate(front_films):
    object = generate_object_dict(key_dict, building_name, n_cols_ideal, n_rows_ideal, n_cols_tree, n_rows_tree, n_diodes_tree, cell_xyz_tree, cell_normals_tree, n_submodules, module_template, front_film, cell_type, cec_key, general_surface_direction, module_center_points, module_normals)
    if write_pickle==True:
        with open(pickle_out[n], 'wb') as fp:
            pickle.dump(object, fp, protocol=pickle.HIGHEST_PROTOCOL)
# ---------- end compile_key_dict ----------

division_13 = Division(A=num_9, B=area_20.Area)
pt_6 = Point(cells_xyz)
lng_29 = ListLength(List=pt_6)
smaller_6 = SmallerThan(FirstNumber=lng_29, SecondNumber=read_module_info.min_cell_module)  # -> SmallerThan, OrEqualTo
larger_6 = LargerThan(FirstNumber=lng_29, SecondNumber=multiplication)  # -> LargerThan, OrEqualTo
pd_28 = PathDescription(Data=lng_29)
dispatch_36 = Dispatch(List=pd_28, DispatchPattern=larger_6.LargerThan)  # -> ListA, ListB
pd_29 = PathDescription(Data=division_13)  # -> flatten(Paths)
dispatch_37 = Dispatch(List=pd_28, DispatchPattern=smaller_6.SmallerThan)  # -> ListA, ListB
larger_7 = LargerThan(FirstNumber=flatten(division_13), SecondNumber=Slider(1.05, range=0..10))  # -> LargerThan, OrEqualTo
area_utilisation = Panel(division_13)
dispatch_38 = Dispatch(List=pd_29, DispatchPattern=larger_7.LargerThan)  # -> ListA, ListB

# ---- group: Too Small
branch_30 = TreeBranch(Tree=dispatch_37.ListA, Path=dispatch_36.ListA, MaintainPaths=True)

# ---- group: Too Big
branch_31 = TreeBranch(Tree=pt_6, Path=dispatch_36.ListA, MaintainPaths=True)

# ----
panel_17 = Panel(branch_30)
panel_18 = Panel(branch_31)

# ---- group: Area Utilisation over 100%
panel_19 = Panel(dispatch_38.ListA)

# ==== cluster TrimHelper
output_paths = ClusterInput()
input_paths = ClusterInput()
pd = PathDescription(Output_paths=output_paths)  # -> flatten(Paths)
pd_2 = PathDescription(Input_paths=input_paths)  # -> flatten(Paths)
item = ListItem(List=pd_2, Index=0, Wrap=True)
item_2 = ListItem(List=pd, Index=0, Wrap=True)
trim_if_path_longer = GhPythonScript(input_path=item, output_path=item_2)  # -> out, trim_bool, trim_number
# ---------- trim_if_path_longer: Python ----------
__author__ = "jmccarty"

import rhinoscriptsyntax as rs

input_ = len(input_path.split(";"))
output_ = len(output_path.split(";"))

if input_==output_:
    trim_bool = False
    trim_number = 0
else:
    trim_bool = True
    trim_number = output_ - input_
# ---------- end trim_if_path_longer ----------
trim = TrimTree(Input_data=output_paths, Depth=trim_if_path_longer.trim_number)
data = ClusterOutput(trim)

# ==== cluster DiagonalTransform
origin_point = ClusterInput()
x_vector = ClusterInput()
y_vector = ClusterInput()

# ---- group: Diag Transform
number_slider = Slider(1, range=0..1)
amp = Amplitude(Vector=x_vector, Amplitude=number_slider)
move = Move(Geometry=origin_point, Motion=amp)  # -> Geometry, Transform
amp_2 = Amplitude(Vector=y_vector, Amplitude=number_slider)
move_2 = Move(Geometry=move.Geometry, Motion=amp_2)  # -> Geometry, Transform
vec2pt = Vector2Pt(PointA=origin_point, PointB=move_2.Geometry, Unitize=True)  # -> Vector, Length

# ----
diagonal_transform = ClusterOutput(vec2pt.Vector)
