# Grasshopper definition cactus_radiance_writer_template.gh (Grasshopper 1.0.7)
# plug-ins: Pufferfish, PTComponentLibrary, HDTTreeUtils

rad_cell_height = Number()
rad_cell_width = Number()
surface_planes = Plane()
surface_z_vector = Vector()
surface_x_vector = Vector()
surface_y_vector = Vector()
surface_points = Point()
surfaces = Surface()
building_number = Number()
windows = Surface()

# ---- group: Cut windows from surfaces
number_slider = Slider(0.05, range=0..0.1)
neg = Negative(Value=number_slider)
offsrf = OffsetSurface(Surface=windows, Distance=number_slider, BothSides=neg, CreateSolid=True)
trim_helper = TrimHelper(output_paths=offsrf, input_paths=surfaces)
bbx = BrepBrep(BrepA=surfaces, BrepB=trim_helper)  # -> Curves, Points
trim_helper_2 = TrimHelper(output_paths=bbx.Curves, input_paths=surfaces)
srfsplit = SurfaceSplit(Surface=surfaces, Curves=trim_helper_2)
trim_helper_3 = TrimHelper(output_paths=srfsplit, input_paths=surfaces)
area = Area(Geometry=trim_helper_3)  # -> Area, Centroid
sort = SortList(Keys=area.Area, ValuesA=trim_helper_3)  # -> Keys, reverse(ValuesA)
item = ListItem(List=sort.ValuesA, Index=0, Wrap=True)

# ----
brec = BoundingRectangle(Geometry=item, Plane=surface_planes, Axis=0, Slide=0, Union=True)  # -> Bounding, DimensionX, DimensionY

# ---- group: Cellulate
bbox = BoundingBox(Content=item, Plane=surface_planes)  # -> Box, Box_2
rec = Rectangle(brec.Bounding)
txt = Text(rec)
trim_helper_4 = TrimHelper(output_paths=txt, input_paths=item)
python = GhPythonScript(x=trim_helper_4)  # -> out, h, w
# ---------- python: Python ----------
__author__ = "jmccarty"

import rhinoscriptsyntax as rs



simple_dims = x.split("Rectangle (")[1].replace(")","")

w = simple_dims.split(",")[0].split("=")[-1]
h = simple_dims.split(",")[1].split("=")[-1]
# ---------- end python ----------
division = Division(A=python.h, B=rad_cell_height)
division_2 = Division(A=python.w, B=rad_cell_width)
addition = Addition(A=division, B=1)
addition_2 = Addition(A=division_2, B=1)
ptplanar = PlanarGrid(
    BasePoint=Point(0, 0, 0),
    IDir=surface_x_vector,
    JDir=surface_y_vector,
    IDistance=rad_cell_height,
    JDistance=rad_cell_width,
    INumber=addition,
    JNumber=addition_2)
ptcell = Cellulate(Grid=ptplanar)  # -> Wires, Cells, Meshes

# ----
trim_helper_5 = TrimHelper(output_paths=rec, input_paths=item)

brep = Brep(trim_helper_5)
area_2 = Area(Geometry=brep)  # -> Area, Centroid
evalsrf = EvaluateSurface(Surface=brep, Point=area_2.Centroid)  # -> Point, Normal, UDirection, VDirection, Frame
vec = VectorXYZ(XComponent=Slider(0, range=0..100), YComponent=Slider(1, range=0..1), ZComponent=Slider(0, range=0..100))  # -> Vector, Length
debrep = DeconstructBrep(Brep=brep)  # -> Faces, Edges, Vertices
trim = TrimTree(Tree=debrep.Vertices, Depth=1)
pdecon = Deconstruct(Point=trim)  # -> XComponent, YComponent, ZComponent
sort_2 = SortList(Keys=pdecon.ZComponent)  # -> Keys, ValuesA
cset = CreateSet(List=sort_2.Keys)  # -> Set, Map
item_2 = ListItem(List=cset.Set, Index=0, Wrap=True)
mindex = MemberIndex(Set=pdecon.ZComponent, Member=item_2)  # -> Index, Count
trim_2 = TrimTree(Tree=mindex.Index, Depth=1)
item_3 = ListItem(List=trim, Index=trim_2, Wrap=True)
calc_angle_from_north = GhPythonScript(north_vector=vec.Vector, vector_b=evalsrf.Normal)  # -> out, angle; inputs north_vector: Vector3d, vector_b: Vector3d
# ---------- calc_angle_from_north: Python ----------
__author__ = "jmccarty_teach"

import rhinoscriptsyntax as rs
import math


x1 = north_vector.X
x2 = vector_b.X
y1 = north_vector.Y
y2 = vector_b.Y

a = (x1,y1)
b = (x2,y2)

ang1 = math.atan2(*a[::-1])
ang2 = math.atan2(*b[::-1])

angle = math.degrees((ang1 - ang2) % (2 * math.pi))
# ---------- end calc_angle_from_north ----------
pdecon_2 = Deconstruct(Point=item_3)  # -> XComponent, YComponent, ZComponent
angle_sorter = GhPythonScript(angle=calc_angle_from_north.angle, X=pdecon_2.XComponent, Y=pdecon_2.YComponent)  # -> out, dir, key; inputs X: list, Y: list
# ---------- angle_sorter: Python ----------
__author__ = "jmccarty_teach"

import rhinoscriptsyntax as rs
if angle < 90:
    print("North, largest X")
    dir = "X"
    key = max(X)
elif 90 <= angle < 180:
    print("East, lowest Y")
    dir = "Y"
    key = min(Y)
elif 180 <= angle < 270:
    print("South, lowest X")
    dir = "X"
    key = min(X)
elif angle >= 270:
    print("West, largest Y")
    dir = "Y"
    key = max(Y)
# ---------- end angle_sorter ----------
python_2 = GhPythonScript(dir=angle_sorter.dir, key=angle_sorter.key, x_list=pdecon_2.XComponent, y_list=pdecon_2.YComponent)  # -> out, out_dir, index; inputs x_list: list, y_list: list
# ---------- python_2: Python ----------
__author__ = "jmccarty_teach"

import rhinoscriptsyntax as rs

if dir=="X":
    out_dir = "X"
    index = x_list.index(key)
else:
    out_dir = "Y"
    index = y_list.index(key)
# ---------- end python_2 ----------
item_4 = ListItem(List=item_3, Index=python_2.index, Wrap=True)

dpath = DeconstructPath()
item_5 = ListItem(List=dpath, Index=-1, Wrap=True)  # -> simplify(Item)

# ---- group: Context Trees
number_slider_2 = Slider(0.5, range=0..1)
glassmod3 = HBGlassModifier3(
    name="context_tree",
    r_trans=number_slider_2,
    g_trans=number_slider_2,
    b_trans=number_slider_2,
    refract=Slider(1.2, range=0..10))  # -> modifier; plug-in component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
face = HBFace(name="context_tree", rad_mod=glassmod3)  # -> report, faces; plug-in component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

# ----
searchmods = HBSearchMofidiers(keywords="context")  # -> modifiers; plug-in component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

# ---- group: Terrain
brep_2 = Brep()
face_2 = HBFace(geo=brep_2, name="terrain", rad_mod=searchmods)  # -> report, faces; plug-in component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

# ----
face_3 = HBFace(name="building", rad_mod=searchmods)  # -> report, faces; plug-in component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

# ---- group: Context
face_4 = HBFace(name="context", rad_mod=searchmods)  # -> report, faces; plug-in component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

# ----
clean = CleanTree(
    RemoveNulls=True,
    RemoveInvalid=True,
    RemoveEmpty=True,
    Tree=flatten([face_2.faces, face_3.faces, face_4.faces, face.faces]))
model = HBModel(faces=flatten(clean), name="hb_model")  # -> report, model; plug-in component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

# ---- group: Rebuild Trees
join = JoinCurves(Curves=ptcell.Wires, Preserve=False)
trim_helper_6 = TrimHelper(output_paths=join, input_paths=ptcell.Wires)
simplify = SimplifyTree(Tree=item, Front=False)
trim_helper_7 = TrimHelper(output_paths=trim_helper_6, input_paths=simplify)

# ----
lng = ListLength(List=trim_helper_7)
repeat = RepeatData(Data=item_5, Length=lng)
assign_paths = AssignPaths(InputData=flatten(trim_helper_7), PathsToAssign=flatten(repeat))

# ---- group: Rebuild Trees (continued)
path_mapper = PathMapper(assign_paths, source="{x}", target="{9999;0;x}")
pd = PathDescription(Data=path_mapper)
python_3 = GhPythonScript(og_path=pd, new_index=building_number, replace_idx=Slider(0, range=0..1))  # -> out, new_path; inputs replace_idx: Int32
# ---------- python_3: Python ----------
__author__ = "jmccarty"

import rhinoscriptsyntax as rs

og_path = og_path.replace("{","").replace("}","")
path_list = og_path.split(";")
path_list[replace_idx] = new_index

new_path = ";".join(path_list)

new_path = str("{" + new_path +"}")
# ---------- end python_3 ----------
assign_paths_2 = AssignPaths(InputData=flatten(path_mapper), PathsToAssign=flatten(python_3.new_path))

# ---- group: Keep it Clean
area_3 = Area(Geometry=assign_paths_2)  # -> Area, Centroid
area_4 = Area(Geometry=surfaces)  # -> Area, Centroid
item_6 = ListItem(List=area_3.Centroid, Index=0, Wrap=True)
lng_2 = ListLength(List=area_3.Centroid)
repeat_2 = RepeatData(Data=surface_z_vector, Length=lng_2)
pd_2 = PathDescription(Data=item_6)
round = Round(Number=area_4.Area)  # -> Nearest, Floor, Ceiling
trim_helper_8 = TrimHelper(output_paths=repeat_2, input_paths=surface_z_vector)
txt_2 = Text(pd_2)
naming_surfaces = GhPythonScript(surface_key=txt_2, area=round.Nearest)  # -> out, out_surface_name; inputs area: Int32
# ---------- naming_surfaces: Python ----------
__author__ = "jmccarty"

import rhinoscriptsyntax as rs

out_surface_name = "radiancesurface_"+str(surface_key)+"_"+str(area)+"sqm"
# ---------- end naming_surfaces ----------

# ----
amp = Amplitude(Vector=trim_helper_8, Amplitude=Slider(0.1, range=0..0.1))
move = Move(Geometry=area_3.Centroid, Motion=amp)  # -> Geometry, Transform

# ---- group: Are points in Building Facade
offsrf_2 = OffsetSurface(Surface=item, Distance=number_slider, BothSides=neg, CreateSolid=True)
trim_helper_9 = TrimHelper(output_paths=offsrf_2, input_paths=item)
brepinc = PointInBrep(Brep=trim_helper_9, Point=area_3.Centroid, Strict=False)

# ----
dispatch = Dispatch(List=move.Geometry, DispatchPattern=brepinc)  # -> ListA, ListB
dispatch_2 = Dispatch(List=trim_helper_8, DispatchPattern=brepinc)  # -> ListA, ListB
lng_3 = ListLength(List=dispatch.ListA)

# ---- group: Keep it Clean (continued)
naming_grids = GhPythonScript(surface_key=txt_2, n_sensors=lng_3)  # -> out, out_grid_name
# ---------- naming_grids: Python ----------
__author__ = "jmccarty"

import rhinoscriptsyntax as rs
surface_key = surface_key.replace("{","").replace("}","").replace(";","_")
out_grid_name = "radiancegrid_"+str(surface_key)+"_"+str(n_sensors)+"sensors"
# ---------- end naming_grids ----------

# ---- group: Remove Grids that are Smaller than Certain size
larger = LargerThan(FirstNumber=lng_3, SecondNumber=Slider(0, range=0..100))  # -> LargerThan, OrEqualTo
pd_3 = PathDescription(Data=lng_3)
dispatch_3 = Dispatch(List=pd_3, DispatchPattern=larger.LargerThan)  # -> ListA, ListB

# ----
branch = TreeBranch(Tree=naming_grids.out_grid_name, Path=dispatch_3.ListA, MaintainPaths=True)
branch_2 = TreeBranch(Tree=dispatch.ListA, Path=dispatch_3.ListA, MaintainPaths=True)
branch_3 = TreeBranch(Tree=dispatch_2.ListA, Path=dispatch_3.ListA, MaintainPaths=True)

# ---- group: Grid
sensorgrid = HBSensorGrid(name=branch, positions=branch_2, directions=branch_3)  # -> grid; plug-in component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

# ----
assigngridsviews = HBAssignGridsAndViews(model=model.model, grids=sensorgrid)  # -> model; plug-in component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
modeltorad = HBModelToRadFolder(model=assigngridsviews, minimal=Toggle(True))  # -> report, folder; plug-in component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

# ==== cluster TrimHelper
output_paths = ClusterInput()
input_paths = ClusterInput()
pd = PathDescription(Output_paths=output_paths)  # -> flatten(Paths)
pd_2 = PathDescription(Input_paths=input_paths)  # -> flatten(Paths)
item = ListItem(List=pd_2, Index=0, Wrap=True)
item_2 = ListItem(List=pd, Index=0, Wrap=True)
trim_if_path_longer = GhPythonScript(input_path=item, output_path=item_2)  # -> out, trim_bool, trim_number
# ---------- trim_if_path_longer: Python ----------
__author__ = "jmccarty"

import rhinoscriptsyntax as rs

input_ = len(input_path.split(";"))
output_ = len(output_path.split(";"))

if input_==output_:
    trim_bool = False
    trim_number = 0
else:
    trim_bool = True
    trim_number = output_ - input_
# ---------- end trim_if_path_longer ----------
trim = TrimTree(Input_data=output_paths, Depth=trim_if_path_longer.trim_number)
data = ClusterOutput(trim)
