# Grasshopper definition standalone_tilted_surfaces.gh (Grasshopper 1.0.7)

# ---- group: Controls
# Surface Design: For non integrated arrays a base surface needs to be created for the radiance simulations. This allows the panelizer a host surface to build multiple type of module convifgurations on that share a common irradiance map. Setting the depth parameters is therefore very important. It is recommended that the depth be set to at leas thte largest posisble module being tested. Other parameters:
# Useful Area - how much of the surface can you use. Note this parameter exists in the panelizer too.
# Primary tilt - the primary angle from the surface that the first set of the array is set to.
# Primary depth - the depth of the first set of the array
# Secondary tilt - while uncommon you can set the other side of the array to ahve a different angle.
# Secondary depth - If for some reason the second set of the array might be using a different module type you can set a different value here
# Worst angle - this is the worst profile angle of the sun for the occlusion of the primary surface.
# Primary Azimuth - the direction that the primary portion of the array will face. Note that this is not cardinal, but rrather a clockwise angle from the Y-vector of the surface. The possible range is 0 to 90 and only accepts integers.
primary_azimuth_max_90 = Slider(45, range=0..90)
number_slider = Slider(1.1, range=0..2)
number_slider_2 = Slider(1.1, range=0..2)
number_slider_3 = Slider(10, range=0..100)
worst_angle = Slider(8, range=0..100)
useful_area = Slider(1, range=0..1)
number_slider_4 = Slider(10, range=0..100)

# ----
brep = Brep(<brep referenced from the Rhino model>)
tilted_model_builder = TiltedModelBuilder(
    surface=brep,
    useful_area=useful_area,
    primary_tilt=number_slider_4,
    primary_depth=number_slider_2,
    secondary_tilt=number_slider_3,
    secondary_depth=number_slider,
    worst_angle=worst_angle,
    primary_azimuth=primary_azimuth_max_90)

# ==== cluster TiltedModelBuilder
surface = ClusterInput()
worst_angle = ClusterInput()
primary_azimuth = ClusterInput()
primary_depth = ClusterInput()
secondary_tilt = ClusterInput()
secondary_depth = ClusterInput()
useful_area = ClusterInput()
primary_tilt = ClusterInput()
surface_2 = Brep(surface)
primary_azimuth_2 = Number(primary_azimuth)
secondary_depth_2 = Number(secondary_depth)
secondary_tilt_2 = Number(secondary_tilt)
primary_depth_2 = Number(primary_depth)
worst_angle_2 = Number(worst_angle)
useful_area_2 = Number(useful_area)

# ---- group: For surfaces with holes get exterior curves
edges = BrepEdges(Brep=surface_2)  # -> Naked, Interior, NonManifold
cls = Closed(Curve=edges.Naked)  # -> Closed, Periodic
dispatch = Dispatch(List=edges.Naked, DispatchPattern=cls.Closed)  # -> ListA, ListB
crv = Curve(dispatch.ListB)
join = JoinCurves(Curves=crv, Preserve=False)
debrep = DeconstructBrep(Brep=join)  # -> simplify(Faces), Edges, Vertices
area = Area(Geometry=debrep.Faces)  # -> Area, Centroid
scale = Scale(Geometry=debrep.Faces, Center=area.Centroid, Factor=useful_area_2)  # -> Geometry, Transform

# ----
primary_tilt_2 = Number(primary_tilt)

# ---- group: Get Lower Left
brep = Brep(scale.Geometry)
area_2 = Area(Geometry=brep)  # -> Area, Centroid
evalsrf = EvaluateSurface(Surface=brep, Point=area_2.Centroid)  # -> Point, Normal, UDirection, VDirection, Frame
vec = VectorXYZ(XComponent=Slider(0, range=0..100), YComponent=Slider(1, range=0..1), ZComponent=Slider(0, range=0..100))  # -> Vector, Length
debrep_2 = DeconstructBrep(Brep=brep)  # -> Faces, Edges, Vertices
trim = TrimTree(Tree=debrep_2.Vertices, Depth=1)
pdecon = Deconstruct(Point=trim)  # -> XComponent, YComponent, ZComponent
sort = SortList(Keys=pdecon.ZComponent)  # -> Keys, ValuesA
cset = CreateSet(List=sort.Keys)  # -> Set, Map
item = ListItem(List=cset.Set, Index=0, Wrap=True)
mindex = MemberIndex(Set=pdecon.ZComponent, Member=item)  # -> Index, Count
trim_2 = TrimTree(Tree=mindex.Index, Depth=1)
item_2 = ListItem(List=trim, Index=trim_2, Wrap=True)
calc_angle_from_north = GhPythonScript(north_vector=vec.Vector, vector_b=evalsrf.Normal)  # -> out, angle; inputs north_vector: Vector3d, vector_b: Vector3d
# ---------- calc_angle_from_north: Python ----------
__author__ = "jmccarty_teach"

import rhinoscriptsyntax as rs
import math


x1 = north_vector.X
x2 = vector_b.X
y1 = north_vector.Y
y2 = vector_b.Y

a = (x1,y1)
b = (x2,y2)

ang1 = math.atan2(*a[::-1])
ang2 = math.atan2(*b[::-1])

angle = math.degrees((ang1 - ang2) % (2 * math.pi))
# ---------- end calc_angle_from_north ----------
pdecon_2 = Deconstruct(Point=item_2)  # -> XComponent, YComponent, ZComponent
angle_sorter = GhPythonScript(angle=calc_angle_from_north.angle, X=pdecon_2.XComponent, Y=pdecon_2.YComponent)  # -> out, dir, key; inputs X: list, Y: list
# ---------- angle_sorter: Python ----------
__author__ = "jmccarty_teach"

import rhinoscriptsyntax as rs
if angle < 90:
    print("North, largest X")
    dir = "X"
    key = max(X)
elif 90 <= angle < 180:
    print("East, lowest Y")
    dir = "Y"
    key = min(Y)
elif 180 <= angle < 270:
    print("South, lowest X")
    dir = "X"
    key = min(X)
elif angle >= 270:
    print("West, largest Y")
    dir = "Y"
    key = max(Y)
# ---------- end angle_sorter ----------
python = GhPythonScript(dir=angle_sorter.dir, key=angle_sorter.key, x_list=pdecon_2.XComponent, y_list=pdecon_2.YComponent)  # -> out, out_dir, index; inputs x_list: list, y_list: list
# ---------- python: Python ----------
__author__ = "jmccarty_teach"

import rhinoscriptsyntax as rs

if dir=="X":
    out_dir = "X"
    index = x_list.index(key)
else:
    out_dir = "Y"
    index = y_list.index(key)
# ---------- end python ----------
item_3 = ListItem(List=item_2, Index=python.index, Wrap=True)

# ----
pt_lower_left = Point(item_3)

# ---- group: Dispatch Flat Roof
evalsrf_2 = EvaluateSurface(Surface=brep, Point=area_2.Centroid)  # -> Point, Normal, UDirection, VDirection, Frame
devec = DeconstructVector(Vector=evalsrf_2.Normal)  # -> XComponent, YComponent, ZComponent
equalst = EqualityWithinTolerance(FirstNumber=devec.ZComponent, SecondNumber=Slider(1, range=-1..1), Tolerance=0.01)  # -> Equality, Inequality
dispatch_2 = Dispatch(List=brep, DispatchPattern=equalst.Equality)  # -> ListA, ListB
dispatch_3 = Dispatch(List=evalsrf_2.Normal, DispatchPattern=equalst.Equality)  # -> ListA, ListB
dispatch_4 = Dispatch(List=pt_lower_left, DispatchPattern=equalst.Equality)  # -> ListA, ListB
clean = CleanTree(RemoveNulls=True, RemoveInvalid=True, RemoveEmpty=True, Tree=dispatch_4.ListB)
clean_2 = CleanTree(RemoveNulls=True, RemoveInvalid=True, RemoveEmpty=True, Tree=dispatch_2.ListB)
clean_3 = CleanTree(RemoveNulls=True, RemoveInvalid=True, RemoveEmpty=True, Tree=dispatch_3.ListB)

# ---- group: Tilted Surface Planes
wires = BrepWireframe(Brep=clean_2, Density=-1)
trim_helper = TrimHelper(output_paths=wires, input_paths=clean)
midpt = CurveMiddle(Curve=trim_helper)
pdecon_3 = Deconstruct(Point=midpt)  # -> XComponent, YComponent, ZComponent
pdecon_4 = Deconstruct(Point=clean)  # -> XComponent, YComponent, ZComponent
equalst_2 = EqualityWithinTolerance(FirstNumber=pdecon_3.ZComponent, SecondNumber=pdecon_4.ZComponent, Tolerance=Slider(0.01, range=0..1.5))  # -> Equality, Inequality
dispatch_5 = Dispatch(List=midpt, DispatchPattern=equalst_2.Equality)  # -> ListA, ListB
pl = PlaneNormal(Origin=clean, ZAxis=clean_3)
vec2pt = Vector2Pt(PointA=clean, PointB=dispatch_5.ListA, Unitize=False)  # -> Vector, Length
align = AlignPlane(Plane=pl, Direction=vec2pt.Vector)  # -> Plane, Angle

# ----
calculate_row_distance = GhPythonScript(
    primary_tilt=primary_tilt_2,
    primary_depth=primary_depth_2,
    secondary_tilt=secondary_tilt_2,
    secondary_depth=secondary_depth_2,
    worst_angle=worst_angle_2)  # -> out, d_contour, x, x_p, y_p, y_s
# ---------- calculate_row_distance: Python ----------
__author__ = "jmccarty"

from math import tan, cos, sin, radians

theta_p = radians(primary_tilt)
theta_s = radians(secondary_tilt)
theta_w = radians(worst_angle)

x_p = cos(theta_p) * primary_depth
y_p = sin(theta_p) * primary_depth
y_s = sin(theta_s) * secondary_depth
y = max(y_p, y_s)

x_s = cos(theta_s) * secondary_depth
x = x_p + x_s

sx_s = y / tan(theta_w)
s = max(0, sx_s - x_s)

d_contour = round(x_p + x_s + s,3)
x = round(x,3)
x_p = round(x_p,3)
y_p = round(y_p,3)
y_s = round(y_s,3)
# ---------- end calculate_row_distance ----------

# ---- group: Extend roof to clean up excess surface
evalsrf_3 = EvaluateSurface(Surface=debrep.Faces, Point=area.Centroid)  # -> Point, Normal, UDirection, VDirection, Frame
amp = Amplitude(Vector=evalsrf_3.Normal, Amplitude=15)
crv_2 = Curve(scale.Geometry)
extr = Extrude(Base=crv_2, Direction=amp)

# ---- group: Flat Roof PLanes
clean_4 = CleanTree(RemoveNulls=True, RemoveInvalid=True, RemoveEmpty=True, Tree=dispatch_4.ListA)
clean_5 = CleanTree(RemoveNulls=True, RemoveInvalid=True, RemoveEmpty=True, Tree=dispatch_2.ListA)
wires_2 = BrepWireframe(Brep=clean_5, Density=-1)
pt = Point(clean_4)
trim_helper_2 = TrimHelper(output_paths=wires_2, input_paths=pt)

# ---- group: Flat Roof PLanes / Join boundary curves for each surface and find the outside curve by comparing the area of any curves in the set.
join_2 = JoinCurves(Curves=trim_helper_2, Preserve=False)

# ---- group: Flat Roof PLanes (continued)
area_3 = Area(Geometry=join_2)  # -> Area, Centroid

# ---- group: Flat Roof PLanes / Join boundary curves for each surface and find the outside curve by comparing the area of any curves in the set. (continued)
sort_2 = SortList(Keys=area_3.Area, ValuesA=join_2)  # -> Keys, reverse(ValuesA)
item_4 = ListItem(List=sort_2.ValuesA, Index=0, Wrap=True)
trim_helper_3 = TrimHelper(output_paths=item_4, input_paths=pt)

# ---- group: Flat Roof PLanes / generate curve to all segments from boundary origin. test if midpoint of new curve intersects with the boundary curve. use this to build initial plane.
midpt_2 = CurveMiddle(Curve=trim_helper_2)
ln = Line(StartPoint=pt, EndPoint=midpt_2)
len = Length(Curve=ln)
sort_3 = SortList(Keys=len, ValuesA=ln)  # -> Keys, ValuesA
midpt_3 = CurveMiddle(Curve=sort_3.ValuesA)
incurve = PointInCurve(Point=midpt_3, Curve=trim_helper_3)  # -> Relationship, Point
equals = Equality(FirstNumber=incurve.Relationship, SecondNumber=Slider(1, range=0..1))  # -> Equality, Inequality
dispatch_6 = Dispatch(List=midpt_3, DispatchPattern=equals.Equality)  # -> ListA, ListB
pt_2 = Point(dispatch_6.ListA)
split = SplitList(List=pt_2, Index=Slider(1, range=0..1))  # -> ListA, ListB
trim_helper_4 = TrimHelper(output_paths=split.ListB, input_paths=pt_2)
trim_helper_5 = TrimHelper(output_paths=split.ListA, input_paths=pt_2)
pl_3pt = Plane3Pt(PointA=pt, PointB=trim_helper_5, PointC=trim_helper_4)
deplane = DeconstructPlane(Plane=pl_3pt)  # -> Origin, XAxis, YAxis, ZAxis

# ---- group: Flat Roof PLanes / Create base XY plane and align. Test aligns to see which has X and Y vectors that lie on the surface boundary
xy = XYPlane(Origin=pt)
align_2 = AlignPlane(Plane=xy, Direction=deplane.XAxis)  # -> Plane, Angle
align_3 = AlignPlane(Plane=xy, Direction=deplane.YAxis)  # -> Plane, Angle
deplane_2 = DeconstructPlane(Plane=align_2.Plane)  # -> Origin, XAxis, YAxis, ZAxis
deplane_3 = DeconstructPlane(Plane=align_3.Plane)  # -> Origin, XAxis, YAxis, ZAxis
vdis = VectorDisplay(Anchor=pt, Vector=deplane_3.XAxis)
vdis_2 = VectorDisplay(Anchor=pt, Vector=deplane_3.YAxis)
number_slider = Slider(0.1, range=0..0.1)
line = LineSDL(Start=pt, Direction=deplane_2.XAxis, Length=number_slider)
line_2 = LineSDL(Start=pt, Direction=deplane_2.YAxis, Length=number_slider)
line_3 = LineSDL(Start=pt, Direction=deplane_3.XAxis, Length=number_slider)
line_4 = LineSDL(Start=pt, Direction=deplane_3.YAxis, Length=number_slider)
end = EndPoints(Curve=line)  # -> Start, End
end_2 = EndPoints(Curve=line_2)  # -> Start, End
end_3 = EndPoints(Curve=line_3)  # -> Start, End
end_4 = EndPoints(Curve=line_4)  # -> Start, End
incurve_2 = PointInCurve(Point=end_2.End, Curve=trim_helper_3)  # -> Relationship, Point
incurve_3 = PointInCurve(Point=end_4.End, Curve=trim_helper_3)  # -> Relationship, Point
incurve_4 = PointInCurve(Point=end_3.End, Curve=trim_helper_3)  # -> Relationship, Point
incurve_5 = PointInCurve(Point=end.End, Curve=trim_helper_3)  # -> Relationship, Point
addition = Addition(A=incurve_5.Relationship, B=incurve_2.Relationship)
number_slider_2 = Slider(2, range=0..10)
addition_2 = Addition(A=incurve_4.Relationship, B=incurve_3.Relationship)
equals_2 = Equality(FirstNumber=addition_2, SecondNumber=number_slider_2)  # -> Equality, Inequality
equals_3 = Equality(FirstNumber=addition, SecondNumber=number_slider_2)  # -> Equality, Inequality
dispatch_7 = Dispatch(List=align_2.Plane, DispatchPattern=equals_3.Equality)  # -> ListA, ListB
dispatch_8 = Dispatch(List=align_3.Plane, DispatchPattern=equals_2.Equality)  # -> ListA, ListB
merge = Merge(Data1=dispatch_7.ListA, Data2=dispatch_8.ListA)

# ---- group: Planes
merge_2 = Merge(Data1=align.Plane, Data2=merge)

# ----
item_5 = ListItem(List=merge_2, Index=0, Wrap=True)

# ---- group: Determine origin point for contour operation
deplane_4 = DeconstructPlane(Plane=item_5)  # -> Origin, XAxis, YAxis, ZAxis
boolean_toggle = BooleanToggle(True)
boolean_toggle_2 = BooleanToggle(False)
line_5 = LineSDL(Start=deplane_4.Origin, Direction=deplane_4.YAxis, Length=1)
line_6 = LineSDL(Start=deplane_4.Origin, Direction=deplane_4.ZAxis, Length=1)
rotate_3d = Rotate3D(
    geometry=line_5,
    angle=primary_azimuth_2,
    clockwise=boolean_toggle_2,
    degree=boolean_toggle,
    center=deplane_4.Origin,
    axis=line_6)  # -> geometry_2, transform
rotate_3d_2 = Rotate3D(
    geometry=item_5,
    angle=primary_azimuth_2,
    clockwise=boolean_toggle_2,
    degree=boolean_toggle,
    center=deplane_4.Origin,
    axis=line_6)  # -> geometry_2, transform
end_5 = EndPoints(Curve=rotate_3d.geometry_2)  # -> Start, End
vec2pt_2 = Vector2Pt(PointA=end_5.Start, PointB=end_5.End, Unitize=Toggle(True))  # -> Vector, Length
bbox = BoundingBox(Content=scale.Geometry, Plane=rotate_3d_2.geometry_2)  # -> simplify(Box), Box_2
pt_3 = Point(pt_lower_left)
debrep_3 = DeconstructBrep(Brep=bbox.Box)  # -> Faces, Edges, simplify(Vertices)
cset_2 = CreateSet(List=debrep_3.Vertices)  # -> Set, Map
vec2pt_3 = Vector2Pt(PointA=pt_lower_left, PointB=cset_2.Set, Unitize=Toggle(True))  # -> Vector, Length
vlen = VectorLength(Vector=vec2pt_3.Vector)
larger = LargerThan(FirstNumber=vlen, SecondNumber=0)  # -> LargerThan, OrEqualTo
dispatch_9 = Dispatch(List=vec2pt_3.Vector, DispatchPattern=larger.LargerThan)  # -> ListA, ListB
angle = Angle(VectorA=vec2pt_2.Vector, VectorB=dispatch_9.ListA, Plane=item_5)  # -> Angle, Reflex
deg = Degrees(Radians=angle.Angle)
python_2 = GhPythonScript(x=deg)  # -> out, a
# ---------- python_2: Python ----------
__author__ = "jmccarty"

import rhinoscriptsyntax as rs
import math 
a = round(x,2)
# ---------- end python_2 ----------
equals_4 = Equality(FirstNumber=python_2.a, SecondNumber=90)  # -> Equality, Inequality
dispatch_10 = Dispatch(List=cset_2.Set, DispatchPattern=equals_4.Equality)  # -> ListA, ListB
pt_4 = Point(dispatch_10.ListA)
python_3 = GhPythonScript(x=primary_azimuth_2, og=pt_3, new=pt_4)  # -> out, a; inputs x: Int32, og: tree of Point3d, new: tree of Point3d
# ---------- python_3: Python ----------
__author__ = "jmccarty"

import rhinoscriptsyntax as rs

if x==0:
    a = og
elif x==90:
    a = og
else:
    a = new
# ---------- end python_3 ----------

# ---- group: Get bounding box face
area_4 = Area(Geometry=debrep_3.Faces)  # -> Area, Centroid
sort_4 = SortList(Keys=area_4.Area, ValuesA=debrep_3.Faces)  # -> Keys, reverse(ValuesA)
item_6 = ListItem(List=sort_4.ValuesA, Index=0, Wrap=True)

# ---- group: Main Contour
contour = Contour(Shape=item_6, Point=python_3.a, Direction=vec2pt_2.Vector, Distance=calculate_row_distance.d_contour)
trim_3 = TrimTree(Tree=contour, Depth=1)

# ----
amp_2 = Amplitude(Vector=vec2pt_2.Vector, Amplitude=calculate_row_distance.x_p)
move = Move(Geometry=trim_3, Motion=amp_2)  # -> Geometry, Transform

# ---- group: secondary lower rail
amp_3 = Amplitude(Vector=vec2pt_2.Vector, Amplitude=calculate_row_distance.x)
move_2 = Move(Geometry=trim_3, Motion=amp_3)  # -> Geometry, Transform
graft = GraftTree(Tree=move_2.Geometry, IncludeEmptyLists=True, IncludeNullItems=True)

# ---- group: primary_upper rail
amp_4 = Amplitude(Vector=deplane_4.ZAxis, Amplitude=calculate_row_distance.y_p)
move_3 = Move(Geometry=move.Geometry, Motion=amp_4)  # -> graft(Geometry), Transform

# ---- group: secondary upper rail
amp_5 = Amplitude(Vector=deplane_4.ZAxis, Amplitude=calculate_row_distance.y_s)
move_4 = Move(Geometry=move.Geometry, Motion=amp_5)  # -> graft(Geometry), Transform

# ---- group: primary lower rail
graft_2 = GraftTree(Tree=trim_3, IncludeEmptyLists=True, IncludeNullItems=True)

# ---- group: Module Surface
loft = Loft(
    Curves=[graft_2, move_3.Geometry],
    Options={Adjust=False, Closed=False, LoftEnds=0, LoftSimp=0, LoftType=0, Rebuild=10, Refit=0.01})
loft_2 = Loft(
    Curves=[graft, move_4.Geometry],
    Options={Adjust=False, Closed=False, LoftEnds=0, LoftSimp=0, LoftType=0, Rebuild=10, Refit=0.01})
trim_4 = TrimTree(Tree=loft, Depth=1)
trim_5 = TrimTree(Tree=loft_2, Depth=1)
merge_3 = Merge(Data1=trim_4, Data2=trim_5)  # -> simplify(Result)

# ---- group: Split Surfaces that extend beyond roof useable area
bbx = BrepBrep(BrepA=simplify(extr), BrepB=merge_3)  # -> Curves, Points
srfsplit = SurfaceSplit(Surface=graft(merge_3), Curves=bbx.Curves)
cap = CapHoles(Brep=extr)
trim_6 = TrimTree(Tree=srfsplit, Depth=2)

# ---- group: Modules with centers in main roof area
area_5 = Area(Geometry=trim_6)  # -> Area, Centroid
brepinc = PointInBrep(Brep=cap, Point=area_5.Centroid, Strict=False)
dispatch_11 = Dispatch(List=trim_6, DispatchPattern=brepinc)  # -> ListA, ListB

# ---- group: Cut holes from obstructions like chimneys
brep_2 = Brep()
crv_3 = Curve(brep_2)
extr_2 = Extrude(Base=crv_3, Direction=amp)
extr_3 = Extrude(Base=brep_2, Direction=amp)
bbx_2 = BrepBrep(BrepA=simplify(extr_2), BrepB=merge_3)  # -> Curves, Points
srfsplit_2 = SurfaceSplit(Surface=graft(dispatch_11.ListA), Curves=bbx_2.Curves)
cap_2 = CapHoles(Brep=extr_3)
trim_7 = TrimTree(Tree=srfsplit_2, Depth=2)
area_6 = Area(Geometry=trim_7)  # -> Area, Centroid
lng = ListLength(List=trim_7)
repeat = RepeatData(Data=1, Length=lng)  # -> simplify(Data)
brepinc_2 = PointInBrep(Brep=cap_2, Point=area_6.Centroid, Strict=False)
subtraction = Subtraction(A=repeat, B=brepinc_2)
dispatch_12 = Dispatch(List=trim_7, DispatchPattern=subtraction)  # -> ListA, ListB
brep_3 = Brep(dispatch_12.ListA)

# ---- group: Clean Up Normals
area_7 = Area(Geometry=brep_3)  # -> Area, Centroid
evalsrf_4 = EvaluateSurface(Surface=brep_3, Point=area_7.Centroid)  # -> Point, Normal, UDirection, VDirection, Frame
devec_2 = DeconstructVector(Vector=evalsrf_4.Normal)  # -> XComponent, YComponent, ZComponent
smaller = SmallerThan(FirstNumber=devec_2.ZComponent, SecondNumber=0)  # -> SmallerThan, OrEqualTo
dispatch_13 = Dispatch(List=brep_3, DispatchPattern=smaller.SmallerThan)  # -> ListA, ListB
flip = Flip(Surface=dispatch_13.ListA)  # -> Surface, Result
panel = Panel("output_raised_surfaces")
merge_4 = Merge(Data1=flip.Surface, Data2=dispatch_13.ListB)  # -> flatten(Result)

# ----
panel_surfaces = Brep(merge_4)
panel_surfaces_2 = ClusterOutput(panel_surfaces)

# ==== cluster TrimHelper
output_paths = ClusterInput()
input_paths = ClusterInput()
pd = PathDescription(Output_paths=output_paths)  # -> flatten(Paths)
pd_2 = PathDescription(Input_paths=input_paths)  # -> flatten(Paths)
item = ListItem(List=pd_2, Index=0, Wrap=True)
item_2 = ListItem(List=pd, Index=0, Wrap=True)
trim_if_path_longer = GhPythonScript(input_path=item, output_path=item_2)  # -> out, trim_bool, trim_number
# ---------- trim_if_path_longer: Python ----------
__author__ = "jmccarty"

import rhinoscriptsyntax as rs

input_ = len(input_path.split(";"))
output_ = len(output_path.split(";"))

if input_==output_:
    trim_bool = False
    trim_number = 0
else:
    trim_bool = True
    trim_number = output_ - input_
# ---------- end trim_if_path_longer ----------
trim = TrimTree(Input_data=output_paths, Depth=trim_if_path_longer.trim_number)
data = ClusterOutput(trim)

# ==== cluster Rotate3D: Rotate an object around a center point and an axis vector.
geometry = ClusterInput()
angle = ClusterInput()  # Rotation Angle in Radians
clockwise = ClusterInput()  # Clockwise Rotation or Anticlockwise
degree = ClusterInput()  # Degree or Radian
center = ClusterInput()
axis = ClusterInput()
number = Number(flatten(angle))
negative = Negative(Value=number)
boolean = Boolean(clockwise)
boolean_2 = Boolean(degree)
number_2 = Number([negative, number])
list_item = ListItem(List=number_2, Index=boolean, Wrap=True)
radians = Radians(Degrees=list_item)
number_3 = Number([list_item, radians])
list_item_2 = ListItem(List=number_3, Index=boolean_2, Wrap=True)
rotate_3d = Rotate3D(Geometry=geometry, Angle=list_item_2, Center=center, Axis=axis)  # -> Geometry, Transform
transform = ClusterOutput(rotate_3d.Transform)
geometry_2 = ClusterOutput(rotate_3d.Geometry)
